# Dynamo graph Dynamo Application.dyn (Dynamo 2.19.3.6394)
# packages: Orchid 2.19.3.6366

# group: User default Packages and Definitions Path
code_block = CodeBlock { Orchid.AdeskApp.Dynamo.DefaultPackagesPath; Orchid.AdeskApp.Dynamo.DefaultDefinitionsPath; }
watch = Watch(code_block.out0)
watch_2 = Watch(code_block.out1)
defaultDefinitionsPath = Orchid.AdeskApp.Dynamo.DefaultDefinitionsPath()
watch_3 = Watch(defaultDefinitionsPath)
defaultPackagesPath = Orchid.AdeskApp.Dynamo.DefaultPackagesPath()
watch_4 = Watch(defaultPackagesPath)

# group: Packages and Definitions Path
packagesPath = Orchid.AdeskApp.Dynamo.PackagesPath()
watch_5 = Watch(packagesPath)
definitionsPath = Orchid.AdeskApp.Dynamo.DefinitionsPath()
watch_6 = Watch(definitionsPath)

# group: Dynamo info
graphPath = Orchid.AdeskApp.Dynamo.GraphPath()
watch_7 = Watch(graphPath)
graphGuid = Orchid.AdeskApp.Dynamo.GraphGuid()
watch_8 = Watch(graphGuid)
version = Orchid.AdeskApp.DynamoCore.Version()
watch_9 = Watch(version)
versionBuild = Orchid.AdeskApp.DynamoCore.VersionBuild()
watch_10 = Watch(versionBuild)
applicationFolder = Orchid.AdeskApp.Dynamo.ApplicationFolder()
watch_11 = Watch(applicationFolder)
version_2 = Orchid.AdeskApp.DynamoRevit.Version()
watch_12 = Watch(version_2)
versionBuild_2 = Orchid.AdeskApp.DynamoRevit.VersionBuild()
watch_13 = Watch(versionBuild_2)

# group: obsolete
version_3 = Orchid.AdeskApp.Dynamo.Version()
watch_14 = Watch(version_3)
versionBuild_3 = Orchid.AdeskApp.Dynamo.VersionBuild()
watch_15 = Watch(versionBuild_3)
