# Dynamo graph Orchid Application.dyn (Dynamo 2.19.3.6394)
# packages: Orchid 2.19.3.6366

packageFolder = Orchid.Common.Orchid.PackageFolder()
watch = Watch(packageFolder)
version = Orchid.Common.Orchid.Version()
watch_2 = Watch(version)
versionBuild = Orchid.Common.Orchid.VersionBuild()
watch_3 = Watch(versionBuild)
