# Dynamo graph Culture.dyn (Dynamo 3.6.2.11575)
# packages: Orchid 3.6.0.6844

# group: Culture name, by name, and display name
code_block = CodeBlock { "da-DK"; }
byName = Orchid.Common.Global.Culture.ByName(name=code_block)
displayName = Orchid.Common.Global.Culture.DisplayName(culture=byName)
watch = Watch(displayName)
name = Orchid.Common.Global.Culture.Name(culture=byName)
watch_2 = Watch(name)
watch_3 = Watch(byName)
culture = Culture("da-DK")

# group: Current culture Current revit culture
current = Orchid.Common.Global.Culture.Current()
culture_2 = Orchid.AdeskApps.Revit.Culture()
edit = Orchid.Common.Global.Culture.Edit(culture=culture_2)

# group: All Cultures
all = Orchid.Common.Global.Culture.All()
watch_4 = Watch(all)

# group: All Languages
all_2 = Orchid.AdeskApps.Language.All()
watch_5 = Watch(all_2)

# group: Language name and by name
code_block_2 = CodeBlock { "English_USA"; }
watch_6 = Watch(code_block_2)
language = Orchid.AdeskApps.Revit.Language()
culture_3 = Orchid.AdeskApps.Language.Culture(language=language)
watch_7 = Watch(culture_3)
byName_2 = Orchid.AdeskApps.Language.ByName(name=code_block_2)
watch_8 = Watch(byName_2)
revit_languages = Language("English_USA")

# group: Modify number
code_block_3 = CodeBlock { 4; ","; }
numberFormat = Orchid.Common.Global.Culture.NumberFormat(culture=edit, digit=code_block_3.out0, decimal=code_block_3.out1)
numberSymbolFormat = Orchid.Common.Global.Culture.NumberSymbolFormat(culture=numberFormat)

# group: Modify percentage
code_block_4 = CodeBlock { 4; ",,"; }
percentageFormat = Orchid.Common.Global.Culture.PercentageFormat(culture=edit, digit=code_block_4.out0, decimal=code_block_4.out1)
percentSymbolFormat = Orchid.Common.Global.Culture.PercentSymbolFormat(culture=percentageFormat)

# group: Modify currency
code_block_5 = CodeBlock { 4; ".."; "#"; }
currencyFormat = Orchid.Common.Global.Culture.CurrencyFormat(culture=edit, digit=code_block_5.out0, decimal=code_block_5.out1)
currencySymbolFormat = Orchid.Common.Global.Culture.CurrencySymbolFormat(culture=currencyFormat, symbol=code_block_5.out2)

# group: Modify calendar, time and date
code_block_6 = CodeBlock { "Tuesday"; }
calendarFormat = Orchid.Common.Global.Culture.CalendarFormat(culture=edit, firstDay=code_block_6)
dateTimeFormat = Orchid.Common.Global.Culture.DateTimeFormat(culture=calendarFormat)
dateFormat = Orchid.Common.Global.Culture.DateFormat(culture=dateTimeFormat)
timeFormat = Orchid.Common.Global.Culture.TimeFormat(culture=dateFormat)

# group: DateTime
today = DateTime.Today()
format = DateTime.Format(dateTime=today)
watch_9 = Watch(format)
dayOfWeek = DateTime.DayOfWeek(dateTime=today)
watch_10 = Watch(dayOfWeek)
