# Dynamo graph DocumentInfo.dyn "ApplicationInfo" (Dynamo 2.19.3.6394)
# packages: Orchid 2.19.3.6366

# group: Document info
info = Orchid.RevitProject.Common.Document.Info()
watch = Watch(info)
unit = Orchid.RevitProject.Common.Document.Unit()
watch_2 = Watch(unit)
path = Orchid.RevitProject.Common.Document.Path()
watch_3 = Watch(path)
name = Orchid.RevitProject.Common.Document.Name()
watch_4 = Watch(name)
directory = Orchid.RevitProject.Common.Document.Directory()
watch_5 = Watch(directory)
