# Dynamo graph Dynamo Application.dyn (Dynamo 2.19.3.6394)
# packages: Orchid 2.19.5.6567

# group: User default Packages and Definitions Path
code_block = CodeBlock { Orchid.AdeskApps.Dynamo.DefaultPackagesPath; Orchid.AdeskApps.Dynamo.DefaultDefinitionsPath; }
watch = Watch(code_block.out0)
watch_2 = Watch(code_block.out1)
defaultDefinitionsPath = Orchid.AdeskApps.Dynamo.DefaultDefinitionsPath()
watch_3 = Watch(defaultDefinitionsPath)
defaultPackagesPath = Orchid.AdeskApps.Dynamo.DefaultPackagesPath()
watch_4 = Watch(defaultPackagesPath)

# group: Packages and Definitions Path
definitionsPath = Orchid.AdeskApps.Dynamo.DefinitionsPath()
watch_5 = Watch(definitionsPath)
packagesPath = Orchid.AdeskApps.Dynamo.PackagesPath()
watch_6 = Watch(packagesPath)

# group: Dynamo info
graphPath = Orchid.AdeskApps.Dynamo.GraphPath()
watch_7 = Watch(graphPath)
graphGuid = Orchid.AdeskApps.Dynamo.GraphGuid()
watch_8 = Watch(graphGuid)
version = Orchid.AdeskApps.DynamoCore.Version()
watch_9 = Watch(version)
versionBuild = Orchid.AdeskApps.DynamoCore.VersionBuild()
watch_10 = Watch(versionBuild)
applicationFolder = Orchid.AdeskApps.Dynamo.ApplicationFolder()
watch_11 = Watch(applicationFolder)
version_2 = Orchid.AdeskApps.DynamoRevit.Version()
watch_12 = Watch(version_2)
versionBuild_2 = Orchid.AdeskApps.DynamoRevit.VersionBuild()
watch_13 = Watch(versionBuild_2)
