# Dynamo graph EnumerationHandling.dyn (Dynamo 2.19.3.6394)
# packages: Orchid 2.19.5.6567

# group: Revit enumeration by enum type and value
view_duplicate_options = ViewDuplicateOption("AsDependent")
code_block = CodeBlock { "ViewDuplicateOption"; "AsDependent"; }
enumByName = Orchid.AdeskApps.Revit.EnumByName(enumType=code_block.out0, valueName=code_block.out1)
type = Object.Type(object=enumByName)
watch = Watch(type)

# group: Orchid enumeration by enum type and value
light_loss_factors = LossFactor("Basic loss factor")
code_block_2 = CodeBlock { "LossFactor"; "Basic"; }
enumByName_2 = Orchid.Common.Orchid.EnumByName(enumType=code_block_2.out0, valueName=code_block_2.out1)
type_2 = Object.Type(object=enumByName_2)
watch_2 = Watch(type_2)

# group: Enumeration by assembly, enum type, and value
code_block_3 = CodeBlock { "RevitAPI"; "ZoomType"; "Zoom"; }
enumByName_3 = Orchid.Common.Object.EnumByName(assemblyName=code_block_3.out0, enumType=code_block_3.out1, valueName=code_block_3.out2)
type_3 = Object.Type(object=enumByName_3)
watch_3 = Watch(type_3)
print_zoom_type = ZoomType("Zoom")

# group: Revit (MEP System) enumeration by enum type and value
code_block_4 = CodeBlock { "ElectricalSystemType"; "Data"; }
enumByName_4 = Orchid.AdeskApps.Revit.EnumByName(enumType=code_block_4.out0, valueName=code_block_4.out1)
type_4 = Object.Type(object=enumByName_4)
watch_4 = Watch(type_4)
electrical_system_types = ElectricalSystemType("Data")

# group: Revit (Material/Structural) enumeration by enum type and value
code_block_5 = CodeBlock { "StructuralAssetClass"; "Concrete"; }
enumByName_5 = Orchid.AdeskApps.Revit.EnumByName(enumType=code_block_5.out0, valueName=code_block_5.out1)
type_5 = Object.Type(object=enumByName_5)
watch_5 = Watch(type_5)
physical_type = PhysicalType("Concrete")

# group: Revit (Material/Termal) enumeration by enum type and value
thermal_type = ThermalType("Liquid")
code_block_6 = CodeBlock { "ThermalMaterialType"; "Liquid"; }
enumByName_6 = Orchid.AdeskApps.Revit.EnumByName(enumType=code_block_6.out0, valueName=code_block_6.out1)
type_6 = Object.Type(object=enumByName_6)
watch_6 = Watch(type_6)

# group: Dynamo enumeration by enum type and value
code_block_7 = CodeBlock()
# ---------- code_block_7.designscript (8 lines) ----------
//Enums
["ScheduleType",
"StructuralType",
"RuleType"];
//Values
["RegularSchedule",
"Column",
"Greater"];
# ----------------------------------------
enumByName_7 = Orchid.AdeskApps.Dynamo.EnumByName(enumType=code_block_7.out0, valueName=code_block_7.out1)
type_7 = Object.Type(object=enumByName_7)
watch_7 = Watch(type_7)
