# Dynamo graph File.NewProject.dyn (Dynamo 2.19.3.6394)
# packages: Orchid 2.19.3.6432

# group: Template and New Projects
directory_path = StringInput("%OrchidSamples%\Data\testSet\")  # graph input
project_file_name = CodeBlock { ["new1", "new2"]; }
extension = StringInput(".rvt")  # graph input
code_block = CodeBlock(a=directory_path, b=project_file_name, c=extension) { a+b+c; }
template_path = StringInput("C:\ProgramData\Autodesk\RVT 2024\Templates\DanEDU\DanEDU Building.rte")  # graph input

# group: Template and New Projects
template_path_2 = StringInput("C:\ProgramData\Autodesk\RVT 2024\Templates\DanEDU\DanEDU Systems.rte")  # graph input
directory_path_2 = StringInput("%OrchidSamples%\Data\testSet\")  # graph input
project_file_name_2 = CodeBlock { ["new3", "new4"]; }
extension_2 = StringInput(".rvt")  # graph input
code_block_2 = CodeBlock(a=directory_path_2, b=project_file_name_2, c=extension_2) { a+b+c; }

create = List.Create(item0=template_path, item1=template_path_2)
newProject = Orchid.RevitProject.Common.Document.NewProject(file=code_block, template=create)
watch = Watch(newProject)
newProject_2 = Orchid.RevitProject.Common.Document.NewProject(file=code_block_2, template=template_path_2)
watch_2 = Watch(newProject_2)
