# Dynamo graph Forge.dyn (Dynamo 2.19.3.6394)
# packages: Orchid 2.19.5.6567

# group: Type test
group_types = GroupTypes("autodesk.revit.group:railingSystemSegmentUGrid")
type = Object.Type(object=group_types)
watch = Watch(group_types)

# group: GroupType
group_types_2 = GroupTypes("autodesk.parameter.group:adskModelProperties")
name = Orchid.AdeskApps.Units.GroupType.Name(type=group_types_2)
watch_2 = Watch(name)
code_block = CodeBlock { "Geometry"; }
byName = Orchid.AdeskApps.Units.GroupType.ByName(string=name)
watch_3 = Watch(byName)
typeId = ForgeType.TypeId(forgeType=group_types_2)
byTypeId = GroupType.ByTypeId(typeId=typeId)
watch_4 = Watch(byTypeId)

# group: SpecType
code_block_2 = CodeBlock { "FillPattern"; }
spec_types = SpecTypes("autodesk.spec.string:url")
name_2 = Orchid.AdeskApps.Units.SpecType.Name(type=spec_types)
watch_5 = Watch(name_2)
typeId_2 = ForgeType.TypeId(forgeType=spec_types)
byTypeId_2 = SpecType.ByTypeId(typeId=typeId_2)
watch_6 = Watch(byTypeId_2)
byName_2 = Orchid.AdeskApps.Units.SpecType.ByName(string=name_2)
watch_7 = Watch(byName_2)

# group: Unit
units = Units("Candelas per square meter")
typeId_3 = DynamoUnits.Unit.TypeId(unit=units)
byTypeID = DynamoUnits.Unit.ByTypeID(typeId=typeId_3)
watch_8 = Watch(byTypeID)
name_3 = DynamoUnits.Unit.Name(unit=units)
watch_9 = Watch(name_3)

# group: Type test
spec_types_2 = SpecTypes("autodesk.spec.aec:fillPattern")
watch_10 = Watch(spec_types_2)
type_2 = Object.Type(object=spec_types_2)

code_block_3 = CodeBlock()
# ---------- code_block_3.designscript (38 lines) ----------
// Special Case return values
"Electrical Frequency";
"Electrical Power";
"Electrical Power Density";
"Electrical Temperature";
"Electrical Temperature Difference";

"HVAC Density";
"HVAC Energy";
"HVAC Friction";
"HVAC Mass per Time";
"HVAC Power";
"HVAC Power Density";
"HVAC Pressure";
"HVAC Roughness";
"HVAC Slope";
"HVAC Temperature";
"HVAC Temperature Difference";
"HVAC Velocity";
"HVAC Viscosity";

"Pipe Mass per Unit Length";
"Pipe Mass";
"Piping Density";
"Piping Flow";
"Piping Friction";
"Piping Mass per Time";
"Piping Pressure";
"Piping Roughness";
"Piping Slope";
"Piping Temperature";
"Piping Temperature Difference";
"Piping Velocity";
"Piping Viscosity";
"Piping Volume";

"Structural Frequency";
"Structural Velocity";
# ----------------------------------------
code_block_4 = CodeBlock()
# ---------- code_block_4.designscript (7 lines) ----------
// Special Case return values
"Dimensions (linear units or % of thickness)";
"Stair Supports";
"Curtain U Grid";
"Railing U Grid";
"Curtain V Grid";
"Railing V Grid";
# ----------------------------------------
