# Dynamo graph MergePDF.dyn (Dynamo 3.6.1.9895)
# packages: Orchid 3.6.0.6844

# group: Merge pdf's into one pdf file
code_block = CodeBlock()
# ---------- code_block.designscript (13 lines) ----------
//input documents
["C:\\Users\\Public\\Temp\\pdf\\pdf1.pdf",
"C:\\Users\\Public\\Temp\\pdf\\pdf2.pdf"];

//output file path
"C:\\Users\\Public\\Temp\\pdf\\result.pdf";

//try providing only a directory,
//this should fail!
"C:\\Users\\Public\\Temp\\pdf";

//create if not exists
true;
# ----------------------------------------
mergePDF = Orchid.Common.File.MergePDF(documents=code_block.out0, filePath=code_block.out1, create=code_block.out3)
watch = Watch(mergePDF)
