# Dynamo graph Orchid Application.dyn (Dynamo 3.6.1.9895)
# packages: Orchid 3.6.0.6844

packageFolder = Orchid.Common.Orchid.PackageFolder()
watch = Watch(packageFolder)
version = Orchid.Common.Orchid.Version()
watch_2 = Watch(version)
versionBuild = Orchid.Common.Orchid.VersionBuild()
watch_3 = Watch(versionBuild)
