# Dynamo graph PDFexport_NamingRule.dyn (Dynamo 2.19.3.6394)
# packages: Orchid 2.19.5.6633

# group: Add naming rule for PDF export
code_block = CodeBlock()
# ---------- code_block.designscript (2 lines) ----------
// PDFexport setting
"test";
# ----------------------------------------
createSetting = Orchid.Revit.Common.PDFexport.CreateSetting(name=code_block)
code_block_2 = CodeBlock()
# ---------- code_block_2.designscript (9 lines) ----------
// Category
"Sheets";
// Parameter
["Sheet_Number",
"Sheet_Name"];
// Separator
[" - ", ""];
// Sample
["A1.01", "Sheet"];
# ----------------------------------------
byName = Category.ByName(name=code_block_2.out0)
byName_2 = Orchid.RevitProject.Parameters.BuiltInParameter.ByName(name=code_block_2.out1)
create = Orchid.RevitProject.Parameters.ParameterField.Create(category=byName, parameter=byName_2, separator=code_block_2.out2, sampleValue=code_block_2.out3)
addNamingRule = Orchid.Revit.Common.PDFexport.AddNamingRule(exportSetting=createSetting, parameterField=create)
namingRule = Orchid.Revit.Common.PDFexport.NamingRule(exportSetting=addNamingRule)
name = Orchid.RevitProject.Parameters.ParameterField.Name(parameterField=namingRule)
watch = Watch(name)
watch_2 = Watch(namingRule)

# group: Export to PDF
sheet_set = SheetSet("A3 set")  # graph input
pdfexport_quality = ExportQuality("DPI300")
byViewSheetSet = Orchid.Revit.Common.PDFexport.ByViewSheetSet(viewSheetSet=sheet_set, exportSetting=addNamingRule, exportQuality=pdfexport_quality)
view = Orchid.RevitProject.Views.SheetSet.View(viewSheetSet=sheet_set)
byView = Orchid.Revit.Common.PDFexport.ByView(view=view, exportSetting=addNamingRule, exportQuality=pdfexport_quality)  # frozen

data = Orchid.RevitProject.Parameters.ParameterField.Data(parameterField=namingRule)
watch_3 = Watch(data.category)
watch_4 = Watch(data.parameter)
watch_5 = Watch(data.prefix)
watch_6 = Watch(data.separator)
watch_7 = Watch(data.sampleValue)
