# Dynamo graph Print.dyn (Dynamo 2.19.3.6394)
# packages: Orchid 2.19.3.6432

# group: SheetSet
code_block = CodeBlock { "Sheets"; }  # frozen
byName = Category.ByName(name=code_block)
all_elements_of_category = ElementsOfCategory(Category=byName)
string = StringInput("testSet")  # graph input
create = Orchid.RevitProject.Views.SheetSet.Create(view=all_elements_of_category, name=string)
view = Orchid.RevitProject.Views.SheetSet.View(viewSheetSet=create)
sheet_set = SheetSet("A3 set")  # graph input
change = Orchid.RevitProject.Views.SheetSet.Change(view=view, viewSheetSet=sheet_set)
delete = Orchid.RevitProject.Views.SheetSet.Delete(viewSheetSet=create)

# group: Remove print setting
# note: Print Setting may be set
# both as an element and
# as a string
string_2 = StringInput("testSetting")  # graph input
deleteSetting = Orchid.Revit.Common.Print.DeleteSetting(printSetting=string_2)  # frozen
print_settings = Setting("testSetting")  # graph input

printer = Printer("Microsoft Print to PDF")  # graph input
string_3 = StringInput("testSetting")  # graph input
createSetting = Orchid.Revit.Common.Print.CreateSetting(printer=printer, name=string_3)
print_paper_sizes = PaperSize("A3", p=printer)
print_page_orientation = PageOrientation("Portrait")  # graph input
print_margin_type = MarginType("User defined")  # graph input
code_block_2 = CodeBlock { [10,10]; }
changeSetting = Orchid.Revit.Common.Print.ChangeSetting(printer=printer, printSetting=createSetting, paperZize=print_paper_sizes, pageOrientation=print_page_orientation, marginType=print_margin_type, margin=code_block_2)
printer_2 = Printer("Microsoft Print to PDF")  # graph input
sheet_set_2 = SheetSet("A3 set")  # graph input
view_2 = Orchid.RevitProject.Views.SheetSet.View(viewSheetSet=sheet_set_2)

# group: filePath --> file name incl. path
directory = Orchid.RevitProject.Common.Document.Directory()
sheetNumber = Sheet.SheetNumber(sheet=view_2)
code_block_3 = CodeBlock(a=directory, b=sheetNumber) { a + "\\" + b; }
# note: Set to "Select" to print the selected views
print_range = Range("Selected views/sheets")  # graph input

string_4 = StringInput("Default")  # graph input
byViewSheetSet = Orchid.Revit.Common.Print.ByViewSheetSet(printer=printer_2, fileName=code_block_3, viewSheetSet=sheet_set_2, printSetting=string_4)  # frozen
boolean = BoolSelector(true)  # graph input
boolean_2 = BoolSelector(true)  # graph input
byView = Orchid.Revit.Common.Print.ByView(printer=printer_2, combine=boolean, file=boolean_2, fileName=code_block_3, view=view_2)
code_block_4 = CodeBlock()
# ---------- code_block_4.designscript (7 lines) ----------
"Adobe PDF";
"Microsoft Print to PDF";
"Microsoft XPS Document Writer";

//Hidden built-in printer
//not supported at the moment!
"Revit DWF Exporter";
# ----------------------------------------
paperSize = Orchid.Revit.Common.Print.PaperSize(printer=printer)
watch = Watch(paperSize)

# group: Merge PDF files
code_block_5 = CodeBlock()
# ---------- code_block_5.designscript (6 lines) ----------
//input documents
["C:\\Users\\Public\\Temp\\pdf\\pdf1.pdf",
"C:\\Users\\Public\\Temp\\pdf\\pdf2.pdf"];

//output file path
"C:\\Users\\Public\\Temp\\pdf\\result.pdf";
# ----------------------------------------
mergePDF = Orchid.Common.File.MergePDF(documents=code_block_5.out0, filePath=code_block_5.out1)  # frozen

code_block_6 = CodeBlock { 100; }
print_zoom_type = ZoomType("Zoom")  # graph input
print_paper_placement = PaperPlacement("Offset from corner")  # graph input

# group: Print current view (center and fit to page)
printer_3 = Printer("Microsoft Print to PDF")  # graph input
string_5 = StringInput("testSetting2")  # graph input
print_paper_sizes_2 = PaperSize("A3", p=printer_3)
print_paper_placement_2 = PaperPlacement("Center")  # graph input
print_zoom_type_2 = ZoomType("Fit To Page")  # graph input
createSetting_2 = Orchid.Revit.Common.Print.CreateSetting(printer=printer_3, name=string_5, paperZize=print_paper_sizes_2, paperPlacement=print_paper_placement_2, zoomType=print_zoom_type_2)  # frozen
print_range_2 = Range("Current window")  # graph input
activeView = Orchid.RevitProject.Common.Document.ActiveView()
# note: if print options there are rarely set need to be included, then connect:
# "Print.SetOptions" output Printsetting to "Print.ByView" input printSetting!
byView_2 = Orchid.Revit.Common.Print.ByView(printer=printer_3, printRange=print_range_2, view=activeView, printSetting=createSetting_2)
await_ = Orchid.Common.DataStream.Await(pass=createSetting_2, waitFors=byView_2)
deleteSetting_2 = Orchid.Revit.Common.Print.DeleteSetting(printSetting=await_)

# group: Print options there are rarely set
boolean_3 = BoolSelector(true)  # graph input
boolean_4 = BoolSelector(false)  # graph input
print_hidden_line = HiddenLineViewsType("Vector Processing")  # graph input
print_raster_quality = RasterQuality("Medium")  # graph input
print_color_depth = ColorDepthType("Gray Scale")  # graph input
setOptions = Orchid.Revit.Common.Print.SetOptions(printSetting=createSetting_2, viewLinksinBlue=boolean_3, hideReforWorkPlanes=boolean_4, hideUnreferencedViewTags=boolean_3, maskCoincidentLines=boolean_3, hideScopeBoxes=boolean_4, hideCropBoundaries=boolean_4, replaceHalftoneWithThinLines=boolean_3, hiddenLineViews=print_hidden_line, rasterQuality=print_raster_quality, colorDepth=print_color_depth)  # frozen
