# Dynamo graph Revit Application.dyn (Dynamo 2.19.3.6394)
# packages: Orchid 2.19.5.6567

username = Orchid.AdeskApps.Revit.Username()
watch = Watch(username)

# group: Application
format = Orchid.AdeskApps.Revit.Format()
watch_2 = Watch(format)
applicationFolder = Orchid.AdeskApps.Revit.ApplicationFolder()
watch_3 = Watch(applicationFolder)

# group: Version
versionBuild = Orchid.AdeskApps.Revit.VersionBuild()
watch_4 = Watch(versionBuild)
version = Orchid.AdeskApps.Revit.Version()
watch_5 = Watch(version)

culture = Orchid.AdeskApps.Revit.Culture()
watch_6 = Watch(culture)
language = Orchid.AdeskApps.Revit.Language()
watch_7 = Watch(language)
