# Dynamo graph TimeZone.dyn (Dynamo 2.19.3.6394)
# packages: Orchid 2.19.3.6432

# group: TimeZone getter
code_block = CodeBlock { "Romance Standard Time"; "GMT Standard Time"; "US Eastern Standard Time"; "India Standard Time"; }
byId = Orchid.Common.Global.TimeZone.ById(id=code_block.out0)
time_zones = TimeZone("India Standard Time")

# group: TimeZone setter
code_block_2 = CodeBlock { 1; }
setTimeZone = Orchid.RevitProject.Common.Location.SetTimeZone(timeZone=code_block_2)  # frozen
setTimeZone_2 = Orchid.RevitProject.Common.Location.SetTimeZone(timeZone=byId)
timeZone = Orchid.RevitProject.Common.Location.TimeZone(siteLocation=setTimeZone_2)
watch = Watch(timeZone)

# group: TimeZone query
current = Orchid.Common.Global.TimeZone.Current()
watch_2 = Watch(current)
all = Orchid.Common.Global.TimeZone.All()
watch_3 = Watch(all)

# group: TimeZone name
name = Orchid.Common.Global.TimeZone.Name(timeZone=byId)
watch_4 = Watch(name)
