# Dynamo graph Elem+Fam.dyn (Dynamo 2.16.1.2727)
# packages: Orchid 216.3.0.5794

# group: Family
families = Family("Ext. Single-Flush")  # graph input
byFamily = Orchid.RevitProject.Elements.Element.ByFamily(family=families)
watch = Watch(byFamily)

code_block = CodeBlock { ["Floors","Walls","Windows"]; }
byCategory = Orchid.RevitProject.Elements.Element.ByCategory(category=code_block)
info = Orchid.RevitProject.Elements.Element.Info(element=byCategory.Element)
watch_2 = Watch(info.Owner)
watch_3 = Watch(info.Creator)
watch_4 = Watch(info.LastChangedBy)
watch_5 = Watch(info.RequestedBy)
name = Element.Name(element=byCategory.Element)
watch_6 = Watch(name)
familyName = Orchid.RevitProject.Elements.Element.FamilyName(element=byCategory.Element)
watch_7 = Watch(familyName)
elementType = Element.ElementType(element=byCategory.Element)
uniqueItems = List.UniqueItems(list=elementType@L2)
familyName_2 = Orchid.RevitProject.Elements.ElementType.FamilyName(elementType=uniqueItems)
watch_8 = Watch(familyName_2)
name_2 = Orchid.RevitProject.Elements.ElementType.Name(elementType=uniqueItems)
watch_9 = Watch(name_2)
