# Dynamo graph ElementTag.dyn (Dynamo 2.16.2.5624)
# packages: Orchid 2.16.4.6197

# group: Get tag
# File: defaultProject
code_block = CodeBlock { "Doors"; }
byName = Category.ByName(name=code_block)
all_elements_of_category = ElementsOfCategory(Category=byName)
code_block_2 = CodeBlock { "Level 1 (door)"; }
byName_2 = Orchid.RevitProject.Views.View.ByName(name=code_block_2)
tag = Orchid.RevitProject.Elements.Element.Tag(element=all_elements_of_category, view=byName_2, lacing=Longest)

watch = Watch(all_elements_of_category)
watch_2 = Watch(tag)
