# Dynamo graph Family-Associated.dyn (Dynamo 2.16.1.2727)
# packages: Orchid 216.3.0.5794

code_block = CodeBlock { "Generic Models"; }
byName = Category.ByName(name=code_block)
all_elements_of_category = ElementsOfCategory(Category=byName)
elementType = Element.ElementType(element=all_elements_of_category)
family = FamilyType.Family(familyType=elementType)
watch = Watch(family)
hasAssociated = Orchid.RevitProject.Elements.Family.HasAssociated(family=family)
watch_2 = Watch(hasAssociated)
watch_3 = Watch(elementType)
hasAssociated_2 = Orchid.RevitProject.Elements.FamilyType.HasAssociated(familyType=elementType)
watch_4 = Watch(hasAssociated_2)
