# Dynamo graph Family.Save.dyn (Dynamo 2.16.2.5624)
# packages: Orchid 2.16.4.6197

# group: selected families by category in project
# File: defaultProject
natural_category_name = CodeBlock()
# ---------- natural_category_name.designscript (12 lines) ----------
[
"Casework",
"Columns",
"Doors",
"Windows",
"Specialty Equipment",
"Structural Columns",
"Structural Foundations",
"Structural Framing",
"Structural Beam Systems",
"Structural Stiffeners"
];
# ----------------------------------------
byName = Category.ByName(name=natural_category_name)
byCategory = Orchid.RevitProject.Elements.Element.ByCategory(category=byName)
elementType = Element.ElementType(element=byCategory.Element)
uniqueItems = List.UniqueItems(list=elementType, lacing=Longest)
flatten = List.Flatten(list=uniqueItems)
family = FamilyType.Family(familyType=flatten)
string = StringInput("%userprofile%\Programming\Testing\Data\testSet")  # graph input
boolean = BoolSelector(true)  # graph input
save = Orchid.RevitProject.Elements.Family.Save(family=family, path=string, subfolder=boolean)

watch = Watch(save)
