# Dynamo graph Filter.dyn (Dynamo 2.16.1.2727)
# packages: Orchid 216.3.0.5794

# group: Filter elements
select_rule_type = RuleTypes("GreaterOrEqual")  # graph input
code_block = CodeBlock { ["Windows","Doors"]; }
byName = Category.ByName(name=code_block)
all_elements_of_category = ElementsOfCategory(Category=byName)
code_block_2 = CodeBlock { "Equals"; "Doors"; "Windows"; }
byName_2 = Category.ByName(name=code_block_2.out2)
byCategory = Orchid.RevitProject.Elements.Filter.ByCategory(element=all_elements_of_category, ruleType=code_block_2.out0, value=byName_2)
byCategory_2 = Orchid.RevitProject.Elements.Filter.ByCategory(element=all_elements_of_category, ruleType=code_block_2.out0, value=code_block_2.out1)
code_block_3 = CodeBlock { "Contains"; "12x"; }
byName_3 = Orchid.RevitProject.Elements.Filter.ByName(element=all_elements_of_category, ruleType=code_block_3.out0, value=code_block_3.out1)
code_block_4 = CodeBlock { "Equals"; "Family"; }
family_types = FamilyTypes("Int. Single-Flush:9x21M")  # graph input
byParameter = Orchid.RevitProject.Elements.Filter.ByParameter(element=all_elements_of_category, ruleType=code_block_4.out0, parameterName=code_block_4.out1, value=family_types)
code_block_5 = CodeBlock()
# ---------- code_block_5.designscript (25 lines) ----------
// Dynamo RuleTypes
// Please notice the spelling
// issue --> GeaterOrEqual
"BeginsWith";
"Contains";
"EndsWith";
"Equals";
"Greater";
"Less";
"GeaterOrEqual";
"GreaterOrEqual";
"LessOrEqual";
"NotBeginsWith";
"NotContains";
"NotEndsWith";
"NotEquals";

// Orchid additional
// Ruletypes
"==";
">";
"<";
">=";
"<=";
"!=";
# ----------------------------------------
code_block_6 = CodeBlock { "=="; "Level"; }
levels = Levels("Level 1")  # graph input
byParameter_2 = Orchid.RevitProject.Elements.Filter.ByParameter(element=all_elements_of_category, ruleType=code_block_6.out0, parameterName=code_block_6.out1, value=levels)
elementType = Element.ElementType(element=all_elements_of_category)
code_block_7 = CodeBlock { "Greater"; "Width"; 1000; }
byParameter_3 = Orchid.RevitProject.Elements.Filter.ByParameter(element=elementType, ruleType=code_block_7.out0, parameterName=code_block_7.out1, value=code_block_7.out2)

watch = Watch(byCategory)
watch_2 = Watch(byCategory_2)
watch_3 = Watch(byName_3)
watch_4 = Watch(byParameter)
watch_5 = Watch(byParameter_2)
watch_6 = Watch(byParameter_3)
