# Dynamo graph Flipped.dyn (Dynamo 2.16.1.2727)
# packages: Orchid 216.3.0.5794

code_block = CodeBlock { "Walls"; }
byName = Category.ByName(name=code_block)
all_elements_of_category = ElementsOfCategory(Category=byName)

# group: Boolean
code_block_2 = CodeBlock(data=all_elements_of_category) { data; }
isFlipped = Orchid.RevitProject.Elements.Wall.IsFlipped(wall=code_block_2)
groupByKey = List.GroupByKey(list=code_block_2, keys=isFlipped)

watch = Watch(groupByKey.groups)
watch_2 = Watch(groupByKey.uniqueKeys)

# group: Element
code_block_3 = CodeBlock(data=all_elements_of_category) { data; }
flipped = Orchid.RevitProject.Elements.Wall.Flipped(wall=code_block_3)
code_block_4 = CodeBlock { "Comments"; "Is flipped"; "Not flipped"; }
setParameterByName = Element.SetParameterByName(element=flipped.true, parameterName=code_block_4.out0, value=code_block_4.out1)
setParameterByName_2 = Element.SetParameterByName(element=flipped.false, parameterName=code_block_4.out0, value=code_block_4.out2)

watch_3 = Watch(setParameterByName)
watch_4 = Watch(setParameterByName_2)
hashing = Orchid.Common.Object.Hashing(object=all_elements_of_category)
watch_5 = Watch(hashing)
code_block_5 = CodeBlock { "Doors"; }
byName_2 = Category.ByName(name=code_block_5)
all_elements_of_category_2 = ElementsOfCategory(Category=byName_2)

# group: Boolean
code_block_6 = CodeBlock(data=all_elements_of_category_2) { data; }
isHandFlipped = Orchid.RevitProject.Elements.FamilyInstance.IsHandFlipped(familyInstance=code_block_6)
groupByKey_2 = List.GroupByKey(list=code_block_6, keys=isHandFlipped)
isFaceFlipped = Orchid.RevitProject.Elements.FamilyInstance.IsFaceFlipped(familyInstance=code_block_6)
groupByKey_3 = List.GroupByKey(list=code_block_6, keys=isFaceFlipped)

watch_6 = Watch(groupByKey_2.groups)
watch_7 = Watch(groupByKey_3.groups)

# group: Element
code_block_7 = CodeBlock(data=all_elements_of_category_2) { data; }
handFlipped = Orchid.RevitProject.Elements.FamilyInstance.HandFlipped(familyInstance=code_block_7)
code_block_8 = CodeBlock { "Hinge Side"; "R"; "L"; }
setParameterByName_3 = Element.SetParameterByName(element=handFlipped.true, parameterName=code_block_8.out0, value=code_block_8.out1)
setParameterByName_4 = Element.SetParameterByName(element=handFlipped.false, parameterName=code_block_8.out0, value=code_block_8.out2)

watch_8 = Watch(setParameterByName_3)
watch_9 = Watch(groupByKey_2.uniqueKeys)
watch_10 = Watch(groupByKey_3.uniqueKeys)
watch_11 = Watch(setParameterByName_4)
watch_12 = Watch(all_elements_of_category_2)
handOrientation = Orchid.RevitProject.Elements.FamilyInstance.HandOrientation(familyInstance=all_elements_of_category_2)
watch_13 = Watch(handOrientation)

# group: Element
setParameterByName_5 = Element.SetParameterByName()  # unwired: element, parameterName, value
code_block_9 = CodeBlock(data=all_elements_of_category_2) { data; }
faceFlipped = Orchid.RevitProject.Elements.FamilyInstance.FaceFlipped(familyInstance=code_block_9)
code_block_10 = CodeBlock { "Opening Side"; "in"; "out"; }
# note: If an element dont include the needed parameter will a normal node fail, however, using Function.Apply will prevent from that!
function_apply = ApplyFunction(function=setParameterByName_5, argument0=faceFlipped.true, argument1=code_block_10.out0, argument2=code_block_10.out1)
clean = Orchid.Common.List.Clean(list=function_apply)
function_apply_2 = ApplyFunction(function=setParameterByName_5, argument0=faceFlipped.false, argument1=code_block_10.out0, argument2=code_block_10.out2)
clean_2 = Orchid.Common.List.Clean(list=function_apply_2)

watch_14 = Watch(clean)
watch_15 = Watch(clean_2)
