# Dynamo graph HVAC Air Renewal.dyn (Dynamo 2.16.1.2727)
# packages: Orchid 216.3.0.5826

# note: Important:
# Following parameters must exist in the Revit file:
# 'Fanger Method' -> using Fangers method. Fieldformat: HVAC airflow (l/s).
# 'NKB Method' -> Nordic Committee on Building Regulations. Fieldformat: HVAC airflow (l/s).
# 'PD' -> Perceived air quality percentage dissatisfied. Fieldformat: Number.
code_block = CodeBlock { "Spaces"; }
byName = Category.ByName(name=code_block)
all_elements_of_category = ElementsOfCategory(Category=byName)
transport = CodeBlock(data=all_elements_of_category) { data; }
parameter = CodeBlock { "Specified Supply Airflow"; "Fanger Method"; "NKB Method"; }
# note: Fanger Equation:
# Class A -> 15% PD
# Class B -> 20% PD
# Class C -> 30% PD
parameter_2 = CodeBlock { "PD"; }
# note: If you don’t want to
# use Fangers methods
# set the PD to 100!
getParameterValueByName = Element.GetParameterValueByName(element=all_elements_of_category, parameterName=parameter_2)
code_block_2 = CodeBlock { 100; }
replace = Orchid.Common.List.Replace(list=getParameterValueByName, replaceWith=code_block_2)
parameter_3 = CodeBlock { "Number of People"; }
getParameterValueByName_2 = Element.GetParameterValueByName(element=all_elements_of_category, parameterName=parameter_3)
code_block_3 = CodeBlock { 0; }
replace_2 = Orchid.Common.List.Replace(list=getParameterValueByName_2, replaceWith=code_block_3)
parameter_4 = CodeBlock { "Area"; }
getParameterValueByName_3 = Element.GetParameterValueByName(element=all_elements_of_category, parameterName=parameter_4)
fangers_equation_result_l_s = CodeBlock(PD=replace, per=replace_2, area=getParameterValueByName_3) { formula = Math.Pow(Math.Log(PD/395)/-1.83,4); a = formula*per; b = formula*area/10; a+b; }
convert_by_units = DynamoUnitConvert(fangers_equation_result_l_s.out3, MeasurementType="autodesk.unit.quantity:volume-1.0.1", FromConversion="autodesk.unit.unit:liters-1.0.1", ToConversion="autodesk.unit.unit:cubicFeet-1.0.1")
nkb_nordic_committee_on_building = CodeBlock(per=replace_2, area=getParameterValueByName_3) { a = 3.5*per + 0.7*area; b = 7*per; a > b ? a : b; }  # "NKB (Nordic Committee on Building Regulations), result l/s"
# note: Convert to imperial units for writing back to Revit
convert_by_units_2 = DynamoUnitConvert(nkb_nordic_committee_on_building.out2, MeasurementType="autodesk.unit.quantity:volume-1.0.1", FromConversion="autodesk.unit.unit:liters-1.0.1", ToConversion="autodesk.unit.unit:cubicFeet-1.0.1")
code_block_4 = CodeBlock(a=convert_by_units, b=convert_by_units_2) { Math.Max(a,b); }
setParameterByName = Element.SetParameterByName(element=transport, parameterName=parameter.out0, value=code_block_4)
# note: verify parameters for MEP Spaces
parameters = Element.Parameters(element=all_elements_of_category)
watch = Watch(parameters)
setParameterByName_2 = Element.SetParameterByName(element=transport, parameterName=parameter.out2, value=convert_by_units_2)
nkb_result_l_s = Watch(nkb_nordic_committee_on_building.out2)
setParameterByName_3 = Element.SetParameterByName(element=transport, parameterName=parameter.out1, value=convert_by_units)
fanger_result_l_s = Watch(fangers_equation_result_l_s.out3)
