# Dynamo graph Material.dyn (Dynamo 2.16.2.5624)
# packages: Orchid 216.3.0.5794

# group: 
# File: defaultProject
natural_category_name = CodeBlock()
# ---------- natural_category_name.designscript (26 lines) ----------
[
"Casework",
"Ceilings",
"Columns",
"Curtain Wall Mullions",
"Curtain Panels",
"Curtain Systems",
"Doors",
"Entourage",
"Floors",
"Furniture",
"Furniture Systems",
"Generic Models",
"Plumbing Fixtures",
"Ramps",
"Roofs",
"Specialty Equipment",
"Stairs",
"Structural Columns",
"Structural Foundations",
"Structural Framing",
"Structural Beam Systems",
"Structural Stiffeners",
"Walls",
"Windows"
];
# ----------------------------------------
byName = Category.ByName(name=natural_category_name)
all_elements_of_category = ElementsOfCategory(Category=byName)

hasMaterial = Orchid.RevitProject.Elements.Element.HasMaterial()
clean = Orchid.Common.List.Clean(list=hasMaterial.Element)
flatten = List.Flatten(list=clean)

# group: get elements sorted by used materials including summarized area and volumne
getMaterials = Element.GetMaterials(element=flatten)
flatten_2 = List.Flatten(list=getMaterials)
uniqueItems = List.UniqueItems(list=flatten_2)
sum = Orchid.RevitProject.Elements.Material.Sum(material=uniqueItems)
element_by_material_watch = Watch(sum.Material)
volumne_watch = Watch(sum.volumne)
area_watch = Watch(sum.area)
name = Element.Name(element=uniqueItems)
material_name_watch = Watch(name)

# group: get materials--their area and volumne--by elements
sumByElement = Orchid.RevitProject.Elements.Material.SumByElement(element=flatten)
volumne_watch_2 = Watch(sumByElement.volumne)
area_watch_2 = Watch(sumByElement.area)
name_2 = Element.Name(element=sumByElement.Material)
material_name_watch_2 = Watch(name_2)
material_by_element_watch = Watch(sumByElement.Material)

# group: get summarized (area and volumne) materials by elements and their asset density
quantity = Orchid.RevitProject.Elements.Material.Quantity(element=flatten)
volumne_watch_3 = Watch(quantity.volumne)
density = Orchid.RevitMaterial.Material.Density(material=quantity.Material)
physical_density_watch = Watch(density.Physical)
thermal_density_watch = Watch(density.Thermal)
area_watch_3 = Watch(quantity.area)
name_3 = Element.Name(element=quantity.Material)
material_name_watch_3 = Watch(name_3)
