# Dynamo graph SystemFamilyType.dyn "SystemFamilyType_R23" (Dynamo 2.16.1.2727)
# packages: Orchid 216.3.0.5794

# group: Wall
# File: defaultProject
wall_types = WallTypes("Exterior - 468mm Masonry / LW Concrete")  # graph input
thermalProperties = Orchid.RevitProject.Elements.SystemFamilyType.ThermalProperties(elementType=wall_types)
watch = Watch(thermalProperties.HeatTransferCoefficient)
watch_2 = Watch(thermalProperties.ThermalResistance)
watch_3 = Watch(thermalProperties.ThermalMass)
watch_4 = Watch(thermalProperties.Absorptance)
watch_5 = Watch(thermalProperties.Roughness)
function = Orchid.RevitProject.Elements.WallType.Function(wallType=wall_types)
watch_6 = Watch(function)
kind = Orchid.RevitProject.Elements.WallType.Kind(wallType=wall_types)
watch_7 = Watch(kind)
width = Orchid.RevitProject.Elements.WallType.Width(wallType=wall_types)
watch_8 = Watch(width)

# group: Roof
roof_types = RoofType("Warm - 500mm Steel Bar Joist / Steel Deck / EPDM Membrane")  # graph input
thermalProperties_2 = Orchid.RevitProject.Elements.SystemFamilyType.ThermalProperties(elementType=roof_types)
watch_9 = Watch(thermalProperties_2.Roughness)
watch_10 = Watch(thermalProperties_2.Absorptance)
watch_11 = Watch(thermalProperties_2.ThermalMass)
watch_12 = Watch(thermalProperties_2.ThermalResistance)
watch_13 = Watch(thermalProperties_2.HeatTransferCoefficient)

# group: Ceiling
ceiling_types = CeilingType("Generic - 300mm")  # graph input
thermalProperties_3 = Orchid.RevitProject.Elements.SystemFamilyType.ThermalProperties(elementType=ceiling_types)
watch_14 = Watch(thermalProperties_3.HeatTransferCoefficient)
watch_15 = Watch(thermalProperties_3.ThermalResistance)
watch_16 = Watch(thermalProperties_3.ThermalMass)
watch_17 = Watch(thermalProperties_3.Absorptance)
watch_18 = Watch(thermalProperties_3.Roughness)

# group: Floor
floor_types = FloorTypes("Suspended - 300mm LW Concrete / Wood Planks")  # graph input
thermalProperties_4 = Orchid.RevitProject.Elements.SystemFamilyType.ThermalProperties(elementType=floor_types)
watch_19 = Watch(thermalProperties_4.HeatTransferCoefficient)
watch_20 = Watch(thermalProperties_4.ThermalResistance)
watch_21 = Watch(thermalProperties_4.ThermalMass)
watch_22 = Watch(thermalProperties_4.Absorptance)
watch_23 = Watch(thermalProperties_4.Roughness)
isFoundationSlab = Orchid.RevitProject.Elements.FloorType.IsFoundationSlab(FloorType=floor_types)
watch_24 = Watch(isFoundationSlab)
structuralMaterial = Orchid.RevitProject.Elements.FloorType.StructuralMaterial(FloorType=floor_types)
watch_25 = Watch(structuralMaterial)
