# Dynamo graph AddConvert.dyn (Dynamo 3.6.1.9895)
# packages: Orchid 3.6.0.6858

# group: create family type
current = Orchid.RevitFamily.FamilyDocument.Current()
create = Orchid.RevitFamily.FamilyType.Create(familyDocument=current)
name = Orchid.RevitFamily.FamilyType.Name(familyType=create)

# group: Add shared parameter
# File: defaultFamily
await_ = Orchid.Common.DataStream.Await(pass=current, waitFor0=create)
code_block = CodeBlock()
# ---------- code_block.designscript (14 lines) ----------
//Parameter name
["Creator Name",
"Creator Organization",
"Creator Build"];
//SP Parameter group
"Sheet and Project";
//GroupType
"AdskModelProperties";
//Instances
true;
//Reporting
true;
//Condense output
false;
# ----------------------------------------
byName = Orchid.AdeskApps.Units.GroupType.ByName(string=code_block.out2)
add = Orchid.RevitFamily.SharedParameter.Add(familyDocument=await_, parameterName=code_block.out0, groupName=code_block.out1, groupType=byName, instance=code_block.out3)

# group: Toggle shared to family parameter and vice versa
toggleFamilyShared = Orchid.RevitFamily.FamilyParameter.ToggleFamilyShared(familyDocument=await_, familyParameter=add)
code_block_2 = CodeBlock { true; }
toggleFamilyShared_2 = Orchid.RevitFamily.FamilyParameter.ToggleFamilyShared(familyDocument=await_, familyParameter=toggleFamilyShared, shared=code_block_2)
name_2 = FamilyParameter.Name(familyParameter=toggleFamilyShared_2)
watch = Watch(name_2)

types = FamilyDocument.Types(familyDocument=await_)
watch_2 = Watch(types)

# group: Create shared parameter
await_2 = Orchid.Common.DataStream.Await(pass=current, waitFor0=create)
code_block_3 = CodeBlock()
# ---------- code_block_3.designscript (8 lines) ----------
//Parameter name
"Dynamo test parameter";
//SP Parameter group
"Dynamo test group";
//SpecType
"Text";
//GroupType
"AdskModelProperties";
# ----------------------------------------
byName_2 = Orchid.AdeskApps.Units.SpecType.ByName(string=code_block_3.out2)
byName_3 = Orchid.AdeskApps.Units.GroupType.ByName(string=code_block_3.out3)
create_2 = Orchid.RevitFamily.SharedParameter.Create(familyDocument=await_2, parameterName=code_block_3.out0, groupName=code_block_3.out1, specType=byName_2, groupType=byName_3)

# group: Converters (to/from Revit API)
toRevitType = Orchid.Common.Object.ToRevitType(object=create_2)
toDynamoType = Orchid.Common.Object.ToDynamoType(object=toRevitType)
watch_3 = Watch(toDynamoType)
watch_4 = Watch(toRevitType)

# group: Add family parameter
await_3 = Orchid.Common.DataStream.Await(pass=current, waitFor0=create)
code_block_4 = CodeBlock()
# ---------- code_block_4.designscript (6 lines) ----------
//Parameter name
["test1","test2"];
//SpecType
"Text";
//GroupType
"AdskModelProperties";
# ----------------------------------------
byName_4 = Orchid.AdeskApps.Units.SpecType.ByName(string=code_block_4.out1)
byName_5 = Orchid.AdeskApps.Units.GroupType.ByName(string=code_block_4.out2)
create_3 = Orchid.RevitFamily.FamilyParameter.Create(familyDocument=await_3, parameterName=code_block_4.out0, specType=byName_4, groupType=byName_5)

# group: Toogle instance to type and change group
await_4 = Orchid.Common.DataStream.Await(pass=await_3, waitFor0=create_3)
code_block_5 = CodeBlock()
# ---------- code_block_5.designscript (4 lines) ----------
//Instances
true;
//GroupType
"Text";
# ----------------------------------------
toggleInstanceType = Orchid.RevitFamily.FamilyParameter.ToggleInstanceType(familyDocument=await_4, familyParameter=create_3, instance=code_block_5.out0)
byName_6 = Orchid.AdeskApps.Units.GroupType.ByName(string=code_block_5.out1)
changeGroup = Orchid.RevitFamily.FamilyParameter.ChangeGroup(familyDocument=await_4, familyParameter=toggleInstanceType, groupType=byName_6)

# group: Dynamo FamilyDocument
current_2 = Document.Current()
byDocument = FamilyDocument.ByDocument(document=current_2)

# group: Set formula by name
await_5 = Orchid.Common.DataStream.Await(pass=current, waitFor0=add)  # frozen
code_block_6 = CodeBlock()
# ---------- code_block_6.designscript (8 lines) ----------
//Parameter name
["Creator Name",
"Creator Organization",
"Creator Build"];
//Values
["\"Erik Falck Jørgensen\"",
"\"Danish Educational Content\"",
"\"2022.0406.0\""];
# ----------------------------------------
input = Orchid.RevitFamily.Formula.Input(familyDocument=await_5, parameterName=code_block_6.out0, value=code_block_6.out1)

# group: Get Formula by name
await_6 = Orchid.Common.DataStream.Await(pass=await_5, waitFor0=input)
code_block_7 = CodeBlock()
# ---------- code_block_7.designscript (4 lines) ----------
//Parameter name
["Creator Name",
"Creator Organization",
"Creator Build"];
# ----------------------------------------
value = Orchid.RevitFamily.Formula.Value(familyDocument=await_6, parameterName=code_block_7)
watch_5 = Watch(value)

# group: Set formula
code_block_8 = CodeBlock(param=add)
# ---------- code_block_8.designscript (2 lines) ----------
//Parameter
param;
# ----------------------------------------
await_7 = Orchid.Common.DataStream.Await(pass=current, waitFor0=add)
code_block_9 = CodeBlock()
# ---------- code_block_9.designscript (4 lines) ----------
//Values
["\"Erik Falck Jørgensen\"",
"\"Danish Educational Content\"",
"\"2026.0402.0\""];
# ----------------------------------------
input_2 = Orchid.RevitFamily.Formula.Input(familyDocument=await_7, familyParameter=code_block_8, value=code_block_9)

# group: Get Formula
await_8 = Orchid.Common.DataStream.Await(pass=code_block_8, waitFor0=input_2)
value_2 = Orchid.RevitFamily.Formula.Value(familyParameter=await_8)
watch_6 = Watch(value_2)

# group: Remove formula
await_9 = Orchid.Common.DataStream.Await(pass=await_7, waitFor0=value_2)
code_block_10 = CodeBlock(param=await_8)  # same code as code_block_8
remove = Orchid.RevitFamily.Formula.Remove(familyDocument=await_9, familyParameter=code_block_10)

# group: Set parameter value
await_10 = Orchid.Common.DataStream.Await(pass=await_9, waitFor0=remove)
code_block_11 = CodeBlock(param=code_block_10)  # same code as code_block_8
code_block_12 = CodeBlock()
# ---------- code_block_12.designscript (2 lines) ----------
//value
["name","org","build"];
# ----------------------------------------
setValue = Orchid.RevitFamily.FamilyParameter.SetValue(familyDocument=await_10, familyParameter=code_block_11, value=code_block_12)

# group: Remove formula
await_11 = Orchid.Common.DataStream.Await(pass=await_6, waitFor0=value)  # frozen
code_block_13 = CodeBlock()  # same code as code_block_7
remove_2 = Orchid.RevitFamily.Formula.Remove(familyDocument=await_11, parameterName=code_block_13)

# group: Set parameter value
await_12 = Orchid.Common.DataStream.Await(pass=await_11, waitFor0=remove_2)
code_block_14 = CodeBlock()
# ---------- code_block_14.designscript (6 lines) ----------
//Parameter name
["Creator Name",
"Creator Organization",
"Creator Build"];
//value
["name","org","build"];
# ----------------------------------------
setValue_2 = Orchid.RevitFamily.FamilyParameter.SetValue(familyDocument=await_12, parameterName=code_block_14.out0, value=code_block_14.out1)
