# Dynamo graph AddSetGet.dyn (Dynamo 2.19.3.6394)
# packages: Orchid 2.19.5.6567

# group: create family type
# File: defaultFamily
current = Orchid.RevitFamily.FamilyDocument.Current()
code_block = CodeBlock()
# ---------- code_block.designscript (2 lines) ----------
//Types to create
"Type 1";
# ----------------------------------------
create = Orchid.RevitFamily.FamilyType.Create(familyDocument=current, name=code_block)
name = Orchid.RevitFamily.FamilyType.Name(familyType=create)

# group: Add parameter
await_ = Orchid.Common.DataStream.Await(pass=current, waitFors=create)
code_block_2 = CodeBlock()
# ---------- code_block_2.designscript (6 lines) ----------
//Parameter name
"Test2";
//SpecType
"Number";
//GroupType
"AdskModelProperties";
# ----------------------------------------
byName = Orchid.AdeskApps.Units.SpecType.ByName(string=code_block_2.out1)
byName_2 = Orchid.AdeskApps.Units.GroupType.ByName(string=code_block_2.out2)
create_2 = Orchid.RevitFamily.FamilyParameter.Create(familyDocument=await_, parameterName=code_block_2.out0, specType=byName, groupType=byName_2)

# group: Set parameter
await_2 = Orchid.Common.DataStream.Await(pass=await_, waitFors=create_2)
code_block_3 = CodeBlock()
# ---------- code_block_3.designscript (6 lines) ----------
//Type
"Type 1";
//Parameter name
"Test2";
//Value
1.5;
# ----------------------------------------
byName_3 = Orchid.RevitFamily.FamilyType.ByName(name=code_block_3.out0)
setValue = Orchid.RevitFamily.FamilyParameter.SetValue(familyDocument=await_2, familyType=byName_3, parameterName=code_block_3.out1, value=code_block_3.out2)

# group: Add parameter
await_3 = Orchid.Common.DataStream.Await(pass=current, waitFors=create)
code_block_4 = CodeBlock()
# ---------- code_block_4.designscript (14 lines) ----------
//Parameter name
"Test1";
//SpecType
"Integer";
//GroupType
"AdskModelProperties";
//ToolTip
"do this work?";
//Instances
true;
//Reporting
true;
//Condense output
false;
# ----------------------------------------
byName_4 = Orchid.AdeskApps.Units.SpecType.ByName(string=code_block_4.out1)
byName_5 = Orchid.AdeskApps.Units.GroupType.ByName(string=code_block_4.out2)
create_3 = Orchid.RevitFamily.FamilyParameter.Create(familyDocument=await_3, parameterName=code_block_4.out0, specType=byName_4, groupType=byName_5, tooltip=code_block_4.out3)

# group: Set parameter
await_4 = Orchid.Common.DataStream.Await(pass=await_3, waitFors=create_3)
code_block_5 = CodeBlock()
# ---------- code_block_5.designscript (6 lines) ----------
//Type
"Type 1";
//Parameter name
"Test1";
//Value
1;
# ----------------------------------------
byName_6 = Orchid.RevitFamily.FamilyType.ByName(familyDocument=await_4, name=code_block_5.out0)
setValue_2 = Orchid.RevitFamily.FamilyParameter.SetValue(familyDocument=await_4, familyType=byName_6, parameterName=code_block_5.out1, value=code_block_5.out2)

# group: Add parameter
await_5 = Orchid.Common.DataStream.Await(pass=current, waitFors=create)
code_block_6 = CodeBlock()
# ---------- code_block_6.designscript (6 lines) ----------
//Parameter name
"Test3";
//SpecType
"Text";
//GroupType
"AdskModelProperties";
# ----------------------------------------
byName_7 = Orchid.AdeskApps.Units.SpecType.ByName(string=code_block_6.out1)
byName_8 = Orchid.AdeskApps.Units.GroupType.ByName(string=code_block_6.out2)
create_4 = Orchid.RevitFamily.FamilyParameter.Create(familyDocument=await_5, parameterName=code_block_6.out0, specType=byName_7, groupType=byName_8)

# group: Set parameter
await_6 = Orchid.Common.DataStream.Await(pass=await_5, waitFors=create_4)
code_block_7 = CodeBlock()
# ---------- code_block_7.designscript (6 lines) ----------
//Type
"Type 1";
//Parameter name
"Test3";
//Value
"string";
# ----------------------------------------
byName_9 = Orchid.RevitFamily.FamilyType.ByName(name=code_block_7.out0)
setValue_3 = Orchid.RevitFamily.FamilyParameter.SetValue(familyDocument=await_6, familyType=byName_9, parameterName=code_block_7.out1, value=code_block_7.out2)

# group: Add parameter
await_7 = Orchid.Common.DataStream.Await(pass=current, waitFors=create)
code_block_8 = CodeBlock()
# ---------- code_block_8.designscript (6 lines) ----------
//Parameter name
"Test4";
//SpecType
"Material";
//GroupType
"AdskModelProperties";
# ----------------------------------------
byName_10 = Orchid.AdeskApps.Units.SpecType.ByName(string=code_block_8.out1)
byName_11 = Orchid.AdeskApps.Units.GroupType.ByName(string=code_block_8.out2)
create_5 = Orchid.RevitFamily.FamilyParameter.Create(familyDocument=await_7, parameterName=code_block_8.out0, specType=byName_10, groupType=byName_11)

# group: Set parameter
await_8 = Orchid.Common.DataStream.Await(pass=await_7, waitFors=create_5)
code_block_9 = CodeBlock()
# ---------- code_block_9.designscript (6 lines) ----------
//Type
"Type 1";
//Parameter name
"Test4";
//Value
"Glass";
# ----------------------------------------
byName_12 = Orchid.RevitFamily.FamilyType.ByName(name=code_block_9.out0)
byName_13 = Material.ByName(name=code_block_9.out2)
setValue_4 = Orchid.RevitFamily.FamilyParameter.SetValue(familyDocument=await_8, familyType=byName_12, parameterName=code_block_9.out1, value=byName_13)

list_create = List.Create(item0=setValue_2, item1=setValue, item2=setValue_3, item3=setValue_4)

# group: Parameters
await_9 = Orchid.Common.DataStream.Await(pass=await_2, waitFors=list_create)
parameters = Orchid.RevitFamily.FamilyDocument.Parameters(familyDocument=await_9)
name_2 = FamilyParameter.Name(familyParameter=parameters)
watch = Watch(name_2)

# group: Get Parameter
await_10 = Orchid.Common.DataStream.Await(pass=await_2, waitFors=list_create)
code_block_10 = CodeBlock()
# ---------- code_block_10.designscript (7 lines) ----------
//Type name
"Type 1";
//Parameter name
["Test1",
"Test2",
"Test3",
"Test4"];
# ----------------------------------------
byName_14 = Orchid.RevitFamily.FamilyType.ByName(name=code_block_10.out0)
value = Orchid.RevitFamily.FamilyParameter.Value(familyDocument=await_10, familyType=byName_14, parameterName=code_block_10.out1)
type = Object.Type(object=value.valueByParameter)
watch_2 = Watch(type)
watch_3 = Watch(value.valueByParameter)
code_block_11 = CodeBlock(t=value.valueByParameter) { t[3]; }
name_3 = Material.Name(material=code_block_11)
watch_4 = Watch(name_3)

# group: Filter by Type
code_block_12 = CodeBlock(data=setValue_4) { data; }
type_2 = Object.Type(object=code_block_12)
toClass = Orchid.Common.String.ToClass(string=type_2)
isClassOf = Orchid.Common.Object.IsClassOf(object=code_block_12, class=toClass)
watch_5 = Watch(isClassOf)
filterByClass = Orchid.Common.Object.FilterByClass(object=code_block_12, class=toClass)
watch_6 = Watch(filterByClass)
