# Dynamo graph BulkUpgrade.dyn (Dynamo 3.6.1.9895)
# packages: Orchid 3.6.0.6858

# group: Bulk upgrade files in directory
# File: defaultFamily
directory_path = StringInput("%OrchidSamples%\Data\testSet")  # graph input
string = StringInput("*.rfa")  # graph input
boolean = BoolSelector(false)  # graph input
contents = Orchid.Common.Directory.Contents(directory=directory_path, searchString=string, deepSearch=boolean)
backgroundOpen = Orchid.RevitProject.Common.Document.BackgroundOpen(file=contents)

code_block = CodeBlock()
# ---------- code_block.designscript (8 lines) ----------
//Parameter name
"Creator Build";
//SP Parameter group
"Sheet & Project";
//GroupType
"AdskModelProperties";
//Instances
true;
# ----------------------------------------
byName = Orchid.AdeskApps.Units.GroupType.ByName(string=code_block.out2)
add = Orchid.RevitFamily.SharedParameter.Add(familyDocument=backgroundOpen, parameterName=code_block.out0, groupName=code_block.out1, groupType=byName, instance=code_block.out3)
await_ = Orchid.Common.DataStream.Await(pass=backgroundOpen, waitFors=add)
code_block_2 = CodeBlock()
# ---------- code_block_2.designscript (2 lines) ----------
//parameter name
"Creator Build";
# ----------------------------------------
creator_build = StringInput("\"2025.0402.0\"")  # graph input
input = Orchid.RevitFamily.Formula.Input(familyDocument=await_, parameterName=code_block_2, value=creator_build)
await_2 = Orchid.Common.DataStream.Await(pass=await_, waitFors=input)
boolean_2 = BoolSelector(true)  # graph input
close = Orchid.RevitProject.Common.Document.Close(document=await_2, save=boolean_2)

# group: Cleanup backup files
await_3 = Orchid.Common.DataStream.Await(pass=directory_path, waitFors=close)
string_2 = StringInput("*.0001.rfa")  # graph input
boolean_3 = BoolSelector(true)  # graph input
contents_2 = Orchid.Common.Directory.Contents(directory=await_3, searchString=string_2, deepSearch=boolean_3)
deleteFile = FileSystem.DeleteFile(path=contents_2)
