# Dynamo graph Family-Associated.dyn (Dynamo 3.6.2.11575)
# packages: Orchid 3.6.0.6858

# group: Associate
# File: defaultFamily_associate
code_block = CodeBlock { "Casework"; "Generic Models"; }
byName = Category.ByName(name=code_block.out0)
all_elements_of_category = ElementsOfCategory(Category=byName)

elementType = Orchid.RevitProject.Elements.Element.ElementType(element=all_elements_of_category)

# group (continued): Associate
family = FamilyType.Family(familyType=elementType)
hasAssociated = Orchid.RevitProject.Elements.Family.HasAssociated(family=family)
hasAssociated_2 = Orchid.RevitProject.Elements.FamilyType.HasAssociated(familyType=elementType)

watch = Watch(family)
watch_2 = Watch(hasAssociated)
watch_3 = Watch(elementType)
watch_4 = Watch(hasAssociated_2)
