# Dynamo graph FamilyType.dyn (Dynamo 3.6.1.9895)
# packages: Orchid 3.6.0.6860

# group: Get all family type
# note: This node is being processed among the first, while it always look at the current document and don't need a document to be loaded. This node is best to use in families where types are not added!
inDocument = Orchid.RevitFamily.FamilyType.InDocument()
name = Orchid.RevitFamily.FamilyType.Name(familyType=inDocument)
watch = Watch(name)
watch_2 = Watch(inDocument)

# group: Current family type
# note: This node is being processed among the first, while it always look at the current document and don't need a document to be loaded. This node is best to use in families where types are not added!
current = Orchid.RevitFamily.FamilyType.Current()
name_2 = Orchid.RevitFamily.FamilyType.Name(familyType=current)
watch_3 = Watch(name_2)

# group: Create type
# File: defaultFamily
current_2 = Orchid.RevitFamily.FamilyDocument.Current()
code_block = CodeBlock()
# ---------- code_block.designscript (2 lines) ----------
//Types to create
["Type 1", "Type 2"];
# ----------------------------------------
create = Orchid.RevitFamily.FamilyType.Create(familyDocument=current_2, name=code_block)

# group: Get all family type by document
await_ = Orchid.Common.DataStream.Await(pass=current_2, waitFors=create)
inDocument_2 = Orchid.RevitFamily.FamilyType.InDocument(familyDocument=await_)
name_3 = Orchid.RevitFamily.FamilyType.Name(familyType=inDocument_2)
watch_4 = Watch(name_3)

# group: Convert to Orchid type
toRevitType = Orchid.Common.Object.ToRevitType(object=create)
toOrchidType = Orchid.Common.Object.ToOrchidType(object=toRevitType)
name_4 = Orchid.RevitFamily.FamilyType.Name(familyType=toOrchidType)
watch_5 = Watch(name_4)

# group: Add parameter
code_block_2 = CodeBlock()
# ---------- code_block_2.designscript (15 lines) ----------
//Parameter name
["Test","something"];
//SpecType
"Text";
//"Length";
//GroupType
"AdskModelProperties";
//Tooltip
"Owner value";
//Instances
true;
//Reporting
true;
//Condense output
false;
# ----------------------------------------
byName = Orchid.AdeskApps.Units.SpecType.ByName(string=code_block_2.out1)
byName_2 = Orchid.AdeskApps.Units.GroupType.ByName(string=code_block_2.out2)
create_2 = Orchid.RevitFamily.FamilyParameter.Create(familyDocument=current_2, parameterName=code_block_2.out0, specType=byName, groupType=byName_2)

# group: Rename parameter
name_5 = Orchid.RevitFamily.FamilyParameter.Name(familyParameter=create_2)
code_block_3 = CodeBlock(name=name_5)
# ---------- code_block_3.designscript (2 lines) ----------
name == "Test"
? true : false;
# ----------------------------------------
filterByBoolMask = List.FilterByBoolMask(list=create_2, mask=code_block_3)
code_block_4 = CodeBlock()
# ---------- code_block_4.designscript (2 lines) ----------
//New name
"NewTest";
# ----------------------------------------
rename = Orchid.RevitFamily.FamilyParameter.Rename(familyParameter=filterByBoolMask.in, name=code_block_4)

# group: Delete parameter
delete = Orchid.RevitFamily.FamilyParameter.Delete(familyParameter=rename)  # frozen

# group: Rename type
name_6 = Orchid.RevitFamily.FamilyType.Name(familyType=create)
code_block_5 = CodeBlock(name=name_6)
# ---------- code_block_5.designscript (2 lines) ----------
name == "Type 1"
? true : false;
# ----------------------------------------
filterByBoolMask_2 = List.FilterByBoolMask(list=create, mask=code_block_5)
code_block_6 = CodeBlock()
# ---------- code_block_6.designscript (2 lines) ----------
//New name
"Type 3";
# ----------------------------------------
rename_2 = Orchid.RevitFamily.FamilyType.Rename(familyType=filterByBoolMask_2.in, name=code_block_6)

# group: Delete type
delete_2 = Orchid.RevitFamily.FamilyType.Delete(familyType=rename_2)  # frozen
