# Dynamo graph Form.dyn (Dynamo 2.19.3.6394)
# packages: Orchid 2.19.5.6567

# group: 
# File: 3solid.rfa (Geometry folder)
element_classes = ElementTypes("Extrusion")
all_elements_of_class = ElementsOfType(element_class=element_classes)
solids = Element.Solids(element=all_elements_of_class)
watch = Watch(solids)
dynamoSolid = Orchid.Revit.Geometry.Form.DynamoSolid(form=all_elements_of_class)
watch_2 = Watch(dynamoSolid)
element_classes_2 = ElementTypes("FreeFormElement")
revitSolid = Orchid.Revit.Geometry.Form.RevitSolid(form=all_elements_of_class)
watch_3 = Watch(revitSolid)

# group: Dynamo Solid
get = Orchid.Revit.Geometry.Form.Get()
dynamoSolid_2 = Orchid.Revit.Geometry.Form.DynamoSolid(form=get)
flatten = List.Flatten(list=dynamoSolid_2)
watch_4 = Watch(flatten)
intersect = Orchid.Revit.Geometry.DynamoSolid.Intersect(dynamoSolid=flatten)
watch_5 = Watch(intersect)
byUnion = Solid.ByUnion(solids=flatten)
# note: Note.
# Dynamo return area in mm2,
# and volumne in mm3
area = Solid.Area(solid=byUnion)
watch_6 = Watch(area)
volume = Solid.Volume(solid=byUnion)
watch_7 = Watch(volume)
watch_8 = Watch(byUnion)
toOrchidType = Orchid.Revit.Geometry.DynamoSolid.ToOrchidType(dynamoSolid=byUnion)
watch_9 = Watch(toOrchidType)

# group: Revit Solid
get_2 = Orchid.Revit.Geometry.Form.Get()
revitSolid_2 = Orchid.Revit.Geometry.Form.RevitSolid(form=get_2)
flatten_2 = List.Flatten(list=revitSolid_2)
intersect_2 = Orchid.Revit.Geometry.RevitSolid.Intersect(revitSolid=flatten_2)
watch_10 = Watch(intersect_2)
watch_11 = Watch(flatten_2)
union = Orchid.Revit.Geometry.RevitSolid.Union(revitSolid=flatten_2)
# note: Note.
# Revit uses the units setting, in this case
# it return area in m2, and volume in m3
area_2 = Orchid.Revit.Geometry.RevitSolid.Area(revitSolid=union)
watch_12 = Watch(area_2)
volumne = Orchid.Revit.Geometry.RevitSolid.Volumne(revitSolid=union)
watch_13 = Watch(volumne)
watch_14 = Watch(union)
toDynamoType = Orchid.Revit.Geometry.RevitSolid.ToDynamoType(revitSolid=union)
watch_15 = Watch(toDynamoType)
