# Dynamo graph FormSetGet.dyn "FormSetGet_R23" (Dynamo 2.16.2.5624)
# packages: Orchid 216.3.0.5794

# group: Create FamilyType based parameter
current = Orchid.RevitFamily.FamilyDocument.Current()
code_block = CodeBlock()
# ---------- code_block.designscript (6 lines) ----------
//Parameter name
"Nested Family";
//SpecType
"Generic Models";
//GroupType
"AdskModelProperties";
# ----------------------------------------
byName = Category.ByName(name=code_block.out1)
byName_2 = Orchid.AdeskApp.GroupType.ByName(string=code_block.out2)
create = Orchid.RevitFamily.FamilyParameter.Create(familyDocument=current, parameterName=code_block.out0, category=byName, groupType=byName_2)

# group: Create ordinary parameter
# File: defaultFamily
current_2 = Orchid.RevitFamily.FamilyDocument.Current()
code_block_2 = CodeBlock()
# ---------- code_block_2.designscript (6 lines) ----------
//Parameter name
"Material";
//SpecType
"Material";
//GroupType
"AdskModelProperties";
# ----------------------------------------
byName_3 = Orchid.AdeskApp.SpecType.ByName(string=code_block_2.out1)
byName_4 = Orchid.AdeskApp.GroupType.ByName(string=code_block_2.out2)
create_2 = Orchid.RevitFamily.FamilyParameter.Create(familyDocument=current_2, parameterName=code_block_2.out0, specType=byName_3, groupType=byName_4)

# group: Set parameter
await_ = Orchid.Common.DataStream.Await(pass=current_2, waitFor=create_2)
code_block_3 = CodeBlock()
# ---------- code_block_3.designscript (2 lines) ----------
//Parameter name
"Material";
# ----------------------------------------
materials = Material("Glass")  # graph input
setValue = Orchid.RevitFamily.FamilyParameter.SetValue(familyDocument=await_, parameterName=code_block_3, value=materials)

# group: Select geometry
element_classes = ElementTypes("Extrusion")
all_elements_of_class = ElementsOfType(element_class=element_classes)

# group: Associate parameter
await_2 = Orchid.Common.DataStream.Await(pass=await_, waitFor=setValue)
code_block_4 = CodeBlock()  # same code as code_block_3
associate = Orchid.RevitFamily.FamilyParameter.Associate(familyDocument=await_2, parameterName=code_block_4, element=all_elements_of_class, elementParameter=code_block_4)
