# Dynamo graph LightSource.dyn (Dynamo 3.6.1.9895)
# packages: Orchid 3.6.0.6861

# group: 
# File: LundtofteLamp_two
code_block = CodeBlock { "Type 1"; "Type 2"; }
byName = Orchid.RevitFamily.FamilyType.ByName(name=code_block.out1)
inDocument = Orchid.RevitFamily.FamilyType.InDocument()

# group: Set light shape data
code_block_2 = CodeBlock(familyType=byName) { familyType; "Point"; }
light_shape_styles = LightShapeStyle("Rectangle")
applyLightShape = Orchid.RevitFamily.FamilyParameter.ApplyLightShape(familyType=code_block_2.familyType, style=light_shape_styles)

# group: Get light shape data
lightShape = Orchid.RevitFamily.FamilyParameter.LightShape(familyType=applyLightShape)
watch = Watch(lightShape.Style)
watch_2 = Watch(lightShape.Value)

# group: Set light distribution data
code_block_3 = CodeBlock(familyType=byName) { familyType; "Spherical"; }
light_distribution_styles = LightDistributionStyle("Spot light distribution")
applyLightDistribution = Orchid.RevitFamily.FamilyParameter.ApplyLightDistribution(familyType=code_block_3.familyType, style=light_distribution_styles)

# group: Get light distribution data
lightDistribution = Orchid.RevitFamily.FamilyParameter.LightDistribution(familyType=applyLightDistribution)
watch_3 = Watch(lightDistribution.Style)
watch_4 = Watch(lightDistribution.Value)

# group: Set light color filter data
code_block_4 = CodeBlock(familyType=byName)
# ---------- code_block_4.designscript (3 lines) ----------
familyType;
Color.ByARGB
(0, 127, 127, 127);
# ----------------------------------------
applyLightColorFilter = Orchid.RevitFamily.FamilyParameter.ApplyLightColorFilter(familyType=code_block_4.familyType, color=code_block_4.out1)

# group: Get light color filter data
lightColorFilter = Orchid.RevitFamily.FamilyParameter.LightColorFilter(familyType=applyLightColorFilter)
watch_5 = Watch(lightColorFilter)

# group: Set light dimming color data
code_block_5 = CodeBlock(familyType=byName) { familyType; "None"; }
light_dimming_colors = LightDimmingColor("Incandescent lamp curve dimming color")
applyLightDimmingColor = Orchid.RevitFamily.FamilyParameter.ApplyLightDimmingColor(familyType=code_block_5.familyType, color=light_dimming_colors)

# group: Get light dimming color data
lightDimmingColor = Orchid.RevitFamily.FamilyParameter.LightDimmingColor(familyType=applyLightDimmingColor)
watch_6 = Watch(lightDimmingColor)

# group: Initial Color
code_block_6 = CodeBlock(familyType=byName)
# ---------- code_block_6.designscript (6 lines) ----------
familyType;
// Style
"PresetColor";

3100;
"FluorescentWarm";
# ----------------------------------------
light_color_styles = InitialColor("Custom color")
applyLightColor = Orchid.RevitFamily.FamilyParameter.ApplyLightColor(familyType=code_block_6.familyType, style=light_color_styles, value=code_block_6.out2)
light_color_presets = ColorPreset("Fluorescent (Warm White)")
applyLightPresetColor = Orchid.RevitFamily.FamilyParameter.ApplyLightPresetColor(familyType=code_block_6.familyType, color=light_color_presets)
applyLightCustomColor = Orchid.RevitFamily.FamilyParameter.ApplyLightCustomColor(familyType=code_block_6.familyType, value=code_block_6.out2)

# group: Initial Color
lightColor = Orchid.RevitFamily.FamilyParameter.LightColor(familyType=applyLightColor)
watch_7 = Watch(lightColor.Style)
watch_8 = Watch(lightColor.Value)
lightColor_2 = Orchid.RevitFamily.FamilyParameter.LightColor(familyType=applyLightPresetColor)
watch_9 = Watch(lightColor_2.Style)
watch_10 = Watch(lightColor_2.Value)
lightColor_3 = Orchid.RevitFamily.FamilyParameter.LightColor(familyType=applyLightCustomColor)
watch_11 = Watch(lightColor_3.Style)
watch_12 = Watch(lightColor_3.Value)

# group: Initial Intensity
code_block_7 = CodeBlock(familyType=byName)
# ---------- code_block_7.designscript (14 lines) ----------
familyType;
// Style
"Flux";

// Wattage
10;
150;
// Flux
1400;
// Luminous
440;
// lluminance
50;
3048;
# ----------------------------------------
light_intensities = InitialIntensity("Flux intensity")
applyLightIntensity = Orchid.RevitFamily.FamilyParameter.ApplyLightIntensity(familyType=code_block_7.familyType, style=light_intensities, valueA=code_block_7.out4)
applyLightWattageIntensity = Orchid.RevitFamily.FamilyParameter.ApplyLightWattageIntensity(familyType=code_block_7.familyType, wattage=code_block_7.out2, efficacy=code_block_7.out3)
applyLightFluxIntensity = Orchid.RevitFamily.FamilyParameter.ApplyLightFluxIntensity(familyType=code_block_7.familyType, value=code_block_7.out4)
applyLightIlluminanceIntensity = Orchid.RevitFamily.FamilyParameter.ApplyLightIlluminanceIntensity(familyType=code_block_7.familyType, illuminance=code_block_7.out6, distance=code_block_7.out7)
applyLightLuminousIntensity = Orchid.RevitFamily.FamilyParameter.ApplyLightLuminousIntensity(familyType=code_block_7.familyType, value=code_block_7.out5)

# group: Initial Intensity
lightIntensity = Orchid.RevitFamily.FamilyParameter.LightIntensity(familyType=applyLightIntensity)
watch_13 = Watch(lightIntensity.Style)
watch_14 = Watch(lightIntensity.Value)
lightIntensity_2 = Orchid.RevitFamily.FamilyParameter.LightIntensity(familyType=applyLightWattageIntensity)
watch_15 = Watch(lightIntensity_2.Style)
watch_16 = Watch(lightIntensity_2.Value)
lightIntensity_3 = Orchid.RevitFamily.FamilyParameter.LightIntensity(familyType=applyLightFluxIntensity)
watch_17 = Watch(lightIntensity_3.Style)
watch_18 = Watch(lightIntensity_3.Value)
lightIntensity_4 = Orchid.RevitFamily.FamilyParameter.LightIntensity(familyType=applyLightIlluminanceIntensity)
watch_19 = Watch(lightIntensity_4.Style)
watch_20 = Watch(lightIntensity_4.Value)
lightIntensity_5 = Orchid.RevitFamily.FamilyParameter.LightIntensity(familyType=applyLightLuminousIntensity)
watch_21 = Watch(lightIntensity_5.Style)
watch_22 = Watch(lightIntensity_5.Value)

# group: Loss Factor
code_block_8 = CodeBlock(familyType=byName)
# ---------- code_block_8.designscript (7 lines) ----------
familyType;

// Style
"Basic";
3.00;
1.25;
0.75;
# ----------------------------------------
light_loss_factors = LossFactor("Basic loss factor")
applyLightLossFactor = Orchid.RevitFamily.FamilyParameter.ApplyLightLossFactor(familyType=code_block_8.familyType, style=light_loss_factors, value=code_block_8.out2, temperature=code_block_8.out3, voltage=code_block_8.out3, ballast=code_block_8.out4, tilt=code_block_8.out4, surface=code_block_8.out4, lumen=code_block_8.out4, luminaire=code_block_8.out4)
applyAdvancedLossFactor = Orchid.RevitFamily.FamilyParameter.ApplyAdvancedLossFactor(familyType=code_block_8.familyType, temperature=code_block_8.out3, voltage=code_block_8.out3, ballast=code_block_8.out4, tilt=code_block_8.out4, surface=code_block_8.out4, lumen=code_block_8.out4, luminaire=code_block_8.out4)
applyBasicLossFactor = Orchid.RevitFamily.FamilyParameter.ApplyBasicLossFactor(familyType=code_block_8.familyType, value=code_block_8.out2)

# group: Loss Factor
lightLossFactor = Orchid.RevitFamily.FamilyParameter.LightLossFactor(familyType=applyLightLossFactor)
watch_23 = Watch(lightLossFactor.Style)
watch_24 = Watch(lightLossFactor.Value)
lightLossFactor_2 = Orchid.RevitFamily.FamilyParameter.LightLossFactor(familyType=applyAdvancedLossFactor)
watch_25 = Watch(lightLossFactor_2.Style)
watch_26 = Watch(lightLossFactor_2.Value)
lightLossFactor_3 = Orchid.RevitFamily.FamilyParameter.LightLossFactor(familyType=applyBasicLossFactor)
watch_27 = Watch(lightLossFactor_3.Style)
watch_28 = Watch(lightLossFactor_3.Value)
