# Dynamo graph Nested-Lookup.dyn (Dynamo 2.19.3.6394)
# packages: Orchid 2.19.3.6432

# group: Load a family (nested)
string = StringInput("%OrchidSamples%\Data\testSet\Front - Plain.rfa")  # graph input
backgroundOpen = Orchid.RevitProject.Common.Document.BackgroundOpen(file=string)
load = Orchid.RevitFamily.Family.Load(familyDocument=backgroundOpen)
await_ = Orchid.Common.DataStream.Await(pass=backgroundOpen, waitFors=load)
close = Orchid.RevitProject.Common.Document.Close(document=await_)

# group: create default family type
# File: defaultFamily
current = Orchid.RevitFamily.FamilyDocument.Current()
create = Orchid.RevitFamily.FamilyType.Create(familyDocument=current)
await_2 = Orchid.Common.DataStream.Await(pass=current, waitFors=create)

# group: Create Family Type parameter (Category)
await_3 = Orchid.Common.DataStream.Await(pass=await_2, waitFors=load)
code_block = CodeBlock()
# ---------- code_block.designscript (8 lines) ----------
//Parameter name
["testFamily"];
//GroupType
"AdskModelProperties";
//Instances
true;
//Reporting
true;
# ----------------------------------------
code_block_2 = CodeBlock { Revit.Category.ByName("Casework"); }
byName = Orchid.AdeskApp.GroupType.ByName(string=code_block.out1)
create_2 = Orchid.RevitFamily.FamilyParameter.Create(familyDocument=await_3, parameterName=code_block.out0, category=code_block_2, groupType=byName)

# group: Create ordinary parameter
code_block_3 = CodeBlock()
# ---------- code_block_3.designscript (6 lines) ----------
//Parameter name
["Width","Height","testValue"];
//SpecType
"Length";
//GroupType
"AdskModelProperties";
# ----------------------------------------
byName_2 = Orchid.AdeskApp.SpecType.ByName(string=code_block_3.out1)
byName_3 = Orchid.AdeskApp.GroupType.ByName(string=code_block_3.out2)
create_3 = Orchid.RevitFamily.FamilyParameter.Create(familyDocument=await_2, parameterName=code_block_3.out0, specType=byName_2, groupType=byName_3)

# group: Set parameter
await_4 = Orchid.Common.DataStream.Await(pass=await_2, waitFors=create_3)
code_block_4 = CodeBlock()
# ---------- code_block_4.designscript (4 lines) ----------
//Parameter name
"Width";
//Value
800.0;
# ----------------------------------------
setValue = Orchid.RevitFamily.FamilyParameter.SetValue(familyDocument=await_4, parameterName=code_block_4.out0, value=code_block_4.out1)

# group: Associate parameter
await_5 = Orchid.Common.DataStream.Await(pass=await_4, waitFors=setValue)
code_block_5 = CodeBlock()
# ---------- code_block_5.designscript (2 lines) ----------
//Parameter name
"Width";
# ----------------------------------------
types = Family.Types(family=load)
associate = Orchid.RevitFamily.FamilyParameter.Associate(familyDocument=await_5, parameterName=code_block_5, element=types, elementParameter=code_block_5)
await_6 = Orchid.Common.DataStream.Await(pass=await_5, waitFors=associate)

# group: parameters
parameters = Orchid.RevitFamily.FamilyDocument.Parameters(familyDocument=await_6)
name = FamilyParameter.Name(familyParameter=parameters)
watch = Watch(name)
toRevitType = Orchid.Common.Object.ToRevitType(object=parameters)

# group: Create ordinary parameter
code_block_6 = CodeBlock()
# ---------- code_block_6.designscript (6 lines) ----------
//Parameter name
["Lookup Table Name","testKey"];
//SpecType
"Text";
//GroupType
"AdskModelProperties";
# ----------------------------------------
byName_4 = Orchid.AdeskApp.SpecType.ByName(string=code_block_6.out1)
byName_5 = Orchid.AdeskApp.GroupType.ByName(string=code_block_6.out2)
create_4 = Orchid.RevitFamily.FamilyParameter.Create(familyDocument=await_2, parameterName=code_block_6.out0, specType=byName_4, groupType=byName_5)

# group: Set parameter
list_create = List.Create(item0=create_3, item1=create_4)
await_7 = Orchid.Common.DataStream.Await(pass=await_2, waitFors=list_create)
code_block_7 = CodeBlock()
# ---------- code_block_7.designscript (4 lines) ----------
//Parameter name
["Lookup Table Name","testKey"];
//Values
["CSVLookuptable","11x300"];
# ----------------------------------------
setValue_2 = Orchid.RevitFamily.FamilyParameter.SetValue(familyDocument=await_7, parameterName=code_block_7.out0, value=code_block_7.out1)

# group: Add lookup table and use it by setting a formula
await_8 = Orchid.Common.DataStream.Await(pass=await_7, waitFors=setValue_2)
string_2 = StringInput("%OrchidSamples%\Data\CSVLookuptable.csv")  # graph input
addLookupTable = Orchid.RevitFamily.FamilyDocument.AddLookupTable(familyDocument=await_8, file=string_2)
await_9 = Orchid.Common.DataStream.Await(pass=await_8, waitFors=addLookupTable)
code_block_8 = CodeBlock()
# ---------- code_block_8.designscript (4 lines) ----------
//Parameter name
"testValue";
//Values
["size_lookup(Lookup Table Name, \"d\", 0, testKey)"];
# ----------------------------------------
string_3 = StringInput("size_lookup(Lookup Table Name, \"d\", 0, testKey)")  # graph input
input = Orchid.RevitFamily.Formula.Input(familyDocument=await_9, parameterName=code_block_8.out0, value=string_3)

# group: Get nested family type (FamilySymbol) and converters Note: Nested families in a family document is denoted FamilySymbol, and FamilyType in a project document is denoted FamilySymbol in Autodesk Revit API!
nested = Orchid.RevitFamily.FamilyType.Nested(familyDocument=await_6)
watch_2 = Watch(nested)
toRevitType_2 = Orchid.Common.Object.ToRevitType(object=nested)
watch_3 = Watch(toRevitType_2)
toDynamoType = Orchid.Common.Object.ToDynamoType(object=toRevitType_2)
watch_4 = Watch(toDynamoType)
name_2 = Element.Name(element=toDynamoType)
watch_5 = Watch(name_2)

# group: Get nested family and converters
nested_2 = Orchid.RevitFamily.Family.Nested(familyDocument=await_6)
watch_6 = Watch(nested_2.Family)
toRevitType_3 = Orchid.Common.Object.ToRevitType(object=nested_2.Family)
watch_7 = Watch(toRevitType_3)
toDynamoType_2 = Orchid.Common.Object.ToDynamoType(object=toRevitType_3)
watch_8 = Watch(toDynamoType_2)
name_3 = Element.Name(element=toDynamoType_2)
watch_9 = Watch(name_3)

# group: Has the parameter associated element
code_block_9 = CodeBlock()
# ---------- code_block_9.designscript (2 lines) ----------
//Parameter name
["Width","Height"];
# ----------------------------------------
hasAssociated = Orchid.RevitFamily.FamilyParameter.HasAssociated(familyDocument=await_6, parameterName=code_block_9)
watch_10 = Watch(hasAssociated)

# group: Get associated element and parameter
associated = Orchid.RevitFamily.FamilyDocument.Associated(familyDocument=await_6)
watch_11 = Watch(associated.Parameter)
watch_12 = Watch(associated.Element)
watch_13 = Watch(associated.elementParameter)
code_block_10 = CodeBlock()  # same code as code_block_5
associated_2 = Orchid.RevitFamily.FamilyParameter.Associated(familyDocument=await_6, parameterName=code_block_10)
watch_14 = Watch(associated_2.elementParameter)
watch_15 = Watch(associated_2.Element)

# group: Get nested data --> use OOTB nodes inside family document
lastItem = List.LastItem(list=nested)
code_block_11 = CodeBlock()  # same code as code_block_5
value = Orchid.RevitProject.Parameters.Parameter.Value(element=lastItem, parameterName=code_block_11)
watch_16 = Watch(value)
