# Dynamo graph Nested-Lookup_ByParameter.dyn "Nested-Lookup_param" (Dynamo 3.6.1.9895)
# packages: Orchid 3.6.0.6863

# group: Load a family (nested)
string = StringInput("%OrchidSamples%\Data\2026_Data\families\Front - Plain.rfa")  # graph input
backgroundOpen = Orchid.RevitProject.Common.Document.BackgroundOpen(file=string)
load = Orchid.RevitFamily.Family.Load(familyDocument=backgroundOpen)
await_ = Orchid.Common.DataStream.Await(pass=backgroundOpen, waitFor0=load)
close = Orchid.RevitProject.Common.Document.Close(document=await_)

# group: Create default family type
# File: defaultFamily
current = Orchid.RevitFamily.FamilyDocument.Current()
create = Orchid.RevitFamily.FamilyType.Create(familyDocument=current)
await_2 = Orchid.Common.DataStream.Await(pass=current, waitFor0=create)

# group: Create Family Type parameter (Category)
await_3 = Orchid.Common.DataStream.Await(pass=await_2, waitFor0=load)
code_block = CodeBlock()
# ---------- code_block.designscript (8 lines) ----------
//Parameter name
["testFamily"];
//GroupType
"AdskModelProperties";
//Instances
true;
//Reporting
true;
# ----------------------------------------
code_block_2 = CodeBlock { Revit.Category.ByName("Casework"); }
byName = Orchid.AdeskApps.Units.GroupType.ByName(string=code_block.out1)
create_2 = Orchid.RevitFamily.FamilyParameter.Create(familyDocument=await_3, parameterName=code_block.out0, category=code_block_2, groupType=byName)

# group: Create ordinary parameter
code_block_3 = CodeBlock()
# ---------- code_block_3.designscript (6 lines) ----------
//Parameter name
["Width","Height","testValue"];
//SpecType
"Length";
//GroupType
"AdskModelProperties";
# ----------------------------------------
byName_2 = Orchid.AdeskApps.Units.SpecType.ByName(string=code_block_3.out1)
byName_3 = Orchid.AdeskApps.Units.GroupType.ByName(string=code_block_3.out2)
create_3 = Orchid.RevitFamily.FamilyParameter.Create(familyDocument=await_2, parameterName=code_block_3.out0, specType=byName_2, groupType=byName_3)

# group: Set parameter
name = Orchid.RevitFamily.FamilyParameter.Name(familyParameter=create_3)
code_block_4 = CodeBlock(name=name)
# ---------- code_block_4.designscript (4 lines) ----------
//Parameter name
name == "Width";
//Value
800.0;
# ----------------------------------------
filterByBoolMask = List.FilterByBoolMask(list=create_3, mask=code_block_4.out0)
setValue = Orchid.RevitFamily.FamilyParameter.SetValue(familyParameter=filterByBoolMask.in, value=code_block_4.out1)

# group: Associate parameter
types = Family.Types(family=load)
code_block_5 = CodeBlock()
# ---------- code_block_5.designscript (2 lines) ----------
//Parameter name
"Width";
# ----------------------------------------
byName_4 = Orchid.RevitProject.Parameters.Parameter.ByName(element=types, parameterName=code_block_5)
associate = Orchid.RevitFamily.FamilyParameter.Associate(familyParameter=setValue, element=types, elementParameter=byName_4)
await_4 = Orchid.Common.DataStream.Await(pass=await_2, waitFor0=associate)

# group: Get nested family type (FamilySymbol) and converters Note: Nested families in a family document is denoted FamilySymbol, and FamilyType in a project document is denoted FamilySymbol in Autodesk Revit API!
nested = Orchid.RevitFamily.FamilyType.Nested(familyDocument=await_4)
watch = Watch(nested)
toRevitType = Orchid.Common.Object.ToRevitType(object=nested)
watch_2 = Watch(toRevitType)
toDynamoType = Orchid.Common.Object.ToDynamoType(object=toRevitType)
watch_3 = Watch(toDynamoType)
name_2 = Element.Name(element=toDynamoType)
watch_4 = Watch(name_2)

# group: Get nested family and converters
nested_2 = Orchid.RevitFamily.Family.Nested(familyDocument=await_4)
watch_5 = Watch(nested_2.Family)
toRevitType_2 = Orchid.Common.Object.ToRevitType(object=nested_2.Family)
watch_6 = Watch(toRevitType_2)
toDynamoType_2 = Orchid.Common.Object.ToDynamoType(object=toRevitType_2)
watch_7 = Watch(toDynamoType_2)
name_3 = Element.Name(element=toDynamoType_2)
watch_8 = Watch(name_3)

# group: Get associated element and parameter
associated = Orchid.RevitFamily.FamilyDocument.Associated(familyDocument=await_4)
watch_9 = Watch(associated.FamilyParameter)
watch_10 = Watch(associated.Element)
watch_11 = Watch(associated.elementParameter)
associated_2 = Orchid.RevitFamily.FamilyParameter.Associated(familyParameter=associate)
watch_12 = Watch(associated_2.Element)
watch_13 = Watch(associated_2.elementParameter)

# group: Get nested data --> use OOTB nodes inside family document
lastItem = List.LastItem(list=nested)
code_block_6 = CodeBlock()  # same code as code_block_5
value = Orchid.RevitProject.Parameters.Parameter.Value(element=lastItem, parameterName=code_block_6)
watch_14 = Watch(value)

# group: Has the parameter associated element
code_block_7 = CodeBlock()
# ---------- code_block_7.designscript (2 lines) ----------
//Parameter name
["Width","Height"];
# ----------------------------------------
byName_5 = Orchid.RevitFamily.FamilyParameter.ByName(familyDocument=await_4, name=code_block_7)
hasAssociated = Orchid.RevitFamily.FamilyParameter.HasAssociated(familyParameter=byName_5)
watch_15 = Watch(hasAssociated)

# group: parameters
parameters = Orchid.RevitFamily.FamilyDocument.Parameters(familyDocument=await_4)
name_4 = Orchid.RevitFamily.FamilyParameter.Name(familyParameter=parameters)
watch_16 = Watch(name_4)

# group: Create ordinary parameter
code_block_8 = CodeBlock()
# ---------- code_block_8.designscript (6 lines) ----------
//Parameter name
["Lookup Table Name","testKey"];
//SpecType
"Text";
//GroupType
"AdskModelProperties";
# ----------------------------------------
byName_6 = Orchid.AdeskApps.Units.SpecType.ByName(string=code_block_8.out1)
byName_7 = Orchid.AdeskApps.Units.GroupType.ByName(string=code_block_8.out2)
create_4 = Orchid.RevitFamily.FamilyParameter.Create(familyDocument=await_2, parameterName=code_block_8.out0, specType=byName_6, groupType=byName_7)

# group: Set parameter
code_block_9 = CodeBlock()
# ---------- code_block_9.designscript (2 lines) ----------
//Values
["CSVLookuptable","11x300"];
# ----------------------------------------
setValue_2 = Orchid.RevitFamily.FamilyParameter.SetValue(familyParameter=create_4, value=code_block_9)

# group: Add lookup table and use it by setting a formula
await_5 = Orchid.Common.DataStream.Await(pass=await_2, waitFor0=setValue_2)
string_2 = StringInput("%OrchidSamples%\Data\CSVLookuptable.csv")  # graph input
addLookupTable = Orchid.RevitFamily.FamilyDocument.AddLookupTable(familyDocument=await_5, file=string_2)
await_6 = Orchid.Common.DataStream.Await(pass=await_5, waitFor0=addLookupTable)
code_block_10 = CodeBlock(parameters=create_3) { parameters; }
name_5 = Orchid.RevitFamily.FamilyParameter.Name(familyParameter=code_block_10)
code_block_11 = CodeBlock(name=name_5)
# ---------- code_block_11.designscript (4 lines) ----------
//Parameter name
name == "testValue";
//Values
["size_lookup(Lookup Table Name, \"d\", 0, testKey)"];
# ----------------------------------------
filterByBoolMask_2 = List.FilterByBoolMask(list=code_block_10, mask=code_block_11.out0)
string_3 = StringInput("size_lookup(Lookup Table Name, \"d\", 0, testKey)")  # graph input
input = Orchid.RevitFamily.Formula.Input(familyDocument=await_6, familyParameter=filterByBoolMask_2.in, value=string_3)
