# Dynamo graph NestedByCategory.dyn (Dynamo 2.16.2.5624)
# packages: Orchid 2.16.4.6198

# group: 
# File: defaultFamily
code_block = CodeBlock { "Level Heads"; }
byName = Category.ByName(name=code_block)
nestedByCategory = Orchid.RevitFamily.Family.NestedByCategory(category=byName)
watch = Watch(nestedByCategory)

nested = Orchid.RevitFamily.Family.Nested()
watch_2 = Watch(nested.Family)
watch_3 = Watch(nested.Category)
