# Dynamo graph PurgeFamilyDocument.dyn "PurgeFamilyDocument_R23" (Dynamo 2.16.2.5624)
# packages: Orchid 2.16.4.6129

# group: Imported dwg files etc.
purge = Orchid.RevitProject.Common.Imports.Purge()  # frozen
code_block = CodeBlock { "ImportInstance"; }  # frozen
byName = Orchid.RevitProject.Elements.Class.ByName(name=code_block)
ofClass = Orchid.RevitProject.Elements.Element.OfClass(class=byName)
delete = Orchid.RevitProject.Elements.Element.Delete(element=ofClass)

# group: Imported lines from dwg files etc.
deleteImported = Orchid.RevitProject.Categories.Category.DeleteImported()  # frozen
code_block_2 = CodeBlock { "Imports in Families"; }  # frozen
byName_2 = Category.ByName(name=code_block_2)
byCategory = Orchid.RevitProject.Categories.SubCategory.ByCategory(category=byName_2)
delete_2 = Orchid.RevitProject.Categories.SubCategory.Delete(category=byName_2, subCategory=byCategory)
imported = Orchid.RevitProject.Categories.Category.Imported()  # frozen
delete_3 = Orchid.RevitProject.Elements.Element.Delete(element=imported)

# group: 
# All is included in FamilyDocument.Purge
purge_2 = Orchid.Geometry.LinePattern.Purge()  # frozen
purge_3 = Orchid.RevitFamily.FamilyParameter.Purge()  # frozen

# group: 
# All is included in FamilyDocument.Purge
purge_4 = Orchid.RevitMaterial.Material.Purge()  # frozen
purge_5 = Orchid.RevitMaterial.Visual.Asset.Purge()  # frozen

# group: FamilyDocument purge
boolean = BoolSelector(true)  # graph input
purge_6 = Orchid.RevitFamily.FamilyDocument.Purge(completely=boolean)

# group: PostCommand
boolean_2 = BoolSelector(false)  # graph input
purge_7 = Orchid.RevitProject.Common.PostCommand.Purge(activate=boolean_2)  # frozen
