# Dynamo graph ReorderParameters.dyn "ReorderParameters_R23" (Dynamo 2.16.2.5624)
# packages: Orchid 216.3.0.5794

# group: Reorder parameters
# File: defaultFamily
code_block = CodeBlock()
# ---------- code_block.designscript (29 lines) ----------
// new order
[
// Graphics
"Sealing",
"Hinging",
"Above Cutplane",
// Materials and Finishes
"Case/Transom",
"Frame/Mullion",
"Glass",
"Embrasure",
"Sill Plate",
"Wall Surface",
// Dimensions
"Width",
"Height",
"Seal Width",
"Rebate Depth",
"Case Depth",
"Case Width",
"Rabbet Depth",
"Rabbet Width",
"Frame Depth",
"Frame Width",
"Glass Thickness",
"Default Sill Height",
"Rough Width",
"Rough Height"
];
# ----------------------------------------
byName = Orchid.RevitFamily.FamilyParameter.ByName(name=code_block)
reorder = Orchid.RevitFamily.FamilyParameter.Reorder(familyParameter=byName)

code_block_2 = CodeBlock()
# ---------- code_block_2.designscript (29 lines) ----------
// Orginal order
[
// Graphics
"Hinging",
"Above Cutplane",
"Sealing",
// Materials and Finishes
"Glass",
"Frame/Mullion",
"Case/Transom",
"Embrasure",
"Sill Plate",
"Wall Surface",
// Dimensions
"Width",
"Height",
"Rebate Depth",
"Seal Width",
"Case Depth",
"Case Width",
"Frame Depth",
"Frame Width",
"Rabbet Depth",
"Rabbet Width",
"Glass Thickness",
"Default Sill Height",
"Rough Width",
"Rough Height"
];
# ----------------------------------------
