# Dynamo graph SharedParameter.dyn (Dynamo 2.19.3.6394)
# packages: Orchid 2.19.3.6432

# group: Add shared parameters by groupName by provided file
string = StringInput("%OrchidSamples%\Data\COBie Extension Shared Parameters.txt")  # graph input
fromPath = Orchid.Common.File.FromPath(path=string)
code_block = CodeBlock()
# ---------- code_block.designscript (14 lines) ----------
//SP Parameter group
["Floor", "Type"];
//GroupType
["Data", "AdskModelProperties"];
//Instance
[true,false];
//Reporting
//NOTE: this list must follow the order
//of true values in the "Instance" list.
//This list does not have to have same
//length as the above three lists!
[true];
//Condense output
false;
# ----------------------------------------
byName = Orchid.AdeskApp.GroupType.ByName(string=code_block.out1)
addByFile = Orchid.RevitFamily.SharedParameter.AddByFile(file=fromPath, groupName=code_block.out0, groupType=byName, instance=code_block.out2)
watch = Watch(addByFile.FamilyParameter)
name = FamilyParameter.Name(familyParameter=addByFile.FamilyParameter)
watch_2 = Watch(name)

# group: Add shared parameters by groupName (current loaded)
# File: defaultFamily
code_block_2 = CodeBlock()
# ---------- code_block_2.designscript (14 lines) ----------
//SP Parameter group
["Energy", "Dimensions"];
//GroupType
["EnergyAnalysis", "Geometry"];
//Instance
[true, false];
//Reporting
//NOTE: this list must follow the order
//of true values in the "Instance" list.
//This list does not have to have same
//length as the above three lists!
[true];
//Condense output
false;
# ----------------------------------------
byName_2 = Orchid.AdeskApp.GroupType.ByName(string=code_block_2.out1)
addByGroup = Orchid.RevitFamily.SharedParameter.AddByGroup(groupName=code_block_2.out0, groupType=byName_2, instance=code_block_2.out2)
name_2 = FamilyParameter.Name(familyParameter=addByGroup.FamilyParameter)
watch_3 = Watch(name_2)
watch_4 = Watch(addByGroup.FamilyParameter)
