# Dynamo graph Apperance.dyn (Dynamo 3.6.2.11575)
# packages: Orchid 3.6.0.6844

# group: All
inDocument = Orchid.RevitMaterial.Appearance.InDocument()
watch = Watch(inDocument)
name = Element.Name(element=inDocument)
watch_2 = Watch(name)

# group: Duplicate
code_block = CodeBlock { "Default Wall"; "_xx"; }
byName = Orchid.RevitMaterial.Appearance.ByName(name=code_block.out0)
duplicate = Orchid.RevitMaterial.Appearance.Duplicate(appearance=byName, name=code_block.out1)
watch_3 = Watch(duplicate)
appearances = Appearance("Default Wall")  # graph input

# group: Create appearance and material: Timber (C24)
code_block_2 = CodeBlock { "_Timber C24"; "GenericSchema"; "HardwoodSchema"; }
create = Orchid.RevitMaterial.Material.Create(name=code_block_2.out0)
create_2 = Orchid.RevitMaterial.Appearance.Create(name=code_block_2.out0, schema=code_block_2.out1)
applyAppearance = Orchid.RevitMaterial.Material.ApplyAppearance(material=create, appearance=create_2)
watch_4 = Watch(applyAppearance)
name_2 = Material.Name(material=applyAppearance)
watch_5 = Watch(name_2)

# group: Material Appearance Asset
code_block_3 = CodeBlock { "Default"; "Copper - Brushed"; }
byName_2 = Material.ByName(name=code_block_3.out0)
byName_3 = Orchid.RevitMaterial.Appearance.ByName(name=code_block_3.out1)
applyAppearance_2 = Orchid.RevitMaterial.Material.ApplyAppearance(material=byName_2, appearance=byName_3)
watch_6 = Watch(applyAppearance_2)

# group: Asset handling
asset_properties = AssetSchema("Concrete")
boolean = BoolSelector(false)
bySchema = Orchid.RevitMaterial.Visual.Asset.BySchema(schema=asset_properties, default=boolean)
code_block_4 = CodeBlock(t=bySchema) { "_test1"; t[0]; }
create_3 = Orchid.RevitMaterial.Appearance.Create(name=code_block_4.out0, asset=code_block_4.out1)
category = Orchid.RevitMaterial.Visual.Asset.Category(asset=bySchema)
byCategory = Orchid.RevitMaterial.Visual.Asset.ByCategory(category=category)
code_block_5 = CodeBlock()
# ---------- code_block_5.designscript (36 lines) ----------
// Asset Schemas

// Ceramic
"CeramicSchema";
// Concrete
"ConcreteSchema";
// Generic
"GenericSchema";
// Glazing
"GlazingSchema";
// Layered
"PrismLayeredSchema";
// Masonry
"MasonryCMUSchema";
// Metal
"PrismMetalSchema";
// Metalic Paint
"MetallicPaintSchema";
// Mirror
"MirrorSchema";
// Opaque
"PrismOpaqueSchema";
// Plastic
"PlasticVinylSchema";
// Solid Glass
"SolidGlassSchema";
// Stone
"StoneSchema";
// Transparent
"PrismTransparentSchema";
// Wall Paint
"WallPaintSchema";
// Water
"WaterSchema";
// Wood
"HardwoodSchema";
# ----------------------------------------
bySchema_2 = Orchid.RevitMaterial.Visual.Asset.BySchema(schema=code_block_5.out0, default=boolean)
toRevitType = Orchid.RevitCommon.Object.ToRevitType(object=bySchema_2)
watch_7 = Watch(toRevitType)
toOrchidType = Orchid.RevitCommon.Object.ToOrchidType(object=toRevitType)
watch_8 = Watch(toOrchidType)

# group: Material Appearance: Timber (C24)
# File: defaultProject
code_block_6 = CodeBlock { "_Timber C24"; }
byName_4 = Orchid.RevitMaterial.Appearance.ByName(name=code_block_6)
code_block_7 = CodeBlock()
# ---------- code_block_7.designscript (6 lines) ----------
// Description
"Hardwood material";
// Keyword
"pine,wood,interior,
furniture,materials,
hardwood";
# ----------------------------------------
addInformation = Orchid.RevitMaterial.Appearance.AddInformation(appearance=byName_4, description=code_block_7.out0, keyword=code_block_7.out1)
code_block_8 = CodeBlock { 145; 15; 65; }
byARGB = Color.ByARGB(red=code_block_8.out0, green=code_block_8.out1, blue=code_block_8.out2)
string = StringInput("%OrchidSamples%\Data\Stone_3.bmp")  # graph input
fromPath = Orchid.Common.File.FromPath(filePath=string)
image = Orchid.RevitMaterial.Visual.Texture.Image(path=fromPath)
code_block_9 = CodeBlock { 70; 50; true; }
slider = Orchid.RevitMaterial.Visual.Texture.Slider(value=code_block_9.out1)
applyGeneric = Orchid.RevitMaterial.Appearance.ApplyGeneric(appearance=addInformation, color=byARGB, texture=image, imageFade=code_block_9.out0, glossiness=slider, highlights=code_block_9.out2)
code_block_10 = CodeBlock { 40; }
applyReflectivity = Orchid.RevitMaterial.Appearance.ApplyReflectivity(appearance=applyGeneric, direct=code_block_10, oblique=code_block_10)
code_block_11 = CodeBlock { 35; 90; 15; 1.52; }
slider_2 = Orchid.RevitMaterial.Visual.Texture.Slider(value=code_block_11.out2)
transparency_refractions = TransparencyRefraction("Alcohol")
applyTransparency = Orchid.RevitMaterial.Appearance.ApplyTransparency(appearance=applyReflectivity, amount=code_block_11.out0, texture=image, imageFade=code_block_11.out1, translucency=slider_2, refraction=transparency_refractions)
applyCutouts = Orchid.RevitMaterial.Appearance.ApplyCutouts(appearance=applyTransparency, texture=image)
code_block_12 = CodeBlock { Color.ByARGB(255, 205, 135, 165); 10.0; 6500.0; }
color = Orchid.RevitMaterial.Visual.Texture.Color(color=code_block_12.out0)
self_illumination_luminances = SelfIlluminationLuminance("Cell Phone Screen")
self_illumination_color = SelfIlluminationColorTemperatur("Moonlight")  # "Self Illumination Color Temperatures"
applySelfIllumination = Orchid.RevitMaterial.Appearance.ApplySelfIllumination(appearance=applyCutouts, texture=color, luminance=self_illumination_luminances, colorTemperature=self_illumination_color)
code_block_13 = CodeBlock { -500; }
slider_3 = Orchid.RevitMaterial.Visual.Texture.Slider(value=code_block_13)
applyBump = Orchid.RevitMaterial.Appearance.ApplyBump(appearance=applySelfIllumination, texture=image, amount=slider_3)
code_block_14 = CodeBlock { Color.ByARGB(255, 50, 115, 65); }
applyTint = Orchid.RevitMaterial.Appearance.ApplyTint(appearance=applyBump, color=code_block_14)
