# Dynamo graph Physical-Thermal-Concrete.dyn (Dynamo 2.19.3.6394)
# packages: Orchid 2.19.3.6432

# group: Create material: Concrete (C30)
# File: defaultProject
boolean = BoolSelector(true)  # graph input
code_block = CodeBlock { "_Concrete"; }
physical_type = PhysicalType("Concrete")  # graph input
create = Orchid.RevitMaterial.Physical.Create(name=code_block, type=physical_type)
code_block_2 = CodeBlock()
# ---------- code_block_2.designscript (6 lines) ----------
"Concrete f'c=30 MPa";
"structural,concrete,CC:BS 8110";
"thermal,solid";
"Concrete";
"Orchid generated";
"https://github.com/erfajo/OrchidForDynamo";
# ----------------------------------------
setInformation = Orchid.RevitMaterial.Physical.SetInformation(propertySet=create, description=code_block_2.out0, keywords=code_block_2.out1, subclass=code_block_2.out3, source=code_block_2.out4, sourceUrl=code_block_2.out5)
physical_behavior = PhysicalBehavior("Isotropic")  # graph input
setBehavior = Orchid.RevitMaterial.Physical.SetBehavior(propertySet=setInformation, behavior=physical_behavior)
thermal_type = ThermalType("Solid")  # graph input
create_2 = Orchid.RevitMaterial.Thermal.Create(name=code_block, type=thermal_type)
setInformation_2 = Orchid.RevitMaterial.Thermal.SetInformation(propertySet=create_2, description=code_block_2.out0, keywords=code_block_2.out2, subclass=code_block_2.out3, source=code_block_2.out4, sourceUrl=code_block_2.out5)
code_block_3 = CodeBlock { 0.00001; }
setBasicThermal = Orchid.RevitMaterial.Physical.SetBasicThermal(propertySet=setBehavior, expansionCoefficient=code_block_3)
code_block_4 = CodeBlock { 20500; 0.2; 11200; 2406.45; }
setMechanical = Orchid.RevitMaterial.Physical.SetMechanical(propertySet=setBasicThermal, youngModulus=code_block_4.out0, poissonRatio=code_block_4.out1, shearModulus=code_block_4.out2, density=code_block_4.out3)
boolean_2 = BoolSelector(false)  # graph input
physical_behavior_2 = PhysicalBehavior("Isotropic")  # graph input
code_block_5 = CodeBlock { 1.046; 0.657; 2300; 0.95; 182.4; 0.01; 0; 2000000; }
setProperties = Orchid.RevitMaterial.Thermal.SetProperties(propertySet=setInformation_2, transmitsLight=boolean_2, behavior=physical_behavior_2, thermalConductivity=code_block_5.out0, specificHeat=code_block_5.out1, density=code_block_5.out2, emissivity=code_block_5.out3, permeability=code_block_5.out4, porosity=code_block_5.out5, reflectivity=code_block_5.out6, electricalResistivity=code_block_5.out7)
create_3 = Orchid.RevitMaterial.Material.Create(name=code_block)
material_aspect = MaterialAspect("Thermal")  # graph input
setThermal = Orchid.RevitMaterial.Material.SetThermal(material=create_3, aspect=material_aspect, propertySet=setProperties)
name = Material.Name(material=setThermal)
watch = Watch(name)
watch_2 = Watch(setThermal)
material_aspect_2 = MaterialAspect("Physical (Structural)")  # graph input
code_block_6 = CodeBlock { 30.0; 1.0; }
boolean_3 = BoolSelector(false)  # graph input
setConcrete = Orchid.RevitMaterial.Physical.SetConcrete(propertySet=setMechanical, compression=code_block_6.out0, shearStrengthReduction=code_block_6.out1, lightweight=boolean_3)
setPhysical = Orchid.RevitMaterial.Material.SetPhysical(material=create_3, aspect=material_aspect_2, propertySet=setConcrete)
name_2 = Material.Name(material=setPhysical)
watch_3 = Watch(name_2)
watch_4 = Watch(setPhysical)
name_3 = Element.Name(element=setProperties)
byName = Orchid.RevitMaterial.Thermal.ByName(name=name_3)
watch_5 = Watch(byName)
name_4 = Element.Name(element=setConcrete)
byName_2 = Orchid.RevitMaterial.Physical.ByName(name=name_4)
watch_6 = Watch(byName_2)
watch_7 = Watch(name_3)
watch_8 = Watch(name_4)

information = Orchid.RevitMaterial.Physical.Information(propertySet=setInformation)
watch_9 = Watch(information.Keywords)
watch_10 = Watch(information.Subclass)
watch_11 = Watch(information.Source)
watch_12 = Watch(information.SourceUrl)
behavior = Orchid.RevitMaterial.Physical.Behavior(propertySet=setBehavior)
watch_13 = Watch(behavior)
watch_14 = Watch(information.Description)
information_2 = Orchid.RevitMaterial.Thermal.Information(propertySet=setInformation_2)
watch_15 = Watch(information_2.SourceUrl)
watch_16 = Watch(information_2.Source)
watch_17 = Watch(information_2.Subclass)
watch_18 = Watch(information_2.Keywords)
watch_19 = Watch(information_2.Description)
youngModulus = Orchid.RevitMaterial.Physical.YoungModulus(propertySet=setMechanical)
watch_20 = Watch(youngModulus.YoungModulusX)
watch_21 = Watch(youngModulus.YoungModulusY)
watch_22 = Watch(youngModulus.YoungModulusZ)
watch_23 = Watch(youngModulus.YoungModulus1)
watch_24 = Watch(youngModulus.YoungModulus2)
expansionCoefficient = Orchid.RevitMaterial.Physical.ExpansionCoefficient(propertySet=setBasicThermal)
watch_25 = Watch(expansionCoefficient.ExpansionCoefficientX)
watch_26 = Watch(expansionCoefficient.ExpansionCoefficientY)
watch_27 = Watch(expansionCoefficient.ExpansionCoefficientZ)
watch_28 = Watch(expansionCoefficient.ExpansionCoefficient1)
watch_29 = Watch(expansionCoefficient.ExpansionCoefficient2)
watch_30 = Watch(youngModulus.YoungModulus)
watch_31 = Watch(expansionCoefficient.ExpansionCoefficient)
properties = Orchid.RevitMaterial.Thermal.Properties(propertySet=setProperties)
watch_32 = Watch(properties.ThermalConductivity)
watch_33 = Watch(properties.SpecificHeat)
watch_34 = Watch(properties.Density)
watch_35 = Watch(properties.Behavior)
watch_36 = Watch(properties.TransmitsLight)
poissonRatio = Orchid.RevitMaterial.Physical.PoissonRatio(propertySet=setMechanical)
watch_37 = Watch(poissonRatio.PoissonRatioX)
watch_38 = Watch(poissonRatio.PoissonRatioY)
watch_39 = Watch(poissonRatio.PoissonRatioZ)
watch_40 = Watch(poissonRatio.PoissonRatio12)
watch_41 = Watch(poissonRatio.PoissonRatio23)
watch_42 = Watch(properties.ElectricalResistivity)
watch_43 = Watch(properties.Reflectivity)
watch_44 = Watch(properties.Porosity)
watch_45 = Watch(properties.Permeability)
watch_46 = Watch(properties.Emissivity)
watch_47 = Watch(poissonRatio.PoissonRatio)
shearModulus = Orchid.RevitMaterial.Physical.ShearModulus(propertySet=setMechanical)
watch_48 = Watch(shearModulus.ShearModulusX)
watch_49 = Watch(shearModulus.ShearModulusY)
watch_50 = Watch(shearModulus.ShearModulus)
watch_51 = Watch(shearModulus.ShearModulusZ)
watch_52 = Watch(shearModulus.ShearModulus12)
concrete = Orchid.RevitMaterial.Physical.Concrete(propertySet=setConcrete)
watch_53 = Watch(concrete.ShearStrengthReduction)
watch_54 = Watch(concrete.Lightweight)
watch_55 = Watch(concrete.Compression)
density = Orchid.RevitMaterial.Physical.Density(propertySet=setMechanical)
watch_56 = Watch(density)
