# Dynamo graph Physical-Thermal-Gas.dyn (Dynamo 2.16.2.5624)
# packages: Orchid 2.16.4.6196

# group: Create material: Oxygen
# File: defaultProject
boolean = BoolSelector(true)  # graph input
code_block = CodeBlock { "_Oxygen"; }
physical_type = PhysicalType("Gas")  # graph input
create = Orchid.RevitMaterial.Physical.Create(name=code_block, type=physical_type)
code_block_2 = CodeBlock()
# ---------- code_block_2.designscript (6 lines) ----------
"Oxygen, properties at atmospheric pressure";
"structural,gas";
"thermal,gas";
"Gas";
"Orchid generated";
"https://github.com/erfajo/OrchidForDynamo";
# ----------------------------------------
setInformation = Orchid.RevitMaterial.Physical.SetInformation(propertySet=create, description=code_block_2.out0, keywords=code_block_2.out1, subclass=code_block_2.out3, source=code_block_2.out4, sourceUrl=code_block_2.out5)
code_block_3 = CodeBlock { 500; }
setBasicThermal = Orchid.RevitMaterial.Physical.SetBasicThermal(propertySet=setInformation, expansionCoefficient=code_block_3)
code_block_4 = CodeBlock { 1.35; }
setMechanical = Orchid.RevitMaterial.Physical.SetMechanical(propertySet=setBasicThermal, density=code_block_4)
thermal_type = ThermalType("Gas")  # graph input
create_2 = Orchid.RevitMaterial.Thermal.Create(name=code_block, type=thermal_type)
setInformation_2 = Orchid.RevitMaterial.Thermal.SetInformation(propertySet=create_2, description=code_block_2.out0, keywords=code_block_2.out2, subclass=code_block_2.out3, source=code_block_2.out4, sourceUrl=code_block_2.out5)
code_block_5 = CodeBlock { 0.0242; 0.9118; 1.35; 0.01; 0; 1; }
setBasicThermal_2 = Orchid.RevitMaterial.Thermal.SetBasicThermal(propertySet=setInformation_2, thermalConductivity=code_block_5.out0, specificHeat=code_block_5.out1, density=code_block_5.out2, emissivity=code_block_5.out3, gasViscosity=code_block_5.out4, compressibility=code_block_5.out5)
create_3 = Orchid.RevitMaterial.Material.Create(name=code_block)
material_aspect = MaterialAspect("Thermal")  # graph input
setThermal = Orchid.RevitMaterial.Material.SetThermal(material=create_3, aspect=material_aspect, propertySet=setBasicThermal_2)
watch = Watch(setThermal)
name = Material.Name(material=setThermal)
watch_2 = Watch(name)
material_aspect_2 = MaterialAspect("Physical (Structural)")  # graph input
setPhysical = Orchid.RevitMaterial.Material.SetPhysical(material=create_3, aspect=material_aspect_2, propertySet=setMechanical)
watch_3 = Watch(setPhysical)
name_2 = Material.Name(material=setPhysical)
watch_4 = Watch(name_2)

information = Orchid.RevitMaterial.Physical.Information(propertySet=setInformation)
watch_5 = Watch(information.SourceUrl)
watch_6 = Watch(information.Source)
watch_7 = Watch(information.Subclass)
watch_8 = Watch(information.Keywords)
watch_9 = Watch(information.Description)
density = Orchid.RevitMaterial.Physical.Density(propertySet=setMechanical)
watch_10 = Watch(density)
information_2 = Orchid.RevitMaterial.Thermal.Information(propertySet=setInformation_2)
watch_11 = Watch(information_2.Subclass)
watch_12 = Watch(information_2.Keywords)
watch_13 = Watch(information_2.Description)
watch_14 = Watch(information_2.Source)
watch_15 = Watch(information_2.SourceUrl)
basicThermal = Orchid.RevitMaterial.Thermal.BasicThermal(propertySet=setBasicThermal_2)
watch_16 = Watch(basicThermal.Density)
watch_17 = Watch(basicThermal.Emissivity)
watch_18 = Watch(basicThermal.GasViscosity)
watch_19 = Watch(basicThermal.SpecificHeat)
watch_20 = Watch(basicThermal.ThermalConductivity)
expansionCoefficient = Orchid.RevitMaterial.Physical.ExpansionCoefficient(propertySet=setBasicThermal)
watch_21 = Watch(expansionCoefficient.ExpansionCoefficient2)
watch_22 = Watch(expansionCoefficient.ExpansionCoefficient1)
watch_23 = Watch(expansionCoefficient.ExpansionCoefficientZ)
watch_24 = Watch(expansionCoefficient.ExpansionCoefficientY)
watch_25 = Watch(expansionCoefficient.ExpansionCoefficientX)
watch_26 = Watch(expansionCoefficient.ExpansionCoefficient)
watch_27 = Watch(basicThermal.Compressibility)
