# Dynamo graph BuiltInParameter.dyn (Dynamo 2.16.2.5624)
# packages: Orchid 2.16.4.6197

inDocument = Orchid.RevitProject.Parameters.BuiltInParameter.InDocument()
label = Orchid.RevitProject.Parameters.BuiltInParameter.Label(builtInParameter=inDocument)
watch = Watch(label)

# group: 
# File: defaultProject
code_block = CodeBlock { "MATERIAL_ID_PARAM"; }
byName = Orchid.RevitProject.Parameters.BuiltInParameter.ByName(name=code_block)
label_2 = Orchid.RevitProject.Parameters.BuiltInParameter.Label(builtInParameter=byName)
watch_2 = Watch(label_2)
name = Orchid.RevitProject.Parameters.BuiltInParameter.Name(builtInParameter=byName)
watch_3 = Watch(name)
watch_4 = Watch(byName)
builtin_parameters = BuiltInParameter("MATERIAL_ID_PARAM")  # graph input

name_2 = Orchid.RevitProject.Parameters.BuiltInParameter.Name(builtInParameter=inDocument)
watch_5 = Watch(name_2)
watch_6 = Watch(inDocument)
