# Dynamo graph Category.dyn (Dynamo 2.19.3.6394)
# packages: Orchid 2.19.3.6432

# group: CategorySet
boolean = BoolSelector(false)
electrical = Orchid.RevitProject.Categories.CategorySet.Electrical(instance=boolean)
watch = Watch(electrical)
piping = Orchid.RevitProject.Categories.CategorySet.Piping(instance=boolean)
watch_2 = Watch(piping)
architecture = Orchid.RevitProject.Categories.CategorySet.Architecture(instance=boolean)
watch_3 = Watch(architecture)
structure = Orchid.RevitProject.Categories.CategorySet.Structure(instance=boolean)
watch_4 = Watch(structure)
infrastructure = Orchid.RevitProject.Categories.CategorySet.Infrastructure(instance=boolean)
watch_5 = Watch(infrastructure)
mechanical = Orchid.RevitProject.Categories.CategorySet.Mechanical(instance=boolean)
watch_6 = Watch(mechanical)

# group: Category --> BuiltInCategory and CategoryType
inDocument = Orchid.RevitProject.Categories.Category.InDocument()
categoryType = Orchid.RevitProject.Categories.Category.CategoryType(category=inDocument)
groupByKey = List.GroupByKey(list=inDocument, keys=categoryType)
watch_7 = Watch(groupByKey.groups)
watch_8 = Watch(groupByKey.uniqueKeys)
watch_9 = Watch(categoryType)
watch_10 = Watch(inDocument)

natural_category_name = CodeBlock()
# ---------- natural_category_name.designscript (26 lines) ----------
[
"Casework",
"Ceilings",
"Columns",
"Curtain Wall Mullions",
"Curtain Panels",
"Curtain Systems",
"Doors",
"Entourage",
"Floors",
"Furniture",
"Furniture Systems",
"Generic Models",
"Plumbing Fixtures",
"Ramps",
"Roofs",
"Specialty Equipment",
"Stairs",
"Structural Columns",
"Structural Foundations",
"Structural Framing",
"Structural Beam Systems",
"Structural Stiffeners",
"Walls",
"Windows"
];
# ----------------------------------------

# group: SubCategory
byName = Category.ByName(name=natural_category_name)
byCategory = Orchid.RevitProject.Categories.SubCategory.ByCategory(category=byName)
watch_11 = Watch(byCategory)
code_block = CodeBlock(list=byCategory) { list[0][3]; }
string_from_object = FromObject(object=code_block)
byName_2 = Orchid.RevitProject.Categories.SubCategory.ByName(name=string_from_object)
watch_12 = Watch(byName_2)

# group: SubCategory
code_block_2 = CodeBlock { "Casework"; "Cabinet"; "Test"; }
byName_3 = Category.ByName(name=code_block_2.out0)
byName_4 = Orchid.RevitProject.Categories.SubCategory.ByName(category=byName_3, name=code_block_2.out1)
watch_13 = Watch(byName_4)
create = Orchid.RevitProject.Categories.SubCategory.Create(category=byName_3, name=code_block_2.out2)
delete = Orchid.RevitProject.Categories.SubCategory.Delete(subCategory=create)
watch_14 = Watch(delete)

# group: Category --> Imported
deleteImported = Orchid.RevitProject.Categories.Category.DeleteImported()  # frozen
imported = Orchid.RevitProject.Categories.Category.Imported()
watch_15 = Watch(imported)

# group: enum
code_block_3 = CodeBlock()
# ---------- code_block_3.designscript (11 lines) ----------
"CategoryType";

"Model";
"Annotation";
"AnalyticalModel";
"Internal";

["Model",
"Annotation",
"AnalyticalModel",
"Internal"];
# ----------------------------------------
enumByName = Orchid.AdeskApp.Revit.EnumByName(enumType=code_block_3.out0, valueName=code_block_3.out1)

# group: Category --> ByCategoryType
# File: defaultProject
byCategoryType = Orchid.RevitProject.Categories.Category.ByCategoryType(categoryType=enumByName)
watch_16 = Watch(byCategoryType)

built_in_categories = CodeBlock()
# ---------- built_in_categories.designscript (26 lines) ----------
[
"OST_Casework",
"OST_Ceilings",
"OST_Columns",
"OST_CurtainWallMullions",
"OST_CurtainWallPanels",
"OST_CurtaSystem",
"OST_Doors",
"OST_Entourage",
"OST_Floors",
"OST_Furniture",
"OST_FurnitureSystems",
"OST_GenericModel",
"OST_PlumbingFixtures",
"OST_Ramps",
"OST_Roofs",
"OST_SpecialityEquipment",
"OST_Stairs",
"OST_StructuralColumns",
"OST_StructuralFoundation",
"OST_StructuralFraming",
"OST_StructuralFramingSystem",
"OST_StructuralStiffener",
"OST_Walls",
"OST_Windows"
];
# ----------------------------------------
