# Dynamo graph Elem+Fam.dyn (Dynamo 2.19.3.6394)
# packages: Orchid 2.19.3.6432

# group: Family
code_block = CodeBlock { "Ext. Single-Flush"; }
byName = Orchid.RevitProject.Elements.Family.ByName(name=code_block)
byFamily = Orchid.RevitProject.Elements.Element.ByFamily(family=byName)
watch = Watch(byFamily)
families = Family("Ext. Single-Flush")

# group: Collect
# File: defaultProject
code_block_2 = CodeBlock { ["Floors","Walls","Windows"]; }
byName_2 = Category.ByName(name=code_block_2)
byCategory = Orchid.RevitProject.Elements.Element.ByCategory(category=byName_2)

info = Orchid.RevitProject.Elements.Element.Info(element=byCategory.Element)
watch_2 = Watch(info.Owner)
watch_3 = Watch(info.Creator)
watch_4 = Watch(info.LastChangedBy)
watch_5 = Watch(info.RequestedBy)
name = Element.Name(element=byCategory.Element)
watch_6 = Watch(name)
familyName = Orchid.RevitProject.Elements.Element.FamilyName(element=byCategory.Element)
watch_7 = Watch(familyName)
elementType = Element.ElementType(element=byCategory.Element)
uniqueItems = List.UniqueItems(list=elementType@L2)
familyName_2 = Orchid.RevitProject.Elements.ElementType.FamilyName(elementType=uniqueItems)
watch_8 = Watch(familyName_2)
name_2 = Orchid.RevitProject.Elements.ElementType.Name(elementType=uniqueItems)
watch_9 = Watch(name_2)
