# Dynamo graph Filter.dyn (Dynamo 2.19.3.6394)
# packages: Orchid 2.19.3.6432

# group: Filter elements
code_block = CodeBlock { ["Windows","Doors"]; }
byName = Category.ByName(name=code_block)
all_elements_of_category = ElementsOfCategory(Category=byName)
code_block_2 = CodeBlock { "12x"; "Doors"; "Windows"; }
byName_2 = Category.ByName(name=code_block_2.out2)
byCategory = Orchid.RevitProject.Elements.Filter.ByCategory(element=all_elements_of_category, value=byName_2)
byCategory_2 = Orchid.RevitProject.Elements.Filter.ByCategory(element=all_elements_of_category, value=code_block_2.out1)
code_block_3 = CodeBlock { "RuleType"; "Contains"; }
enumByName = Orchid.AdeskApps.Dynamo.EnumByName(enumType=code_block_3.out0, valueName=code_block_3.out1)
byName_3 = Orchid.RevitProject.Elements.Filter.ByName(element=all_elements_of_category, ruleType=enumByName, value=code_block_2.out0)
code_block_4 = CodeBlock { "Family"; }
family_types = FamilyTypes("Int. Single-Flush:9x21M")  # graph input
byParameter = Orchid.RevitProject.Elements.Filter.ByParameter(element=all_elements_of_category, parameterName=code_block_4, value=family_types)
code_block_5 = CodeBlock()
# ---------- code_block_5.designscript (13 lines) ----------
// Dynamo RuleTypes
"BeginsWith";
"Contains";
"EndsWith";
"Equals";
"Greater";
"Less";
"GreaterOrEqual";
"LessOrEqual";
"NotBeginsWith";
"NotContains";
"NotEndsWith";
"NotEquals";
# ----------------------------------------
code_block_6 = CodeBlock { "Width"; 1000; "Level"; }
levels = Levels("Level 1")  # graph input
byParameter_2 = Orchid.RevitProject.Elements.Filter.ByParameter(element=all_elements_of_category, parameterName=code_block_6.out2, value=levels)
elementType = Element.ElementType(element=all_elements_of_category)
code_block_7 = CodeBlock { "RuleType"; "Greater"; }
enumByName_2 = Orchid.AdeskApps.Dynamo.EnumByName(enumType=code_block_7.out0, valueName=code_block_7.out1)
byParameter_3 = Orchid.RevitProject.Elements.Filter.ByParameter(element=elementType, ruleType=enumByName_2, parameterName=code_block_6.out0, value=code_block_6.out1)
filter_rule_type = RuleType("BeginsWith")

watch = Watch(byCategory)
watch_2 = Watch(byCategory_2)
watch_3 = Watch(byName_3)
watch_4 = Watch(byParameter)
watch_5 = Watch(byParameter_2)
watch_6 = Watch(byParameter_3)
