# Dynamo graph LightSource_FamilyType.dyn (Dynamo 3.7.0.11777)
# packages: Orchid 2.19.3.6432

inDocument = Orchid.RevitProject.Elements.FamilyType.InDocument()
watch = Watch(inDocument.FamilyType)
watch_2 = Watch(inDocument.Category)

# group: collect
# File: Electrical_Basic
code_block = CodeBlock { "LundtofteLamp"; }
byName = Orchid.RevitProject.Elements.Family.ByName(name=code_block)
types = Family.Types(family=byName)

# group: Set light color filter data
code_block_2 = CodeBlock(familyType=types)
# ---------- code_block_2.designscript (3 lines) ----------
familyType;
Color.ByARGB
(0, 127, 127, 127);
# ----------------------------------------
applyLightColorFilter = Orchid.RevitProject.Elements.FamilyType.ApplyLightColorFilter(familyType=code_block_2.familyType, color=code_block_2.out1)

# group: Get light color filter data
lightColorFilter = Orchid.RevitProject.Elements.FamilyType.LightColorFilter(familyType=applyLightColorFilter)
watch_3 = Watch(lightColorFilter)

# group: Set light distribution data
code_block_3 = CodeBlock(familyType=types) { familyType; "Spherical"; }
light_distribution_styles = LightDistributionStyle("Spot light distribution")
applyLightDistribution = Orchid.RevitProject.Elements.FamilyType.ApplyLightDistribution(familyType=code_block_3.familyType, style=light_distribution_styles)

# group: Get light distribution data
lightDistribution = Orchid.RevitProject.Elements.FamilyType.LightDistribution(familyType=applyLightDistribution)
watch_4 = Watch(lightDistribution.Style)
watch_5 = Watch(lightDistribution.Value)

# group: Set light shape data
code_block_4 = CodeBlock(familyType=types) { familyType; "Point"; }
light_shape_styles = LightShapeStyle("Rectangle")
applyLightShape = Orchid.RevitProject.Elements.FamilyType.ApplyLightShape(familyType=code_block_4.familyType, style=light_shape_styles)

# group: Get light shape data
lightShape = Orchid.RevitProject.Elements.FamilyType.LightShape(familyType=applyLightShape)
watch_6 = Watch(lightShape.Style)
watch_7 = Watch(lightShape.Value)

# group: Set light dimming color data
code_block_5 = CodeBlock(familyType=types) { familyType; "None"; }
light_dimming_colors = LightDimmingColor("Incandescent lamp curve dimming color")
applyLightDimmingColor = Orchid.RevitProject.Elements.FamilyType.ApplyLightDimmingColor(familyType=code_block_5.familyType, color=light_dimming_colors)

# group: Get light dimming color data
lightDimmingColor = Orchid.RevitProject.Elements.FamilyType.LightDimmingColor(familyType=applyLightDimmingColor)
watch_8 = Watch(lightDimmingColor)

# group: Set light color
code_block_6 = CodeBlock(familyType=types)
# ---------- code_block_6.designscript (6 lines) ----------
familyType;
// Style
"PresetColor";

3100;
"FluorescentWarm";
# ----------------------------------------
applyLightCustomColor = Orchid.RevitProject.Elements.FamilyType.ApplyLightCustomColor(familyType=code_block_6.familyType, value=code_block_6.out2)  # frozen
light_color_presets = ColorPreset("Fluorescent (Warm White)")
applyLightPresetColor = Orchid.RevitProject.Elements.FamilyType.ApplyLightPresetColor(familyType=code_block_6.familyType, color=light_color_presets)  # frozen
light_color_styles = InitialColor("Custom color")
applyLightColor = Orchid.RevitProject.Elements.FamilyType.ApplyLightColor(familyType=code_block_6.familyType, style=light_color_styles, color=light_color_presets, value=code_block_6.out2)

# group: Get light color
lightColor = Orchid.RevitProject.Elements.FamilyType.LightColor(familyType=applyLightCustomColor)
watch_9 = Watch(lightColor.Value)
lightColor_2 = Orchid.RevitProject.Elements.FamilyType.LightColor(familyType=applyLightPresetColor)
watch_10 = Watch(lightColor_2.Value)
lightColor_3 = Orchid.RevitProject.Elements.FamilyType.LightColor(familyType=applyLightColor)
watch_11 = Watch(lightColor_3.Style)
watch_12 = Watch(lightColor_3.Value)

# group: Set light intensity
code_block_7 = CodeBlock(familyType=types)
# ---------- code_block_7.designscript (14 lines) ----------
familyType;
// Style
"Flux";

// Wattage
10;
150;
// Flux
1400;
// Luminous
440;
// lluminance
50;
3048;
# ----------------------------------------
applyLightWattageIntensity = Orchid.RevitProject.Elements.FamilyType.ApplyLightWattageIntensity(familyType=code_block_7.familyType, wattage=code_block_7.out2, efficacy=code_block_7.out3)  # frozen
applyLightFluxIntensity = Orchid.RevitProject.Elements.FamilyType.ApplyLightFluxIntensity(familyType=code_block_7.familyType, value=code_block_7.out4)  # frozen
applyLightLuminousIntensity = Orchid.RevitProject.Elements.FamilyType.ApplyLightLuminousIntensity(familyType=code_block_7.familyType, value=code_block_7.out5)  # frozen
applyLightIlluminanceIntensity = Orchid.RevitProject.Elements.FamilyType.ApplyLightIlluminanceIntensity(familyType=code_block_7.familyType, illuminance=code_block_7.out6, distance=code_block_7.out7)  # frozen
light_intensities = InitialIntensity("Flux intensity")
applyLightIntensity = Orchid.RevitProject.Elements.FamilyType.ApplyLightIntensity(familyType=code_block_7.familyType, style=light_intensities, valueA=code_block_7.out4)

# group: Get light intensity
lightIntensity = Orchid.RevitProject.Elements.FamilyType.LightIntensity(familyType=applyLightWattageIntensity)
watch_13 = Watch(lightIntensity.Value)
lightIntensity_2 = Orchid.RevitProject.Elements.FamilyType.LightIntensity(familyType=applyLightFluxIntensity)
watch_14 = Watch(lightIntensity_2.Value)
lightIntensity_3 = Orchid.RevitProject.Elements.FamilyType.LightIntensity(familyType=applyLightLuminousIntensity)
watch_15 = Watch(lightIntensity_3.Value)
lightIntensity_4 = Orchid.RevitProject.Elements.FamilyType.LightIntensity(familyType=applyLightIlluminanceIntensity)
watch_16 = Watch(lightIntensity_4.Value)
lightIntensity_5 = Orchid.RevitProject.Elements.FamilyType.LightIntensity(familyType=applyLightIntensity)
watch_17 = Watch(lightIntensity_5.Style)
watch_18 = Watch(lightIntensity_5.Value)

# group: Set light loss factor
code_block_8 = CodeBlock(familyType=types)
# ---------- code_block_8.designscript (7 lines) ----------
familyType;

// Style
"Basic";
3.0;
1.25;
0.75;
# ----------------------------------------
applyBasicLossFactor = Orchid.RevitProject.Elements.FamilyType.ApplyBasicLossFactor(familyType=code_block_8.familyType, value=code_block_8.out2)  # frozen
applyAdvancedLossFactor = Orchid.RevitProject.Elements.FamilyType.ApplyAdvancedLossFactor(familyType=code_block_8.familyType, temperature=code_block_8.out3, voltage=code_block_8.out3, ballast=code_block_8.out4, tilt=code_block_8.out4, surface=code_block_8.out4, lumen=code_block_8.out4, luminaire=code_block_8.out4)  # frozen
light_loss_factors = LossFactor("Basic loss factor")
applyLightLossFactor = Orchid.RevitProject.Elements.FamilyType.ApplyLightLossFactor(familyType=code_block_8.familyType, style=light_loss_factors, value=code_block_8.out2, temperature=code_block_8.out3, voltage=code_block_8.out3, ballast=code_block_8.out4, tilt=code_block_8.out4, surface=code_block_8.out4, lumen=code_block_8.out4, luminaire=code_block_8.out4)

# group: Get light loss factor
lightLossFactor = Orchid.RevitProject.Elements.FamilyType.LightLossFactor(familyType=applyBasicLossFactor)
watch_19 = Watch(lightLossFactor.Value)
lightLossFactor_2 = Orchid.RevitProject.Elements.FamilyType.LightLossFactor(familyType=applyAdvancedLossFactor)
watch_20 = Watch(lightLossFactor_2.Value)
lightLossFactor_3 = Orchid.RevitProject.Elements.FamilyType.LightLossFactor(familyType=applyLightLossFactor)
watch_21 = Watch(lightLossFactor_3.Style)
watch_22 = Watch(lightLossFactor_3.Value)
