# Dynamo graph SaveFromProject_Families.dyn (Dynamo 2.19.3.6394)
# packages: Orchid 2.19.4.6491

# group: selected families by category in project
# File: defaultProject
code_block = CodeBlock { ["Doors","Windows"]; }
byName = Category.ByName(name=code_block)
byCategory = Orchid.RevitProject.Elements.ElementType.ByCategory(category=byName)
family = FamilyType.Family(familyType=byCategory.ElementType)
uniqueItems = List.UniqueItems(list=family, lacing=Longest)
directory = Orchid.RevitProject.Common.Document.Directory()
boolean = BoolSelector(true)  # graph input
save = Orchid.RevitProject.Elements.Family.Save(family=uniqueItems, path=directory, subfolder=boolean)

watch = Watch(save)

# group: Set directory path
directory_2 = Orchid.RevitProject.Common.Document.Directory()
code_block_2 = CodeBlock { 1; }
subPath = Orchid.Common.Directory.SubPath(directory=directory_2, remove=code_block_2)
code_block_3 = CodeBlock(directory=subPath)
# ---------- code_block_3.designscript (2 lines) ----------
directory+
"\\LibTemp";
# ----------------------------------------

# group: selected families by category in project -- extended
inDocument = Orchid.RevitProject.Categories.Category.InDocument()  # frozen
byCategory_2 = Orchid.RevitProject.Elements.ElementType.ByCategory(category=inDocument)
string_from_object = FromObject(object=byCategory_2.Category)
code_block_4 = CodeBlock()
# ---------- code_block_4.designscript (5 lines) ----------
// Filter element types
["Curtain","Group"];

// Filter dynamo class
"FamilyType";
# ----------------------------------------
contains = String.Contains(string=string_from_object, searchFor=code_block_4.out0, lacing=CrossProduct)
anyTrue = Orchid.Common.List.AnyTrue(list=contains)
filterByBoolMask = List.FilterByBoolMask(list=byCategory_2.ElementType, mask=anyTrue)
classByName = Orchid.AdeskApp.Dynamo.ClassByName(name=code_block_4.out1)
ofClass = Orchid.Common.Object.OfClass(object=filterByBoolMask.out, class=classByName, lacing=Longest)
clean = Orchid.Common.List.Clean(list=ofClass)
family_2 = FamilyType.Family(familyType=clean)
uniqueItems_2 = List.UniqueItems(list=family_2, lacing=Longest)
boolean_2 = BoolSelector(true)  # graph input
save_2 = Orchid.RevitProject.Elements.Family.Save(family=uniqueItems_2, path=code_block_3, subfolder=boolean_2)

# group: Cleanup backup files
await_ = Orchid.Common.DataStream.Await(pass=code_block_3, waitFor0=save_2)
string = StringInput("*.0001.rfa")  # graph input
boolean_3 = BoolSelector(true)  # graph input
contents = Orchid.Common.Directory.Contents(directory=await_, searchString=string, deepSearch=boolean_3)
deleteFile = FileSystem.DeleteFile(path=contents)

watch_2 = Watch(save_2)
