# Dynamo graph ExportFileFromView.dyn (Dynamo 2.19.3.6394)
# packages: Orchid 2.19.3.6432

# group: Path
current = Orchid.RevitProject.Common.Document.Current()
boolean = BoolSelector(false)
path = Orchid.RevitProject.Common.Document.Path(document=current, withExtension=boolean)

# group: Set "IBB 2000" export settings
# File: defaultProject
code_block = CodeBlock()
# ---------- code_block.designscript (18 lines) ----------
"IBB 2000";

// merge files into one?
true;

// filepaths
path1 = "C:\\ProgramData\\Autodesk\\RVT ";
path2 = "\\Libraries\\DanEDU\\Generic Project\\";
layer = "DanEDU Exportlayers.txt";
lines = "DanEDU Linetypes.lin";
format =  Orchid.AdeskApp.Revit.Format;
layerMapping = path1 + format + path2 + layer;
lineTypes =path1 + format + path2 + lines;

// export using shared coordinate?
true;
// preserve coincident lines
true;
# ----------------------------------------
createAcadOption = Orchid.RevitProject.Common.ExportOption.CreateAcadOption(name=code_block.out0, layerMapping=code_block.layerMapping)
acadOptionSettings = Orchid.RevitProject.Common.ExportOption.AcadOptionSettings(option=createAcadOption, linetypesFile=code_block.lineTypes)
acad_version = ACADVersion("R2018")
acadOptionGenerel = Orchid.RevitProject.Common.ExportOption.AcadOptionGenerel(option=acadOptionSettings, fileVersion=acad_version)  # frozen

# group: Get view by name in model
code_block_2 = CodeBlock { "ViewType"; "FloorPlan"; }
enumByName = Orchid.AdeskApp.Revit.EnumByName(enumType=code_block_2.out0, valueName=code_block_2.out1)
byViewType = Orchid.RevitProject.Views.View.ByViewType(viewType=enumByName)
name = Element.Name(element=byViewType)
code_block_3 = CodeBlock()
# ---------- code_block_3.designscript (2 lines) ----------
// View to find
"Level 2 (window)";
# ----------------------------------------
boolean_2 = BoolSelector(true)
contains = Orchid.Common.String.Contains(string=name, searchFor=code_block_3, ignoreCase=boolean_2)
filterByBoolMask = List.FilterByBoolMask(list=byViewType, mask=contains)

# group: DWG
boolean_3 = BoolSelector(true)
exportDWG = Orchid.RevitProject.Common.Document.ExportDWG(document=current, option=acadOptionSettings, view=filterByBoolMask.in, file=path, overwrite=boolean_3)

# group: Delete "BIPS 2005" export settings
acadOptions = Orchid.RevitProject.Common.ExportOption.AcadOptions()  # frozen
code_block_4 = CodeBlock(option=acadOptions) { name = Revit.Element.Name(option); name == "BIPS 2005"; }
filterByBoolMask_2 = List.FilterByBoolMask(list=acadOptions, mask=code_block_4.out1)
delete = Orchid.RevitProject.Elements.Element.Delete(element=filterByBoolMask_2.in)

# group: Create DGN export setting
code_block_5 = CodeBlock { "DGNexport"; }
createDGNOption = Orchid.RevitProject.Common.ExportOption.CreateDGNOption(name=code_block_5)
dgn_file_format = DGNFileFormat("DGNVersion8")
createDGNOption_2 = Orchid.RevitProject.Common.ExportOption.CreateDGNOption(name=code_block_5, fileVersion=dgn_file_format)  # frozen

# group: DGN
boolean_4 = BoolSelector(true)
exportDGN = Orchid.RevitProject.Common.Document.ExportDGN(option=createDGNOption, view=filterByBoolMask.in, file=path, overwrite=boolean_4)

# group: DWF
createDWFOption = Orchid.RevitProject.Common.ExportOption.CreateDWFOption()
boolean_5 = BoolSelector(true)
exportDWF = Orchid.RevitProject.Common.Document.ExportDWF(option=createDWFOption, view=filterByBoolMask.in, file=path, overwrite=boolean_5)
createDWFxOption = Orchid.RevitProject.Common.ExportOption.CreateDWFxOption()

# group: DXF
code_block_6 = CodeBlock { "DFXexport"; }
createAcadOption_2 = Orchid.RevitProject.Common.ExportOption.CreateAcadOption(name=code_block_6)
boolean_6 = BoolSelector(true)
exportDXF = Orchid.RevitProject.Common.Document.ExportDXF(option=createAcadOption_2, view=filterByBoolMask.in, file=path, overwrite=boolean_6)

# group: DGN Options
DGNOptions = Orchid.RevitProject.Common.ExportOption.DGNOptions()  # frozen
watch = Watch(DGNOptions)
code_block_7 = CodeBlock { "DGNexport"; }
await_ = Orchid.Common.DataStream.Await(pass=code_block_7, waitFor0=DGNOptions)
DGNByName = Orchid.RevitProject.Common.ExportOption.DGNByName(name=await_)
name_2 = Element.Name(element=DGNOptions)
watch_2 = Watch(name_2)

# group: DWG Options
acadOptions_2 = Orchid.RevitProject.Common.ExportOption.AcadOptions()  # frozen
watch_3 = Watch(acadOptions_2)
code_block_8 = CodeBlock { "IBB 2000"; }
await_2 = Orchid.Common.DataStream.Await(pass=code_block_8, waitFor0=acadOptions_2)
acadByName = Orchid.RevitProject.Common.ExportOption.AcadByName(name=await_2)
name_3 = Element.Name(element=acadOptions_2)
watch_4 = Watch(name_3)
