# Dynamo graph ExportSchedules.dyn (Dynamo 2.19.3.6394)
# packages: Orchid 2.19.3.6432

# group: Path
# File: defaultProject
current = Orchid.RevitProject.Common.Document.Current()
path = Orchid.RevitProject.Common.Document.Path(document=current)
directoryName = FileSystem.DirectoryName(path=path)
string = StringInput("\Schedule")  # graph input
code_block = CodeBlock(a=directoryName, b=string) { a+b; }

# group: Schedules
code_block_2 = CodeBlock { "Room Schedule"; }
byName = Orchid.RevitProject.Views.View.ByName(name=code_block_2)
current_2 = Orchid.Common.Global.Culture.Current()
data = Orchid.RevitProject.Schedules.Schedule.Data(scheduleView=byName, culture=current_2)

# group: Export to Excel
code_block_3 = CodeBlock { 0; }
exportToExcel = Data.ExportToExcel(filePath=code_block, sheetName=code_block_2, startRow=code_block_3, startColumn=code_block_3, data=data)
