# Dynamo graph ExportSchedules_MultiSheet.dyn (Dynamo 3.6.1.9895)
# packages: Orchid 3.6.0.6947

# group: Path
# File: defaultProject
current = Orchid.RevitProject.Common.Document.Current()
boolean = BoolSelector(false)
directory = Orchid.RevitProject.Common.Document.Directory(document=current, workshared=boolean)
name = Orchid.RevitProject.Common.Document.Name(document=current)
code_block = CodeBlock(a=directory, b=name)
# ---------- code_block.designscript (6 lines) ----------
// Filename and path
file = a + "\\" + b;
// Excel file
file + ".xlsx";
// OpenDocument file
file + ".ods";
# ----------------------------------------

# group: Schedules
inDocument = Orchid.RevitProject.Schedules.Schedule.InDocument()
name_2 = Element.Name(element=inDocument)
data = Orchid.RevitProject.Schedules.Schedule.Data(scheduleView=inDocument)

# group: Export handling
boolean_2 = BoolSelector(true)
exportExcelSheets = Orchid.Applications.Office365.ExportExcelSheets(filePath=code_block.out1, sheetNames=name_2, data=data, overWrite=boolean_2)
exportSpreadsheets = Orchid.Applications.OpenDocument.ExportSpreadsheets(filePath=code_block.out2, sheetNames=name_2, data=data, overWrite=boolean_2)

# group: Truncate mechanism
code_block_2 = CodeBlock { " - "; "–"; 33; }  # frozen
replace = Orchid.Common.String.Replace(searchFor=code_block_2.out0, replaceWith=code_block_2.out1)  # unwired: string
truncate = Orchid.Common.String.Truncate(string=replace, length=code_block_2.out2)
