# Dynamo graph ExportDWGfromView.dyn "ExportDWGfromView_R23" (Dynamo 2.16.2.5624)
# packages: Orchid 2.16.4.6193

# group: Path
current = Orchid.RevitProject.Common.Document.Current()
boolean = BoolSelector(false)
path = Orchid.RevitProject.Common.Document.Path(document=current, withExtension=boolean)

# group: Set "IBB 2000" export settings
# File: any DTU building file
code_block = CodeBlock()
# ---------- code_block.designscript (18 lines) ----------
"IBB 2000";

// merge files into one?
true;

// filepaths
path1 = "C:\\ProgramData\\Autodesk\\RVT ";
path2 = "\\Libraries\\DanEDU\\Generic Project\\";
layer = "DanEDU Exportlayers.txt";
lines = "DanEDU Linetypes.lin";
format =  Orchid.AdeskApp.Revit.Format;
layerMapping = path1 + format + path2 + layer;
lineTypes =path1 + format + path2 + lines;

// export using shared coordinate?
true;
// preserve coincident lines
true;
# ----------------------------------------
createAcadOption = Orchid.RevitProject.Common.ExportOption.CreateAcadOption(name=code_block.out0, layerMapping=code_block.layerMapping)
acadOptionSettings = Orchid.RevitProject.Common.ExportOption.AcadOptionSettings(option=createAcadOption, linetypesFile=code_block.lineTypes)
acadOptionGenerel = Orchid.RevitProject.Common.ExportOption.AcadOptionGenerel(option=acadOptionSettings)  # frozen

# group: Get view by name in model
code_block_2 = CodeBlock { "ViewType"; "FloorPlan"; }
enumByName = Orchid.AdeskApp.Revit.EnumByName(enumType=code_block_2.out0, valueName=code_block_2.out1)
byViewType = Orchid.RevitProject.Views.View.ByViewType(viewType=enumByName)
name = Element.Name(element=byViewType)
code_block_3 = CodeBlock()
# ---------- code_block_3.designscript (2 lines) ----------
// View to find
"DTUexport";
# ----------------------------------------
boolean_2 = BoolSelector(true)
contains = Orchid.Common.String.Contains(string=name, searchFor=code_block_3, ignoreCase=boolean_2)
filterByBoolMask = List.FilterByBoolMask(list=byViewType, mask=contains)

# group: DWG
boolean_3 = BoolSelector(true)
exportDWG = Orchid.RevitProject.Common.Document.ExportDWG(document=current, option=acadOptionSettings, view=filterByBoolMask.in, file=path, overwrite=boolean_3)

# group: Delete "BIPS 2005" export settings
acadOptions = Orchid.RevitProject.Common.ExportOption.AcadOptions()  # frozen
code_block_4 = CodeBlock(option=acadOptions) { name = Revit.Element.Name(option); name == "BIPS 2005"; }
filterByBoolMask_2 = List.FilterByBoolMask(list=acadOptions, mask=code_block_4.out1)
delete = Orchid.RevitProject.Elements.Element.Delete(element=filterByBoolMask_2.in)

watch = Watch(filterByBoolMask.in)
