# Dynamo graph FillPattern.dyn (Dynamo 2.19.3.6394)
# packages: Orchid 2.19.5.6567

# group: OOTB FillPatternElement
fill_patterns = FillPatterns("Crosshatch")
code_block = CodeBlock { "Crosshatch"; }
fill_pattern_targets = FillPatternTargets("Drafting")
getByName = FillPatternElement.GetByName(name=code_block, fillPatternTarget=fill_pattern_targets)
watch = Watch(getByName)

# group: FillPatternElement
# File: defaultProject
code_block_2 = CodeBlock { "TestPattern"; 15; 3; }
fill_pattern_target = FillPatternTarget("Drafting")
fill_pattern_orientation = FillPatternOrientation("ToView")
create = Orchid.Revit.Geometry.FillPatternElement.Create(name=code_block_2.out0, target=fill_pattern_target, orientation=fill_pattern_orientation, angle=code_block_2.out1, spacing1=code_block_2.out2, spacing2=code_block_2.out2)
watch_2 = Watch(create)
name = Element.Name(element=create)
watch_3 = Watch(name)

# group: OOTB FilledRegion
code_block_3 = CodeBlock { "Vertical"; }
byName = FilledRegionType.ByName(name=code_block_3)
select_filled_region_type = FilledRegionTypes("Vertical")
color = FilledRegionType.Color(filledRegionType=select_filled_region_type)
fillPatternId = FilledRegionType.FillPatternId(filledRegionType=select_filled_region_type)
name_2 = FilledRegionType.Name(filledRegionType=select_filled_region_type)

# group: FillPatternElement
inDocument = Orchid.Revit.Geometry.FillPatternElement.InDocument()
watch_4 = Watch(inDocument.FillPattern)
watch_5 = Watch(inDocument.Target)
drafting_fill_patterns = DraftingFillPattern("<Solid fill>")
model_fill_patterns = ModelFillPattern("100mm Horizontal")

# group: FilledRegionType
code_block_4 = CodeBlock { "Level 1 (door)"; }
byName_2 = Orchid.RevitProject.Views.View.ByName(name=code_block_4)
code_block_5 = CodeBlock { "Vertical"; "FilledRegionType"; }
classByName = Orchid.AdeskApps.Revit.ClassByName(name=code_block_5.out1)
byName_3 = Orchid.RevitProject.Elements.ElementType.ByName(name=code_block_5.out0, class=classByName)
inDocument_2 = Orchid.Revit.Geometry.FilledRegionType.InDocument()
watch_6 = Watch(inDocument_2)

# group: Create a box
code_block_6 = CodeBlock { [0,0,-1000,-1000]; [0,-1000,-1000,0]; }
byCoordinates = Point.ByCoordinates(x=code_block_6.out0, y=code_block_6.out1)
boolean = BoolSelector(true)
byPoints = PolyCurve.ByPoints(points=byCoordinates, connectLastToFirst=boolean)
explode = Geometry.Explode(geometry=byPoints)

# group: OOTB FilledRegion
byCurves = FilledRegion.ByCurves(view=byName_2, boundary=explode, regionType=byName_3)

# group: FilledRegion
# note: Rememeber this node must be frozen
# until the filled region has been created.
boundary = Orchid.Revit.Geometry.FilledRegion.Boundary(filledRegion=byCurves)  # frozen
watch_7 = Watch(boundary)
inDocument_3 = Orchid.Revit.Geometry.FilledRegion.InDocument()
watch_8 = Watch(inDocument_3)

# group: FillPatternElement
code_block_7 = CodeBlock { "Crosshatch"; }
byName_4 = Orchid.Revit.Geometry.FillPatternElement.ByName(name=code_block_7)
angle = Orchid.Revit.Geometry.FillPatternElement.Angle(fillPattern=byName_4)
watch_9 = Watch(angle)
lineSpacing = Orchid.Revit.Geometry.FillPatternElement.LineSpacing(fillPattern=byName_4)
watch_10 = Watch(lineSpacing.LineSpacing1)
watch_11 = Watch(lineSpacing.LineSpacing2)
