# Dynamo graph NestedGeometryHandling.dyn (Dynamo 2.19.3.6394)
# packages: Orchid 2.19.5.6567

# group: Collect
# File: DefaultProject, remember to add beam!
code_block = CodeBlock { "Casework"; "Structural Framing"; }
byName = Category.ByName(name=code_block.out0)
byCategory = Orchid.RevitProject.Elements.Element.ByCategory(category=byName)
byName_2 = Category.ByName(name=code_block.out1)
byCategory_2 = Orchid.RevitProject.Elements.Element.ByCategory(category=byName_2)

# group: Get nested components, find solid, verify intersection(s)
nestedComponent = Orchid.RevitProject.Elements.FamilyInstance.NestedComponent(familyInstance=byCategory)
dynamoSolid = Orchid.RevitProject.Elements.Element.DynamoSolid(element=nestedComponent.FamilyInstance)
location = Orchid.RevitProject.Elements.Element.Location(element=byCategory)
move = Orchid.Revit.Geometry.DynamoSolid.Move(dynamoSolid=dynamoSolid, point=location)
doesIntersect = Orchid.Revit.Geometry.DynamoSolid.DoesIntersect(dynamoSolid=move, elements=byCategory_2)
revitSolid = Orchid.RevitProject.Elements.Element.RevitSolid(element=nestedComponent.FamilyInstance)
move_2 = Orchid.Revit.Geometry.RevitSolid.Move(revitSolid=revitSolid, point=location)
doesIntersect_2 = Orchid.Revit.Geometry.RevitSolid.DoesIntersect(revitSolid=move_2, elements=byCategory_2)

# group: Close open (nested family) document
await_ = Orchid.Common.DataStream.Await(pass=nestedComponent.FamilyDocument, waitFor0=doesIntersect, waitFor1=doesIntersect_2)
close = Orchid.RevitProject.Common.Document.Close(document=await_)  # frozen

watch = Watch(nestedComponent.FamilyInstance)
watch_2 = Watch(doesIntersect_2)
watch_3 = Watch(doesIntersect)
