# Dynamo graph LinkedCloudDocument.dyn (Dynamo 2.16.2.5624)
# packages: Orchid 2.19.3.6432

# group: Get Revit Linked document
revitLink = Orchid.RevitProject.Common.Link.RevitLink()
info = Orchid.RevitProject.Common.Link.Info(link=revitLink)
list_create = List.Create(item0=info.Name, item1=info.Status, item2=info.ReferenceType, item3=info.Path, item4=info.PathType)
watch = Watch(list_create)

# group: Get Link
# File: Linked360Project
indocument = Orchid.RevitProject.Common.Link.Indocument()
watch_2 = Watch(indocument.Type)
watch_3 = Watch(indocument.Link)

# group: Get Link by type
link_types = LinkType("Revit Link")
linkByType = Orchid.RevitProject.Common.Link.LinkByType(linkType=link_types)
watch_4 = Watch(linkByType)
code_block = CodeBlock { "RevitLink"; }
