# Dynamo graph SingleFileWithoutWorksharing.dyn "Worksharing" (Dynamo 2.19.3.6394)
# packages: Orchid 2.19.3.6432

# group: Create a "single" file by copying the central file, incl. removing worksets
# File: defaultProject or any other file
string = StringInput("%OrchidSamples%\Data\2024_Data\")  # graph input
fromPath = Orchid.Common.Directory.FromPath(path=string)
string_2 = StringInput("worksharing_CENTRAL")  # graph input
string_3 = StringInput("worksharing_SINGLE")  # graph input
code_block = CodeBlock(a=fromPath, b=string_2, c=string_3)
# ---------- code_block.designscript (5 lines) ----------
// central file
a+b+".rvt";

// local file
a+c+".rvt";
# ----------------------------------------
fromPath_2 = Orchid.Common.File.FromPath(path=code_block.out0)
boolean = BoolSelector(true)  # graph input
boolean_2 = BoolSelector(true)  # graph input
boolean_3 = BoolSelector(false)  # graph input
backgroundOpen = Orchid.RevitProject.Common.Document.BackgroundOpen(file=fromPath_2, detachFromCentral=boolean, discardWorksets=boolean_2, audit=boolean_3)
boolean_4 = BoolSelector(false)  # graph input
saveAs = Orchid.RevitProject.Common.Document.SaveAs(document=backgroundOpen, name=code_block.out1, overwrite=boolean_4)
close = Orchid.RevitProject.Common.Document.Close(document=saveAs)
