# Dynamo graph LinkedCloudDocumentRepath.dyn (Dynamo 2.16.2.5624)
# packages: Orchid 216.3.0.5794

# group: Get Revit Linked document
# File: Linked360Project
revitLink = Orchid.RevitProject.Common.Link.RevitLink()
info = Orchid.RevitProject.Common.Link.Info(link=revitLink)
list_create = List.Create(item0=info.Name, item1=info.Status, item2=info.ReferenceType, item3=info.Path, item4=info.PathType)
watch = Watch(list_create)

# group: Repath Cloud link to local path
cloudToLocal = Orchid.Common.File.CloudToLocal(path=info.Path)
watch_2 = Watch(cloudToLocal)
repath = Orchid.RevitProject.Common.Link.Repath(link=revitLink, file=cloudToLocal)
cloudToLocal_2 = Orchid.Common.Directory.CloudToLocal(path=info.Path)
watch_3 = Watch(cloudToLocal_2)
