# Dynamo graph MoveToOrigin.dyn (Dynamo 2.19.3.6394)
# packages: Orchid 2.19.3.6432

# group: Adjust sectionsbox
code_block = CodeBlock { "ViewType"; "ThreeD"; }  # frozen
enumByName = Orchid.AdeskApp.Revit.EnumByName(enumType=code_block.out0, valueName=code_block.out1)
byViewType = Orchid.RevitProject.Views.View.ByViewType(document=enumByName)
watch = Watch(byViewType)

# group: new origin -> as vector
select_model_element = DSModelElementSelection()  # 1 picked in the model; graph input
getLocation = Element.GetLocation(element=select_model_element)
reverse = Orchid.Geometry.Point.Reverse(point=getLocation)

# group: Write coordinate to txt file and copy coordinate to clipboard
current = Orchid.RevitProject.Common.Document.Current()
boolean = BoolSelector(false)
path = Orchid.RevitProject.Common.Document.Path(document=current, withExtension=boolean)
code_block_2 = CodeBlock(file=path) { file+".txt"; }
string_from_object = FromObject(obj=reverse)
writeText = FileSystem.WriteText(filePath=code_block_2, text=string_from_object)
copyTo = Orchid.Common.Clipboard.CopyTo(object=reverse)

# group: Adjust sectionsbox
threeD = Orchid.RevitProject.Views.View.ThreeD()
moveSectionBox = Orchid.RevitProject.Views.View.MoveSectionBox(view3D=threeD, point=reverse)
await_ = Orchid.Common.DataStream.Await(pass=reverse, waitFors=moveSectionBox)

# group: Adjust view crop box
model = Orchid.RevitProject.Views.View.Model()
move = Orchid.RevitProject.Views.View.Move(view=model, point=await_)

# group: Select elements
code_block_3 = CodeBlock()
# ---------- code_block_3.designscript (4 lines) ----------
// Revit enumeration
"CategoryType";
// Category type elements
"Model";
# ----------------------------------------
enumByName_2 = Orchid.AdeskApp.Revit.EnumByName(enumType=code_block_3.out0, valueName=code_block_3.out1)
byCategoryType = Orchid.RevitProject.Elements.Element.ByCategoryType(categoryType=enumByName_2)
string_from_object_2 = FromObject(obj=byCategoryType.Category)
code_block_4 = CodeBlock()
# ---------- code_block_4.designscript (2 lines) ----------
// Filter for Curtain elements
"Curtain";
# ----------------------------------------
contains = String.Contains(string=string_from_object_2, searchFor=code_block_4)
filterByBoolMask = List.FilterByBoolMask(list=byCategoryType.Element, mask=contains)
stackedWalls = Orchid.RevitProject.Elements.Wall.StackedWalls()
inDocument = Orchid.RevitProject.Elements.Sweep.InDocument()
code_block_5 = CodeBlock { "MultistoryStairs"; }
byName = Orchid.RevitProject.Elements.Class.ByName(name=code_block_5)
all_elements_of_class = ElementsOfType(element_type=byName)
separationLines = Orchid.RevitProject.Elements.SpatialElement.SeparationLines()
flatten = List.Flatten(list=separationLines.Element)
join = List.Join(list0=filterByBoolMask.out, list1=stackedWalls, list2=inDocument, list3=all_elements_of_class, list4=flatten)

# group: Select special elements
inDocument_2 = Orchid.RevitProject.Datums.SketchPlane.InDocument()
inDocument_3 = Orchid.RevitProject.Datums.ReferencePlane.InDocument()
inDocument_4 = Orchid.RevitProject.Datums.Level.InDocument()
inDocument_5 = Orchid.RevitProject.Datums.Grid.InDocument()
model_2 = Orchid.RevitProject.Elements.Group.Model()
join_2 = List.Join(list0=inDocument_2, list1=inDocument_3, list2=inDocument_4, list3=inDocument_5, list4=model_2)

# group: Select elements
code_block_6 = CodeBlock()
# ---------- code_block_6.designscript (4 lines) ----------
// Revit enumeration
"CategoryType";
// Category type elements
"Annotation";
# ----------------------------------------
enumByName_3 = Orchid.AdeskApp.Revit.EnumByName(enumType=code_block_6.out0, valueName=code_block_6.out1)
byCategoryType_2 = Orchid.RevitProject.Elements.Element.ByCategoryType(categoryType=enumByName_3)
code_block_7 = CodeBlock(category=byCategoryType_2.Category)
# ---------- code_block_7.designscript (3 lines) ----------
category.Name == "Section Boxes" ||
category.Name == "Revision Clouds"
? true : false;
# ----------------------------------------
filterByBoolMask_2 = List.FilterByBoolMask(list=byCategoryType_2.Element, mask=code_block_7)

# group: Select additional elements that not can be grouped
detail = Orchid.RevitProject.Elements.Group.Detail()
ownerViewType = Orchid.RevitProject.Elements.Element.OwnerViewType(element=detail)
code_block_8 = CodeBlock(t=ownerViewType) { t != "Detail"? true : false; }
filterByBoolMask_3 = List.FilterByBoolMask(list=detail, mask=code_block_8)

# group: Collect linked instances
cadLink = Orchid.RevitProject.Common.Link.CadLink()
revitLink = Orchid.RevitProject.Common.Link.RevitLink()
list_create = List.Create(item0=cadLink, item1=revitLink)
instance = Orchid.RevitProject.Common.Link.Instance(link=list_create)

# group: join lists and unpin element
# File: newOrigin
join_3 = List.Join(list0=join, list1=join_2, list2=filterByBoolMask_2.out, list3=filterByBoolMask_3.in, list4=instance)
flatten_2 = List.Flatten(list=join_3)
clean = Orchid.Common.List.Clean(list=flatten_2)
isPinned = Orchid.RevitProject.Elements.Element.IsPinned(element=clean)
filterByBoolMask_4 = List.FilterByBoolMask(list=clean, mask=isPinned)
unPin = Orchid.RevitProject.Elements.Element.UnPin(element=filterByBoolMask_4.in)
await_2 = Orchid.Common.DataStream.Await(pass=clean, waitFors=unPin)
move_2 = Orchid.RevitProject.Elements.Element.Move(element=await_2, point=await_)

# group: re-pin elements
await_3 = Orchid.Common.DataStream.Await(pass=unPin, waitFors=move_2)
pin = Orchid.RevitProject.Elements.Element.Pin(element=await_3)

# group: Revisions -> delete or add
# note: If revisions is deleted, then remember to
# remove they are added to the "move" list
deleteAll = Orchid.RevitProject.Common.Revision.DeleteAll()  # frozen
inDocument_6 = Orchid.RevitProject.Common.RevisionCloud.InDocument()  # frozen
deleteAll_2 = Orchid.RevitProject.Common.RevisionCloud.DeleteAll()  # frozen

# group: Move SurveyPoint
surveyPoint = Orchid.RevitProject.Common.Document.SurveyPoint()  # frozen
move_3 = Orchid.RevitProject.Elements.Element.Move(element=surveyPoint, point=await_)
