# Dynamo graph RotateByOrigin.dyn (Dynamo 2.19.3.6394)
# packages: Orchid 2.19.3.6432

# group: Collect elements
code_block = CodeBlock()
# ---------- code_block.designscript (4 lines) ----------
// Revit enumeration
"CategoryType";
// Category type elements
"Model";
# ----------------------------------------
enumByName = Orchid.AdeskApp.Revit.EnumByName(enumType=code_block.out0, valueName=code_block.out1)
byCategoryType = Orchid.RevitProject.Elements.Element.ByCategoryType(categoryType=enumByName)
string_from_object = FromObject(obj=byCategoryType.Category)
code_block_2 = CodeBlock()
# ---------- code_block_2.designscript (2 lines) ----------
// Filter for Curtain elements
"Curtain";
# ----------------------------------------
contains = String.Contains(string=string_from_object, searchFor=code_block_2)
filterByBoolMask = List.FilterByBoolMask(list=byCategoryType.Element, mask=contains)
stackedWalls = Orchid.RevitProject.Elements.Wall.StackedWalls()
inDocument = Orchid.RevitProject.Elements.Sweep.InDocument()
separationLines = Orchid.RevitProject.Elements.SpatialElement.SeparationLines()
flatten = List.Flatten(list=separationLines.Element)
join = List.Join(list0=filterByBoolMask.out, list1=stackedWalls, list2=inDocument, list3=flatten)

# group: Collect special elements
code_block_3 = CodeBlock { "MultistoryStairs"; }
byName = Orchid.RevitProject.Elements.Class.ByName(name=code_block_3)
all_elements_of_type = ElementsOfType(element_type=byName)
inDocument_2 = Orchid.RevitProject.Datums.ReferencePlane.InDocument()
inDocument_3 = Orchid.RevitProject.Datums.Level.InDocument()
inDocument_4 = Orchid.RevitProject.Datums.Grid.InDocument()
model = Orchid.RevitProject.Elements.Group.Model()
join_2 = List.Join(list0=all_elements_of_type, list1=inDocument_2, list2=inDocument_3, list3=inDocument_4, list4=model)

# group: Collect elements
code_block_4 = CodeBlock()
# ---------- code_block_4.designscript (4 lines) ----------
// Revit enumeration
"CategoryType";
// Category type elements
"Annotation";
# ----------------------------------------
enumByName_2 = Orchid.AdeskApp.Revit.EnumByName(enumType=code_block_4.out0, valueName=code_block_4.out1)
byCategoryType_2 = Orchid.RevitProject.Elements.Element.ByCategoryType(categoryType=enumByName_2)
code_block_5 = CodeBlock(category=byCategoryType_2.Category)
# ---------- code_block_5.designscript (3 lines) ----------
category.Name == "Section Boxes" ||
category.Name == "Revision Clouds"
? true : false;
# ----------------------------------------
filterByBoolMask_2 = List.FilterByBoolMask(list=byCategoryType_2.Element, mask=code_block_5)

# group: Collect additional elements that not can be grouped
detail = Orchid.RevitProject.Elements.Group.Detail()
ownerViewType = Orchid.RevitProject.Elements.Element.OwnerViewType(element=detail)
code_block_6 = CodeBlock(t=ownerViewType) { t != "Detail"? true : false; }
filterByBoolMask_3 = List.FilterByBoolMask(list=detail, mask=code_block_6)

# group: Collect linked instances
cadLink = Orchid.RevitProject.Common.Link.CadLink()
revitLink = Orchid.RevitProject.Common.Link.RevitLink()
list_create = List.Create(item0=cadLink, item1=revitLink)
instance = Orchid.RevitProject.Common.Link.Instance(link=list_create)

# group: Project Origin
code_block_7 = CodeBlock { Autodesk.Point.ByCoordinates(0, 0, 0); -90; }

# group: join lists and unpin element
# File: defaultProject
join_3 = List.Join(list0=join, list1=join_2, list2=filterByBoolMask_2.out, list3=filterByBoolMask_3.in, list4=instance)
flatten_2 = List.Flatten(list=join_3)
clean = Orchid.Common.List.Clean(list=flatten_2)
isPinned = Orchid.RevitProject.Elements.Element.IsPinned(element=clean)
filterByBoolMask_4 = List.FilterByBoolMask(list=clean, mask=isPinned)
unPin = Orchid.RevitProject.Elements.Element.UnPin(element=filterByBoolMask_4.in)
isCopyMonitored = Orchid.RevitProject.Elements.Element.IsCopyMonitored(element=clean)
filterByBoolMask_5 = List.FilterByBoolMask(list=clean, mask=isCopyMonitored)
await_ = Orchid.Common.DataStream.Await(pass=filterByBoolMask_5.out, waitFors=unPin)
rotate = Orchid.RevitProject.Elements.Element.Rotate(element=await_, point=code_block_7.out0, angle=code_block_7.out1)

# group: re-pin elements
await_2 = Orchid.Common.DataStream.Await(pass=unPin, waitFors=rotate)
pin = Orchid.RevitProject.Elements.Element.Pin(element=await_2)

# group: Adjust view crop box
model_2 = Orchid.RevitProject.Views.View.Model()
rotate_2 = Orchid.RevitProject.Views.View.Rotate(view=model_2, point=code_block_7.out0, angle=code_block_7.out1)

# group: Adjust sectionsbox
threeD = Orchid.RevitProject.Views.View.ThreeD()
rotateSectionBox = Orchid.RevitProject.Views.View.RotateSectionBox(view3D=threeD, point=code_block_7.out0, angle=code_block_7.out1)
