# Dynamo graph EditFromProject_FamilyParameter.dyn (Dynamo 3.7.0.11777)
# packages: Orchid 2.19.3.6432

# group: Open all files in directory and sub directories
string = StringInput("%OrchidSamples%\Data\testSet")  # graph input
code_block = CodeBlock { "*.rfa"; true; }
contents = Orchid.Common.Directory.Contents(directory=string, searchString=code_block.out0)  # frozen
backgroundOpen = Orchid.RevitProject.Common.Document.BackgroundOpen(file=contents)

# group: Collect family as document from current document
# File: defaultProject
code_block_2 = CodeBlock { ["Doors","Windows"]; }
byName = Category.ByName(name=code_block_2)
byCategory = Orchid.RevitProject.Elements.Element.ByCategory(category=byName)
elementType = Element.ElementType(element=byCategory.Element)
uniqueItems = List.UniqueItems(list=elementType, lacing=Longest)
flatten = List.Flatten(list=uniqueItems)
family = FamilyType.Family(familyType=flatten)
uniqueItems_2 = List.UniqueItems(list=family)
edit = Orchid.RevitProject.Elements.Family.Edit(family=uniqueItems_2)

code_block_3 = CodeBlock()
# ---------- code_block_3.designscript (10 lines) ----------
//Parameter name
"Creator Build";
//SP Parameter group
"Sheet and Project";
//GroupType
"AdskModelProperties";
//Instances
true;
//Reporting
false;
# ----------------------------------------
byName_2 = Orchid.AdeskApps.Units.GroupType.ByName(name=code_block_3.out2)
add = Orchid.RevitFamily.SharedParameter.Add(familyDocument=edit, parameterName=code_block_3.out0, groupName=code_block_3.out1, groupType=byName_2, instance=code_block_3.out3)

# group: Close files
await_ = Orchid.Common.DataStream.Await(pass=backgroundOpen, waitFors=add)
boolean = BoolSelector(true)  # graph input
close = Orchid.RevitProject.Common.Document.Close(document=await_, save=boolean)  # frozen

# group: load back into the current project
await_2 = Orchid.Common.DataStream.Await(pass=edit, waitFors=add)
load = Orchid.RevitProject.Elements.Family.Load(familyDocument=await_2)
await_3 = Orchid.Common.DataStream.Await(pass=await_2, waitFors=load)
close_2 = Orchid.RevitProject.Common.Document.Close(document=await_3)
