# Dynamo graph LoadFamilies_SetParameter.dyn (Dynamo 3.7.0.11777)
# packages: Orchid 2.19.3.6432

# group: 
# File: defaultProject
directory_path = StringInput("%OrchidSamples%\Data\testSet")  # graph input
string = StringInput("*.rfa")  # graph input
boolean = BoolSelector(true)  # graph input
contents = Orchid.Common.Directory.Contents(directory=directory_path, searchString=string, deepSearch=boolean)
backgroundOpen = Orchid.RevitProject.Common.Document.BackgroundOpen(file=contents)

code_block = CodeBlock()
# ---------- code_block.designscript (8 lines) ----------
//Parameter name
"Creator Build";
//SP Parameter group
"Sheet and Project";
//GroupType
"AdskModelProperties";
//Instances
true;
# ----------------------------------------
byName = Orchid.AdeskApps.Units.GroupType.ByName(name=code_block.out2)
add = Orchid.RevitFamily.SharedParameter.Add(familyDocument=backgroundOpen, parameterName=code_block.out0, groupName=code_block.out1, groupType=byName, instance=code_block.out3)
await_ = Orchid.Common.DataStream.Await(pass=backgroundOpen, waitFors=add)
code_block_2 = CodeBlock { "Creator Build"; }
creator_build = StringInput("\"2023.0405.0\"")  # graph input
input = Orchid.RevitFamily.Formula.Input(familyDocument=await_, parameterName=code_block_2, value=creator_build)
await_2 = Orchid.Common.DataStream.Await(pass=await_, waitFors=input)
load = Orchid.RevitProject.Elements.Family.Load(familyDocument=await_2)
await_3 = Orchid.Common.DataStream.Await(pass=await_2, waitFors=load)
close = Orchid.RevitProject.Common.Document.Close(document=await_3)
