# Dynamo graph ParameterFilter.dyn (Dynamo 2.19.3.6394)
# packages: Orchid 2.19.3.6432

# group: Orchid -> Filter rule for (element) parameters
code_block = CodeBlock { "test2"; }
code_block_2 = CodeBlock { "Windows"; }
byName = Category.ByName(name=code_block_2)
all_elements_of_category = ElementsOfCategory(Category=byName)
firstItem = List.FirstItem(list=all_elements_of_category)
elementType = Element.ElementType(element=firstItem)
code_block_3 = CodeBlock { "Width"; 2000; }
byName_2 = Orchid.RevitProject.Parameters.Parameter.ByName(element=elementType, parameterName=code_block_3.out0)
code_block_4 = CodeBlock { "RuleType"; "Greater"; }
enumByName = Orchid.AdeskApps.Dynamo.EnumByName(enumType=code_block_4.out0, valueName=code_block_4.out1)
create = Orchid.RevitProject.Filters.FilterRule.Create(parameterName=byName_2, ruleType=enumByName, value=code_block_3.out1)
code_block_5 = CodeBlock { ["Doors","Windows"]; }
byName_3 = Category.ByName(name=code_block_5)
create_2 = Orchid.RevitProject.Filters.ParameterFilter.Create(name=code_block, filterRule=create, category=byName_3)

# group: Add filter to view, and set visibility
views = Views("{3D}")  # graph input
boolean = BoolSelector(false)  # graph input
addFilter = Orchid.RevitProject.Views.View.AddFilter(view=views, parameterFilter=create_2, enable=boolean)
filters = View.Filters(view=addFilter)

# group: Filter rule for user-defined parameters (project, shared, and global parameters)
# File: defaultProject_param
code_block_6 = CodeBlock { "test1"; }
code_block_7 = CodeBlock()
# ---------- code_block_7.designscript (13 lines) ----------
// Parameter name
"TestStringParameter";
"TestIntegerParameter";
"TestDoubleParameter";

// Rule Type
"RuleType";
"Equals";

// values
"Something";
500;
500.0;
# ----------------------------------------
create_3 = Orchid.RevitProject.Filters.FilterRule.Create(parameterName=code_block_7.out0, value=code_block_7.out5)
byName_4 = Orchid.RevitProject.Parameters.ProjectParameter.ByName(parameterName=code_block_7.out2)
enumByName_2 = Orchid.AdeskApps.Dynamo.EnumByName(enumType=code_block_7.out3, valueName=code_block_7.out4)
create_4 = Orchid.RevitProject.Filters.FilterRule.Create(parameterName=byName_4, ruleType=enumByName_2, value=code_block_7.out7)
create_5 = List.Create(item0=create_3, item1=create_4)
code_block_8 = CodeBlock { ["Doors","Windows"]; }
byName_5 = Category.ByName(name=code_block_8)
boolean_2 = BoolSelector(false)  # graph input
create_6 = Orchid.RevitProject.Filters.ParameterFilter.Create(name=code_block_6, filterRule=create_5, category=byName_5, andOr=boolean_2)
id = Element.Id(element=byName_4)
watch = Watch(id)
name = Element.Name(element=byName_4)
watch_2 = Watch(name)

# group: OOTB -> Filter rule for (element) parameters. Notice the need to convert between SI and Imperial units!
code_block_9 = CodeBlock { "test3"; }
code_block_10 = CodeBlock { ["Windows","Doors"]; }
byName_6 = Category.ByName(name=code_block_10)
code_block_11 = CodeBlock { "Greater"; "Width"; 1000; }
convert_by_units = DynamoUnitConvert(code_block_11.out2, MeasurementType="autodesk.unit.quantity:length-1.0.4", FromConversion="autodesk.unit.unit:millimeters-1.0.1", ToConversion="autodesk.unit.unit:feet-1.0.1")
code_block_12 = CodeBlock { "Windows"; }
byName_7 = Category.ByName(name=code_block_12)
all_elements_of_category_2 = ElementsOfCategory(Category=byName_7)
firstItem_2 = List.FirstItem(list=all_elements_of_category_2)
elementType_2 = Element.ElementType(element=firstItem_2)
parameterByName = Parameter.ParameterByName(element=elementType_2, name=code_block_11.out1)
byRuleType = Revit.Filter.FilterRule.ByRuleType(type=code_block_11.out0, value=convert_by_units, parameter=parameterByName)
byRules = Revit.Filter.ParameterFilterElement.ByRules(name=code_block_9, categories=byName_6, rules=byRuleType)

# group: Get FilterRule and convert so it can be sat as an AND filter
rule = Orchid.RevitProject.Filters.ParameterFilter.Rule(parameterFilter=byRules)
code_block_13 = CodeBlock { "test4"; }
boolean_3 = BoolSelector(true)  # graph input
create_7 = Orchid.RevitProject.Filters.ParameterFilter.Create(name=code_block_13, filterRule=rule, category=byName_3, andOr=boolean_3)

# group: Add filter rule set
ruleTree = Orchid.RevitProject.Filters.ParameterFilter.RuleTree(parameterFilter=create_6)
addRule = Orchid.RevitProject.Filters.ParameterFilter.AddRule(parameterFilter=create_6, ruleTree=ruleTree, filterRule=create)
ruleTree_2 = Orchid.RevitProject.Filters.ParameterFilter.RuleTree(parameterFilter=addRule)
boolean_4 = BoolSelector(false)  # graph input
addRule_2 = Orchid.RevitProject.Filters.ParameterFilter.AddRule(parameterFilter=addRule, ruleTree=ruleTree_2, filterRule=rule, andOr=boolean_4)
ruleTree_3 = Orchid.RevitProject.Filters.ParameterFilter.RuleTree(parameterFilter=addRule_2)
code_block_14 = CodeBlock { [3]; [3,2]; }
boolean_5 = BoolSelector(false)  # graph input
addRule_3 = Orchid.RevitProject.Filters.ParameterFilter.AddRule(parameterFilter=addRule_2, ruleTree=ruleTree_3, atIndex=code_block_14.out0, filterRule=create, andOr=boolean_5)
ruleTree_4 = Orchid.RevitProject.Filters.ParameterFilter.RuleTree(parameterFilter=addRule_3)
watch_3 = Watch(ruleTree_4)
watch_4 = Watch(ruleTree_3)
watch_5 = Watch(ruleTree_2)
watch_6 = Watch(ruleTree)

parameter_filters = ParameterFilter("Architectural")  # graph input
watch_7 = Watch(parameter_filters)
inDocument = Orchid.RevitProject.Filters.ParameterFilter.InDocument()
watch_8 = Watch(inDocument)
await_ = Orchid.Common.DataStream.Await(pass=code_block_6, waitFors=create_6)
byName_8 = Orchid.RevitProject.Filters.ParameterFilter.ByName(name=await_)
watch_9 = Watch(byName_8)

# group: Ruletype
code_block_15 = CodeBlock()
# ---------- code_block_15.designscript (13 lines) ----------
// Dynamo RuleTypes
"BeginsWith";
"Contains";
"EndsWith";
"Equals";
"Greater";
"Less";
"GreaterOrEqual";
"LessOrEqual";
"NotBeginsWith";
"NotContains";
"NotEndsWith";
"NotEquals";
# ----------------------------------------
select_rule_type = RuleTypes("Greater")  # graph input

# group: Converter
toRevitType = Orchid.Common.Object.ToRevitType(object=byName_8)
toDynamoType = Orchid.Common.Object.ToDynamoType(object=toRevitType)
watch_10 = Watch(toDynamoType)
watch_11 = Watch(toRevitType)

# group: Remove/Replace filter rule
code_block_16 = CodeBlock { [3]; [3,2]; }
replaceRule = Orchid.RevitProject.Filters.ParameterFilter.ReplaceRule(parameterFilter=addRule_3, ruleTree=ruleTree_4, atIndex=code_block_16.out0, filterRule=byRuleType)
ruleTree_5 = Orchid.RevitProject.Filters.ParameterFilter.RuleTree(parameterFilter=replaceRule)
code_block_17 = CodeBlock { 2; }
removeRule = Orchid.RevitProject.Filters.ParameterFilter.RemoveRule(parameterFilter=replaceRule, ruleTree=ruleTree_5, atIndex=code_block_17)
ruleTree_6 = Orchid.RevitProject.Filters.ParameterFilter.RuleTree(parameterFilter=removeRule)
watch_12 = Watch(ruleTree_6)
watch_13 = Watch(ruleTree_5)

ruleTree_7 = Orchid.RevitProject.Filters.ParameterFilter.RuleTree(parameterFilter=byRules)
watch_14 = Watch(ruleTree_7)
ruleTree_8 = Orchid.RevitProject.Filters.ParameterFilter.RuleTree(parameterFilter=create_7)
watch_15 = Watch(ruleTree_8)

# group: Clear rules
clearRules = Orchid.RevitProject.Filters.ParameterFilter.ClearRules(parameterFilter=create_7)  # frozen

# group: Get Filter Rule from Ruletree
code_block_18 = CodeBlock(ruleTree=ruleTree_4) { ruleTree[0]; ruleTree[3][0]; ruleTree[3][1]; }
rule_2 = Orchid.RevitProject.Filters.ElementFilter.Rule(elementFilter=code_block_18.out0)
watch_16 = Watch(rule_2)
watch_17 = Watch(code_block_18.out2)
