# Dynamo graph ParameterSet.dyn (Dynamo 2.19.3.6394)
# packages: Orchid 2.19.5.6567

# group: Add shared parameter
code_block = CodeBlock()
# ---------- code_block.designscript (14 lines) ----------
//Parameter name
["Creator Name",
"Creator Organization",
"Creator Build"];
//SP Parameter group
"Sheet & Project";
//GroupType
"AdskModelProperties";
//Instances
true;
//Vary Between Groups
true;
//Category
"Doors";
# ----------------------------------------
byName = Orchid.AdeskApps.Units.GroupType.ByName(string=code_block.out2)
byName_2 = Category.ByName(name=code_block.out5)
add = Orchid.RevitProject.Parameters.SharedParameter.Add(parameterName=code_block.out0, groupName=code_block.out1, groupType=byName, category=byName_2)

# group: Create shared parameter
# File: defaultProject
code_block_2 = CodeBlock()
# ---------- code_block_2.designscript (16 lines) ----------
//Parameter name
"Dynamo test parameter";
//SP Parameter group
"Dynamo test group";
//SpecType
"Text";
//GroupType
"AdskModelProperties";
//Tooltip
"Some tooltip";
//Instances
true;
//Vary Between Groups
true;
//Category
"Doors";
# ----------------------------------------
byName_3 = Orchid.AdeskApps.Units.SpecType.ByName(string=code_block_2.out2)
byName_4 = Orchid.AdeskApps.Units.GroupType.ByName(string=code_block_2.out3)
byName_5 = Category.ByName(name=code_block_2.out7)
create = Orchid.RevitProject.Parameters.SharedParameter.Create(parameterName=code_block_2.out0, groupName=code_block_2.out1, specType=byName_3, groupType=byName_4, tooltip=code_block_2.out4, category=byName_5)

# group: Change parameter and category binding in the project
code_block_3 = CodeBlock()
# ---------- code_block_3.designscript (15 lines) ----------
// Parameter name
// Revit can't be changed! Only
// shared parameters can be changed!

// test, shared parameter;
"Creator Name";
// test, created from Dynamo;
"Dynamo test parameter";
// test, created inside Revit;
"ChangeCategory";

//Instances
true;
//Category
["Doors", "Entourage", "Floors"];
# ----------------------------------------
byName_6 = Orchid.RevitProject.Parameters.ProjectParameter.ByName(parameterName=code_block_3.out0)
byName_7 = Category.ByName(name=code_block_3.out4)
changeCategory = Orchid.RevitProject.Parameters.ProjectParameter.ChangeCategory(parameterElement=byName_6, category=byName_7)  # frozen
changeCategory_2 = Orchid.RevitProject.Parameters.ProjectParameter.ChangeCategory(parameterName=code_block_3.out0, category=byName_7)

# group: Delete parameter
code_block_4 = CodeBlock()
# ---------- code_block_4.designscript (2 lines) ----------
["Creator Build",
"Dynamo test parameter"];
# ----------------------------------------
byName_8 = Orchid.RevitProject.Parameters.ProjectParameter.ByName(parameterName=code_block_4)
delete = Orchid.RevitProject.Elements.Element.Delete(element=byName_8)  # frozen
