# Dynamo graph SharedParameter.dyn (Dynamo 2.19.3.6394)
# packages: Orchid 2.19.3.6432

# group: Add shared parameters by groupName (current loaded)
# File: defaultProject
code_block = CodeBlock()
# ---------- code_block.designscript (14 lines) ----------
//SP Parameter group
["Energy","Dimensions"];
//GroupType
["EnergyAnalysis", "Geometry"];
//Instance
[true,false];
//Vary pr group
//NOTE: this list must follow the order
//of true values in the "Instance" list.
//This list does not have to have same
//length as the above three lists!
[true,true];
//Categories
["Doors", "Windows", "Floors", "Walls"];
# ----------------------------------------
byName = Orchid.AdeskApp.GroupType.ByName(string=code_block.out1)
byName_2 = Category.ByName(name=code_block.out4)
addByGroup = Orchid.RevitProject.Parameters.SharedParameter.AddByGroup(groupName=code_block.out0, groupType=byName, instance=code_block.out2, vary=code_block.out3, category=byName_2)
name = Element.Name(element=addByGroup.ParameterElement)
watch = Watch(name)
watch_2 = Watch(addByGroup.Guid)

# group: Set the shared parameter file
string = StringInput("%OrchidSamples%\Data\Shared Parameters.txt")  # graph input
fromPath = Orchid.Common.File.FromPath(path=string)
code_block_2 = CodeBlock(data=fromPath) { data; }
setFile = Orchid.RevitProject.Parameters.SharedParameter.SetFile(file=code_block_2)
watch_3 = Watch(setFile)
string_2 = StringInput("..\COBie Extension Shared Parameters.txt")  # graph input
string_3 = StringInput("%OrchidSamples%\Data\COBie Extension Shared Parameters.txt")  # graph input
fromPath_2 = Orchid.Common.File.FromPath(path=string_3)

# group: Get shared parameters by file
byFile = Orchid.RevitProject.Parameters.SharedParameter.ByFile(file=setFile)
watch_4 = Watch(byFile.ParameterName)
watch_5 = Watch(byFile.ParameterType)
watch_6 = Watch(byFile.Definition)
watch_7 = Watch(byFile.Guid)
watch_8 = Watch(byFile.GroupName)

# group: Get shared parameter file
file = Orchid.RevitProject.Parameters.SharedParameter.File()
watch_9 = Watch(file)

# group: Group by type and group name
groupByTypeAndGroupName = Orchid.RevitProject.Parameters.SharedParameter.GroupByTypeAndGroupName(file=setFile)
watch_10 = Watch(groupByTypeAndGroupName.ParameterName)
watch_11 = Watch(groupByTypeAndGroupName.Definition)
watch_12 = Watch(groupByTypeAndGroupName.ParameterType)
watch_13 = Watch(groupByTypeAndGroupName.GroupName)
watch_14 = Watch(groupByTypeAndGroupName.Guid)

# group: Group by group name and type
groupByGroupNameAndType = Orchid.RevitProject.Parameters.SharedParameter.GroupByGroupNameAndType(file=setFile)
watch_15 = Watch(groupByGroupNameAndType.ParameterName)
watch_16 = Watch(groupByGroupNameAndType.GroupName)
watch_17 = Watch(groupByGroupNameAndType.ParameterType)
watch_18 = Watch(groupByGroupNameAndType.Definition)
watch_19 = Watch(groupByGroupNameAndType.Guid)

# group: Add shared parameters by groupName by provided file
string_4 = StringInput("%OrchidSamples%\Data\COBie Extension Shared Parameters.txt")  # graph input
fromPath_3 = Orchid.Common.File.FromPath(path=string_4)
code_block_3 = CodeBlock()
# ---------- code_block_3.designscript (15 lines) ----------
//SP Parameter group
["Floor", "Type"];
//GroupType
["AdskModelProperties",
"AdskModelProperties"];
//Instance
[true,false];
//Vary pr group
//NOTE: this list must follow the order
//of true values in the "Instance" list.
//This list does not have to have same
//length as the above three lists!
[true,true];
//Categories
["Doors", "Windows", "Floors", "Walls"];
# ----------------------------------------
byName_3 = Orchid.AdeskApp.GroupType.ByName(string=code_block_3.out1)
byName_4 = Category.ByName(name=code_block_3.out4)
addByFile = Orchid.RevitProject.Parameters.SharedParameter.AddByFile(file=fromPath_3, groupName=code_block_3.out0, groupType=byName_3, instance=code_block_3.out2, vary=code_block_3.out3, category=byName_4)
name_2 = Element.Name(element=addByFile.ParameterElement)
watch_20 = Watch(name_2)
watch_21 = Watch(addByFile.Guid)
