# Dynamo graph TypeParameterValueToInstanceParameter.dyn (Dynamo 3.7.0.11777)
# packages: Orchid 3.3.1.6591

# group: Get elements by category
# File: defaultProject_param
code_block = CodeBlock { "Windows"; }
byName = Category.ByName(name=code_block)
byCategory = Orchid.RevitProject.Elements.ElementType.ByCategory(category=byName)

# group: Transfer type parameter value to instance parameter
code_block_2 = CodeBlock { "Width"; "Width_Instance"; }
byName_2 = Orchid.RevitProject.Parameters.Parameter.ByName(element=byCategory, parameterName=code_block_2.out0)
element = Orchid.RevitProject.Parameters.Parameter.Element(parameter=byName_2)
element_2 = Orchid.RevitProject.Elements.ElementType.Element(elementType=element)
value = Orchid.RevitProject.Parameters.Parameter.Value(parameter=byName_2)
addValue = Orchid.RevitProject.Parameters.Parameter.AddValue(element=element_2, parameterName=code_block_2.out1, value=value)

watch = Watch(addValue)

# group: Testing
value_2 = Orchid.RevitProject.Parameters.Parameter.Value(element=addValue, parameterName=code_block_2.out1)
watch_2 = Watch(value_2)
