# Dynamo graph ParameterAttachedCategories.dyn (Dynamo 2.16.2.5624)
# packages: Orchid 216.3.0.5794

# group: 
# File: defaultProject
code_block = CodeBlock { "Occupant"; "IfcExportAs[Type]"; }
byName = Orchid.RevitProject.Parameters.ProjectParameter.ByName(parameterName=code_block.out1)
category = Orchid.RevitProject.Parameters.ProjectParameter.Category(parameter=byName)
watch = Watch(category)
byName_2 = Orchid.RevitProject.Parameters.Definition.ByName(name=code_block.out1)
category_2 = Orchid.RevitProject.Parameters.Definition.Category(definition=byName_2)
watch_2 = Watch(category_2)
category_3 = Orchid.RevitProject.Parameters.ProjectParameter.Category(parameterName=code_block.out1)
watch_3 = Watch(category_3)
