# Dynamo graph PurgeProjectDocument.dyn (Dynamo 2.19.3.6394)
# packages: Orchid 2.19.3.6432

# group: Imported dwg files etc.
purge = Orchid.RevitProject.Common.Imports.Purge()
code_block = CodeBlock { "ImportInstance"; }  # frozen
byName = Orchid.RevitProject.Elements.Class.ByName(name=code_block)
ofClass = Orchid.RevitProject.Elements.Element.OfClass(class=byName)
delete = Orchid.RevitProject.Elements.Element.Delete(element=ofClass)

# group: Imported lines from dwg files etc.
deleteImported = Orchid.RevitProject.Categories.Category.DeleteImported()
code_block_2 = CodeBlock { "Imports in Families"; }  # frozen
byName_2 = Category.ByName(name=code_block_2)
byCategory = Orchid.RevitProject.Categories.SubCategory.ByCategory(category=byName_2)
delete_2 = Orchid.RevitProject.Categories.SubCategory.Delete(category=byName_2, subCategory=byCategory)
imported = Orchid.RevitProject.Categories.Category.Imported()  # frozen
delete_3 = Orchid.RevitProject.Elements.Element.Delete(element=imported)

# group: Document purge
boolean = BoolSelector(true)  # graph input
purge_2 = Orchid.RevitProject.Common.Document.Purge(completely=boolean)

# group: 
# All is included in Document.Purge
purge_3 = Orchid.RevitProject.Views.ViewTemplate.Purge()  # frozen
purge_4 = Orchid.Geometry.LineStyle.Purge()  # frozen
purge_5 = Orchid.Geometry.LinePattern.Purge()  # frozen
purge_6 = Orchid.RevitProject.Filters.ParameterFilter.Purge()  # frozen
purge_7 = Orchid.RevitProject.Parameters.Parameter.Purge()  # frozen
purge_8 = Orchid.RevitProject.Parameters.ProjectParameter.Purge()  # frozen
purge_9 = Orchid.RevitProject.Parameters.SharedParameter.Purge()  # frozen

# group: 
# All is included in Document.Purge
purge_10 = Orchid.RevitMaterial.Material.Purge()  # frozen
purge_11 = Orchid.RevitMaterial.Visual.Asset.Purge()  # frozen

# group: Sheet
boolean_2 = BoolSelector(true)
purge_12 = Orchid.RevitProject.Views.Sheet.Purge(placeholder=boolean_2)

# group: PostCommand
boolean_3 = BoolSelector(false)  # graph input
purge_13 = Orchid.RevitProject.Common.PostCommand.Purge(activate=boolean_3)  # frozen

# group: Delete Revisions
deleteAll = Orchid.RevitProject.Common.Revision.DeleteAll()
deleteAll_2 = Orchid.RevitProject.Common.RevisionCloud.DeleteAll()

# group: Delete non placed rooms
inDocument = Orchid.RevitProject.Elements.SpatialElement.InDocument()
status = Orchid.RevitProject.Elements.SpatialElement.Status(spatialElement=inDocument)
code_block_3 = CodeBlock(value=status) { value =="placed" ? true : false; }
filterByBoolMask = List.FilterByBoolMask(list=inDocument, mask=code_block_3)
delete_4 = Orchid.RevitProject.Elements.Element.Delete(element=filterByBoolMask.out)

# group: Delete elements of Category
code_block_4 = CodeBlock { ["Windows","Walls"]; }
byName_3 = Category.ByName(name=code_block_4)
purge_14 = Orchid.RevitProject.Categories.Category.Purge(category=byName_3)  # frozen
