# Dynamo graph SheetViews.dyn (Dynamo 2.16.2.5624)
# packages: Orchid 216.3.0.5794

# group: 
# File: defaultProject
inDocument = Orchid.RevitProject.Views.Sheet.InDocument()
content = Orchid.RevitProject.Views.Sheet.Content(sheet=inDocument)
flatten = List.Flatten(list=content)

watch = Watch(content)
onSheet = Orchid.RevitProject.Schedules.Schedule.OnSheet(schedule=inDocument)
watch_2 = Watch(onSheet)
onSheet_2 = Orchid.RevitProject.Views.View.OnSheet(view=inDocument)
watch_3 = Watch(onSheet_2)
watch_4 = Watch(flatten)
flatten_2 = List.Flatten(list=onSheet)
watch_5 = Watch(flatten_2)
flatten_3 = List.Flatten(list=onSheet_2)
watch_6 = Watch(flatten_3)
