# Dynamo graph SpatialTag.dyn "Tagging" (Dynamo 2.19.3.6394)
# packages: Orchid 2.19.3.6432

# group: Room tagging by location
model_views = ModelView("Level 1 (room)")  # graph input
categories = Categories("OST_Rooms")  # graph input
all_elements_of_category = ElementsOfCategory(Category=categories)
code_block = CodeBlock { "Room Tag"; "Text Only"; }
byFamilyNameAndTypeName = FamilyType.ByFamilyNameAndTypeName(familyName=code_block.out0, typeName=code_block.out1)
getLocation = Element.GetLocation(element=all_elements_of_category)
code_block_2 = CodeBlock { true; }
bySpatialElementAndLocation = Orchid.RevitProject.Annotations.Tag.BySpatialElementAndLocation(view=model_views, spatialElement=all_elements_of_category, tagType=byFamilyNameAndTypeName, location=getLocation, addLeader=code_block_2, allowMultiple=code_block_2)

watch = Watch(bySpatialElementAndLocation)

# group: Room tagging
# File: defaultProject
model_views_2 = ModelView("Level 1 (room)")  # graph input
categories_2 = Categories("OST_Rooms")  # graph input
all_elements_of_category_2 = ElementsOfCategory(Category=categories_2)
code_block_3 = CodeBlock { "Room Tag"; "Text Only"; }
byFamilyNameAndTypeName_2 = FamilyType.ByFamilyNameAndTypeName(familyName=code_block_3.out0, typeName=code_block_3.out1)
bySpatialElement = Orchid.RevitProject.Annotations.Tag.BySpatialElement(view=model_views_2, spatialElement=all_elements_of_category_2, tagType=byFamilyNameAndTypeName_2)  # frozen

watch_2 = Watch(bySpatialElement)

# group: Element tagging
model_views_3 = ModelView("Level 1 (room)")  # graph input
categories_3 = Categories("OST_Doors")  # graph input
all_elements_of_category_3 = ElementsOfCategory(Category=categories_3)
code_block_4 = CodeBlock { "Door Tag"; "Hinging"; }
byFamilyNameAndTypeName_3 = FamilyType.ByFamilyNameAndTypeName(familyName=code_block_4.out0, typeName=code_block_4.out1)
byElement = Orchid.RevitProject.Annotations.Tag.ByElement(view=model_views_3, element=all_elements_of_category_3, tagType=byFamilyNameAndTypeName_3)

watch_3 = Watch(byElement)

# group: Element tagging by location
model_views_4 = ModelView("Level 1 (room)")  # graph input
categories_4 = Categories("OST_Doors")  # graph input
all_elements_of_category_4 = ElementsOfCategory(Category=categories_4)
code_block_5 = CodeBlock { "Door Tag"; "Hinging"; }
byFamilyNameAndTypeName_4 = FamilyType.ByFamilyNameAndTypeName(familyName=code_block_5.out0, typeName=code_block_5.out1)
getLocation_2 = Element.GetLocation(element=all_elements_of_category_4)
code_block_6 = CodeBlock { true; }
byElementAndLocation = Orchid.RevitProject.Annotations.Tag.ByElementAndLocation(view=model_views_4, element=all_elements_of_category_4, tagType=byFamilyNameAndTypeName_4, location=getLocation_2, addLeader=code_block_6, allowMultiple=code_block_6)  # frozen

watch_4 = Watch(byElementAndLocation)

# group: Space tagging
model_views_5 = ModelView("Level 1 (hvac)")  # graph input
categories_5 = Categories("OST_MEPSpaces")  # graph input
all_elements_of_category_5 = ElementsOfCategory(Category=categories_5)
code_block_7 = CodeBlock { "Space Tag"; "Text and Area"; }
byFamilyNameAndTypeName_5 = FamilyType.ByFamilyNameAndTypeName(familyName=code_block_7.out0, typeName=code_block_7.out1)
bySpatialElement_2 = Orchid.RevitProject.Annotations.Tag.BySpatialElement(view=model_views_5, spatialElement=all_elements_of_category_5, tagType=byFamilyNameAndTypeName_5)  # frozen

watch_5 = Watch(bySpatialElement_2)

# group: Space tagging by location
model_views_6 = ModelView("Level 1 (hvac)")  # graph input
categories_6 = Categories("OST_MEPSpaces")  # graph input
all_elements_of_category_6 = ElementsOfCategory(Category=categories_6)
code_block_8 = CodeBlock { "Space Tag"; "Text and Area"; }
byFamilyNameAndTypeName_6 = FamilyType.ByFamilyNameAndTypeName(familyName=code_block_8.out0, typeName=code_block_8.out1)
getLocation_3 = Element.GetLocation(element=all_elements_of_category_6)
code_block_9 = CodeBlock { true; }
bySpatialElementAndLocation_2 = Orchid.RevitProject.Annotations.Tag.BySpatialElementAndLocation(view=model_views_6, spatialElement=all_elements_of_category_6, tagType=byFamilyNameAndTypeName_6, location=getLocation_3, addLeader=code_block_9, allowMultiple=code_block_9)

watch_6 = Watch(bySpatialElementAndLocation_2)

# group: Area tagging
model_views_7 = ModelView("Level 1 (area)")  # graph input
categories_7 = Categories("OST_Areas")  # graph input
all_elements_of_category_7 = ElementsOfCategory(Category=categories_7)
code_block_10 = CodeBlock { "Area Tag"; "Text Only"; }
byFamilyNameAndTypeName_7 = FamilyType.ByFamilyNameAndTypeName(familyName=code_block_10.out0, typeName=code_block_10.out1)
bySpatialElement_3 = Orchid.RevitProject.Annotations.Tag.BySpatialElement(view=model_views_7, spatialElement=all_elements_of_category_7, tagType=byFamilyNameAndTypeName_7)

watch_7 = Watch(bySpatialElement_3)

# group: Area tagging by location
model_views_8 = ModelView("Level 1 (area)")  # graph input
categories_8 = Categories("OST_Areas")  # graph input
all_elements_of_category_8 = ElementsOfCategory(Category=categories_8)
code_block_11 = CodeBlock { "Area Tag"; "Text Only"; }
byFamilyNameAndTypeName_8 = FamilyType.ByFamilyNameAndTypeName(familyName=code_block_11.out0, typeName=code_block_11.out1)
getLocation_4 = Element.GetLocation(element=all_elements_of_category_8)
code_block_12 = CodeBlock { true; }
bySpatialElementAndLocation_3 = Orchid.RevitProject.Annotations.Tag.BySpatialElementAndLocation(view=model_views_8, spatialElement=all_elements_of_category_8, tagType=byFamilyNameAndTypeName_8, location=getLocation_4, addLeader=code_block_12, allowMultiple=code_block_12)  # frozen

watch_8 = Watch(bySpatialElementAndLocation_3)
