# Dynamo graph DefaultTemplateTypes.dyn (Dynamo 2.19.3.6394)
# packages: Orchid 2.19.3.6432

# group: Purge ViewTemplate
current = Document.Current()  # frozen
purge = Orchid.RevitProject.Views.ViewTemplate.Purge(document=current)
await_ = Orchid.Common.DataStream.Await(waitFors=purge)  # unwired: pass

# group: Rename existing ViewTemplate
inDocument = Orchid.RevitProject.Views.ViewTemplate.InDocument()
name = Element.Name(element=inDocument.ViewTemplate)
code_block = CodeBlock(name=name) { "_dummy_" + name; }
setName = Orchid.RevitProject.Elements.Element.SetName(element=inDocument.ViewTemplate, name=code_block)

# group: Rename existing ViewFamilyType and Attribute
inDocument_2 = Orchid.RevitProject.Common.Attribute.InDocument()
code_block_2 = CodeBlock(name=inDocument_2.FamilyName) { !DSCore.String.Contains(name,"Tag"); }
filterByBoolMask = List.FilterByBoolMask(list=inDocument_2.ElementType, mask=code_block_2)
inDocument_3 = Orchid.RevitProject.Views.ViewFamilyType.InDocument()
string_from_object = FromObject(object=inDocument_3.Enum)
code_block_3 = CodeBlock()
# ---------- code_block_3.designscript (7 lines) ----------
["Sheet",
"Schedule",
"Report",
"Legend",
"Image",
"Three",
"Walk"];
# ----------------------------------------
contains = Orchid.Common.String.Contains(string=string_from_object, searchFor=code_block_3)
filterByBoolMask_2 = List.FilterByBoolMask(list=inDocument_3.ViewFamilyType, mask=contains)
join = List.Join(list0=filterByBoolMask.in, list1=filterByBoolMask_2.out)
name_2 = Element.Name(element=join)
code_block_4 = CodeBlock(name=name_2) { "_dummy_" + name; }
setName_2 = Orchid.RevitProject.Elements.Element.SetName(element=join, name=code_block_4)
await_2 = Orchid.Common.DataStream.Await(pass=setName, waitFors=setName_2)

# group: Get default template
code_block_5 = CodeBlock()
# ---------- code_block_5.designscript (4 lines) ----------
path1 = "C:\\ProgramData\\Autodesk\\RVT ";
path2 = "\\Templates\\DanEDU\\DanEDU Template.rte";
format =  Orchid.AdeskApp.Revit.Format;
path1 + format + path2;
# ----------------------------------------
backgroundOpen = Orchid.RevitProject.Common.Document.BackgroundOpen(file=code_block_5.out3)
await_3 = Orchid.Common.DataStream.Await(pass=backgroundOpen, waitFors=await_2)

# group: Transfer default ViewTemplate
inDocument_4 = Orchid.RevitProject.Views.ViewTemplate.InDocument(document=await_3)
copyElement = Orchid.RevitProject.Common.Document.CopyElement(source=await_3, element=inDocument_4.ViewTemplate)
await_4 = Orchid.Common.DataStream.Await(pass=await_3, waitFors=copyElement)

# group: Transfer default ViewFamilyType
inDocument_5 = Orchid.RevitProject.Views.ViewFamilyType.InDocument(document=await_4)
string_from_object_2 = FromObject(object=inDocument_5.Enum)
contains_2 = Orchid.Common.String.Contains(string=string_from_object_2, searchFor=code_block_3)
filterByBoolMask_3 = List.FilterByBoolMask(list=inDocument_5.ViewFamilyType, mask=contains_2)
code_block_6 = CodeBlock { true; }
transferByElementType = Orchid.RevitProject.Common.Document.TransferByElementType(source=await_4, elementType=filterByBoolMask_3.out, append=code_block_6)
await_5 = Orchid.Common.DataStream.Await(pass=await_4, waitFors=transferByElementType)

# group: Viewtemplate attached to a Viewtype
code_block_7 = CodeBlock { "View Template applied to new views"; }
byName = Orchid.RevitProject.Parameters.Parameter.ByName(element=transferByElementType, parameterName=code_block_7)
# note: If null value is return, no temlate is attached!
byName_2 = Orchid.RevitProject.Parameters.Parameter.ByName(element=filterByBoolMask_3.out, parameterName=code_block_7)
value = Orchid.RevitProject.Parameters.Parameter.Value(parameter=byName_2)
name_3 = Element.Name(element=value)
byName_3 = Orchid.RevitProject.Views.ViewTemplate.ByName(name=name_3)
setValue = Orchid.RevitProject.Parameters.Parameter.SetValue(parameter=byName, value=byName_3)

# group: Transfer default Attribute
inDocument_6 = Orchid.RevitProject.Common.Attribute.InDocument(document=await_5)
code_block_8 = CodeBlock(name=inDocument_6.FamilyName) { !DSCore.String.Contains(name,"Tag"); }
filterByBoolMask_4 = List.FilterByBoolMask(list=inDocument_6.ElementType, mask=code_block_8)
code_block_9 = CodeBlock { true; }
transferByElementType_2 = Orchid.RevitProject.Common.Document.TransferByElementType(source=await_5, elementType=filterByBoolMask_4.in, append=code_block_9)

# group: Close default Template
await_6 = Orchid.Common.DataStream.Await(pass=await_5, waitFors=setValue)
await_7 = Orchid.Common.DataStream.Await(pass=await_6, waitFors=transferByElementType_2)
close = Orchid.RevitProject.Common.Document.Close(document=await_7)
