# Dynamo graph Open View.dyn (Dynamo 2.16.2.5624)
# packages: Orchid 2.19.3.6432

# group: 
# File: defaultProject
views = Views("{3D}")  # graph input
openView = Orchid.RevitProject.Common.Document.OpenView(view=views)
watch = Watch(openView)
