# Dynamo graph RoomViewsCreate.dyn (Dynamo 2.19.3.6394)
# packages: Orchid 2.19.4.6485

# group: Find room by number
inDocument = Orchid.RevitProject.Elements.SpatialElement.InDocument()
number = Orchid.RevitProject.Elements.SpatialElement.Number(spatialElement=inDocument)
code_block = CodeBlock()
# ---------- code_block.designscript (5 lines) ----------
// Room
["1","3"];
// Rotate
0;
15;
# ----------------------------------------
code_block_2 = CodeBlock(value=number, number=code_block.out0) { value<1L> == number<1L>; }
filterByBoolMask = List.FilterByBoolMask(list=inDocument, mask=code_block_2)

# group: Create elevation mark by room
string = StringInput("Elevation")
byName = Orchid.RevitProject.Views.ViewFamilyType.ByName(name=string)
location = Orchid.RevitProject.Elements.SpatialElement.Location(spatialElement=filterByBoolMask.in)
create = Orchid.RevitProject.Views.ElevationMarker.Create(viewFamilyType=byName.ViewFamilyType, location=location, lacing=Longest)
flatten = List.Flatten(list=create)

# group: Floor plan
code_block_3 = CodeBlock()
# ---------- code_block_3.designscript (2 lines) ----------
// View
"Level 1 (door)";
# ----------------------------------------
view_type = ViewType("FloorPlan")
byNameAndViewType = Orchid.RevitProject.Views.View.ByNameAndViewType(name=code_block_3, viewType=view_type)
flatten_2 = List.Flatten(list=byNameAndViewType)

# group: Create floor plan by room boundingbox
name = Element.Name(element=flatten_2)
code_block_4 = CodeBlock(str=name, number=code_block.out0)
# ---------- code_block_4.designscript (2 lines) ----------
// Planview
str+"_R"+ number<1L>;
# ----------------------------------------
duplicate = Orchid.RevitProject.Views.View.Duplicate(view=flatten_2, name=code_block_4, lacing=Longest)
scopeBox = Orchid.RevitProject.Views.View.ScopeBox(view=duplicate)
code_block_5 = CodeBlock(room=filterByBoolMask.in, location=location, rotate=code_block.out1)
# ---------- code_block_5.designscript (4 lines) ----------
// Room
room;
location;
rotate;
# ----------------------------------------
rotateCropBox = Orchid.RevitProject.Views.View.RotateCropBox(view=scopeBox, point=code_block_5.location, angle=code_block_5.rotate)
boundingBox = Element.BoundingBox(element=code_block_5.room)
setCropBox = Orchid.RevitProject.Views.View.SetCropBox(view=rotateCropBox, boundingBox=boundingBox)
flatten_3 = List.Flatten(list=setCropBox)

# group: Create elevation views by view and elevation mark
# Elevation must be set visible in the plan view graphical setting!
code_block_6 = CodeBlock()
# ---------- code_block_6.designscript (2 lines) ----------
// Index
[1,3];
# ----------------------------------------
code_block_7 = CodeBlock { "Elevations"; }
byName_2 = Category.ByName(name=code_block_7)
unhideCategory = Orchid.RevitProject.Views.View.UnhideCategory(view=flatten_3, category=byName_2)
createElevation = Orchid.RevitProject.Views.ElevationMarker.CreateElevation(elevationMarker=flatten, planView=unhideCategory, rotation=code_block.out1)

# group: Set elevation view name
name_2 = Element.Name(element=createElevation)
code_block_8 = CodeBlock(str=name_2, number=code_block.out0)
# ---------- code_block_8.designscript (2 lines) ----------
// Planview
str+"_R"+ number;
# ----------------------------------------
setName = Orchid.RevitProject.Elements.Element.SetName(element=createElevation, name=code_block_8)

# group: Set view template
# Remember you also might want to controll floor and ceiling plan template!
string_2 = StringInput("Architectural Room")  # frozen
byName_3 = Orchid.RevitProject.Views.ViewTemplate.ByName(name=string_2)
set = Orchid.RevitProject.Views.ViewTemplate.Set(view=setName, viewTemplate=byName_3)

# group: Ceiling plan
code_block_9 = CodeBlock()
# ---------- code_block_9.designscript (2 lines) ----------
// View
"Level 1";
# ----------------------------------------
view_type_2 = ViewType("CeilingPlan")
byNameAndViewType_2 = Orchid.RevitProject.Views.View.ByNameAndViewType(name=code_block_9, viewType=view_type_2)
flatten_4 = List.Flatten(list=byNameAndViewType_2)

# group: Create ceiling plan by room boundingbox
name_3 = Element.Name(element=flatten_4)
code_block_10 = CodeBlock(str=name_3, number=code_block.out0)  # same code as code_block_4
duplicate_2 = Orchid.RevitProject.Views.View.Duplicate(view=flatten_4, name=code_block_10, lacing=Longest)
scopeBox_2 = Orchid.RevitProject.Views.View.ScopeBox(view=duplicate_2)
code_block_11 = CodeBlock(room=filterByBoolMask.in, location=location, rotate=code_block.out1)  # same code as code_block_5
rotateCropBox_2 = Orchid.RevitProject.Views.View.RotateCropBox(view=scopeBox_2, point=code_block_11.location, angle=code_block_11.rotate)
boundingBox_2 = Element.BoundingBox(element=code_block_11.room)
setCropBox_2 = Orchid.RevitProject.Views.View.SetCropBox(view=rotateCropBox_2, boundingBox=boundingBox_2)
flatten_5 = List.Flatten(list=setCropBox_2)

# group: Visibility graphic
boolean = BoolSelector(false)
join = List.Join(list0=flatten_3, list1=flatten_5, list2=createElevation)
boolean_2 = BoolSelector(true)
# note: If view is handled by using viewtemplate, then freeze this node
visibilityGraphic = Orchid.RevitProject.Views.View.VisibilityGraphic(view=join, annotationCategories=boolean_2, analyticalCategories=boolean_2, importCategories=boolean_2, coordinationModel=boolean_2, pointCloud=boolean_2)
boolean_3 = BoolSelector(true)
setCropBoxVisible = View.SetCropBoxVisible(view=join, isVisible=boolean_3)
setCropBoxActive = View.SetCropBoxActive(view=join, isActive=boolean_3)
