# Dynamo graph RoomViewsToSheet.dyn (Dynamo 2.19.3.6394)
# packages: Orchid 2.19.4.6485

# group: Find room by number
inDocument = Orchid.RevitProject.Elements.SpatialElement.InDocument()
number = Orchid.RevitProject.Elements.SpatialElement.Number(spatialElement=inDocument)
code_block = CodeBlock()
# ---------- code_block.designscript (3 lines) ----------
// Room
["1","3"];
["R1","R3"];
# ----------------------------------------
code_block_2 = CodeBlock(value=number, number=code_block.out0) { value<1L> == number<1L>; }
filterByBoolMask = List.FilterByBoolMask(list=inDocument, mask=code_block_2)

# group: Create sheet
code_block_3 = CodeBlock()
# ---------- code_block_3.designscript (5 lines) ----------
// Sheet Family
"Sheet din824 Titleblock";

// Sheet Family Type
"30x42";
# ----------------------------------------
byFamilyNameAndTypeName = FamilyType.ByFamilyNameAndTypeName(familyName=code_block_3.out0, typeName=code_block_3.out1)
count = List.Count(list=filterByBoolMask.in)
cycle = List.Cycle(list=byFamilyNameAndTypeName, amount=count)
create = Orchid.RevitProject.Views.Sheet.Create(familyType=cycle)

# group: Sheet name and number
code_block_4 = CodeBlock()
# ---------- code_block_4.designscript (5 lines) ----------
// Sheet name
"Rum {0}, opstalter";

// Sheet number
"A.70{0}";
# ----------------------------------------
number_2 = Orchid.RevitProject.Elements.SpatialElement.Number(spatialElement=filterByBoolMask.in)
format = Orchid.Common.String.Format(string=code_block_4.out0, item0=number_2@L1)
setSheetName = Sheet.SetSheetName(sheet=create, sheetName=format)
format_2 = Orchid.Common.String.Format(string=code_block_4.out1, item0=number_2@L1)
setSheetNumber = Sheet.SetSheetNumber(sheet=create, sheetNumber=format_2)

# group: Find room elevation by name
view_type = ViewType("Elevation")
byViewType = Orchid.RevitProject.Views.View.ByViewType(viewType=view_type)
name = Element.Name(element=byViewType)
contains = String.Contains(string=name, searchFor=code_block.out1, lacing=CrossProduct)
anyTrue = Orchid.Common.List.AnyTrue(list=contains)
filterByBoolMask_2 = List.FilterByBoolMask(list=byViewType, mask=anyTrue)

# group: Group elevation by room
name_2 = Element.Name(element=filterByBoolMask_2.in)
code_block_5 = CodeBlock { "_R"; }
# note: If room id cant be found in the string
# null will be returned!
substring = Orchid.Common.String.Substring(string=name_2, startsWith=code_block_5, endsWith=code_block.out0@L1)
clean = Orchid.Common.List.Clean(list=substring)
flatten = List.Flatten(list=clean)
groupByKey = List.GroupByKey(list=filterByBoolMask_2.in, keys=flatten)

# group: ViewPort location on sheet
code_block_6 = CodeBlock(sheet=create, view=groupByKey.groups)
# ---------- code_block_6.designscript (5 lines) ----------
// Sheet
sheet;

// View
view;
# ----------------------------------------
addView = Orchid.RevitProject.Views.Sheet.AddView(sheet=code_block_6.sheet, view=code_block_6.view)
await_ = Orchid.Common.DataStream.Await(pass=code_block_6.view, waitFor0=addView)
associated = Orchid.RevitProject.Views.View.Associated(view=await_)
cropBox = Orchid.RevitProject.Views.View.CropBox(view=code_block_6.view)
length = Curve.Length(curve=cropBox.Curve)
round = Math.Round(number=length)
code_block_7 = CodeBlock()
# ---------- code_block_7.designscript (5 lines) ----------
// Width
1;

// Height
0;
# ----------------------------------------
getItemAtIndex = List.GetItemAtIndex(list=round@@L2, index=code_block_7.out0)
scale = View.Scale(view=code_block_6.view)
code_block_8 = CodeBlock(value=getItemAtIndex, scale=scale) { ((value * 1/scale)/2)+10; value/2+scale*10; }
scan = Orchid.Common.Math.Scan(values=code_block_8.out1)
code_block_9 = CodeBlock(val=scan, scale=scale)
# ---------- code_block_9.designscript (4 lines) ----------
// X position
t = List.Insert(val@L2<1>, 0, 0);
dist = val+t;
-dist-scale*210;
# ----------------------------------------
getItemAtIndex_2 = List.GetItemAtIndex(list=round@@L2, index=code_block_7.out1)
code_block_10 = CodeBlock(dist=getItemAtIndex_2, scale=scale)
# ---------- code_block_10.designscript (2 lines) ----------
// Y position
dist/2+scale*20;
# ----------------------------------------
byCoordinates = Point.ByCoordinates(x=code_block_9.out2, y=code_block_10)
move = Orchid.RevitProject.Views.Viewport.Move(viewport=associated.Viewport, point=byCoordinates)

# group: Find room floor plan by name
view_type_2 = ViewType("FloorPlan")
byViewType_2 = Orchid.RevitProject.Views.View.ByViewType(viewType=view_type_2)
name_3 = Element.Name(element=byViewType_2)
contains_2 = String.Contains(string=name_3, searchFor=code_block.out1, lacing=CrossProduct)
anyTrue_2 = Orchid.Common.List.AnyTrue(list=contains_2)
filterByBoolMask_3 = List.FilterByBoolMask(list=byViewType_2, mask=anyTrue_2)

# group: Find room ceiling plan by name
view_type_3 = ViewType("CeilingPlan")
byViewType_3 = Orchid.RevitProject.Views.View.ByViewType(viewType=view_type_3)
name_4 = Element.Name(element=byViewType_3)
contains_3 = String.Contains(string=name_4, searchFor=code_block.out1, lacing=CrossProduct)
anyTrue_3 = Orchid.Common.List.AnyTrue(list=contains_3)
filterByBoolMask_4 = List.FilterByBoolMask(list=byViewType_3, mask=anyTrue_3)

# group: Combine pr. room
list_create = List.Create()  # unwired: item0, item1
combine = List.Combine(combineFunction=list_create, list0=filterByBoolMask_3.in, list1=filterByBoolMask_4.in)

# group: ViewPort location on sheet
code_block_11 = CodeBlock(sheet=create, view=combine)  # same code as code_block_6
addView_2 = Orchid.RevitProject.Views.Sheet.AddView(sheet=code_block_11.sheet, view=code_block_11.view)
await_2 = Orchid.Common.DataStream.Await(pass=code_block_11.view, waitFor0=addView_2)
associated_2 = Orchid.RevitProject.Views.View.Associated(view=await_2)
cropBox_2 = Orchid.RevitProject.Views.View.CropBox(view=code_block_11.view)
length_2 = Curve.Length(curve=cropBox_2.Curve)
round_2 = Math.Round(number=length_2)
code_block_12 = CodeBlock()  # same code as code_block_7
getItemAtIndex_3 = List.GetItemAtIndex(list=round_2@@L2, index=code_block_12.out0)
scale_2 = View.Scale(view=code_block_11.view)
code_block_13 = CodeBlock(value=getItemAtIndex_3, scale=scale_2) { ((value * 1/scale)/2)+10; value/2+scale*10; }
scan_2 = Orchid.Common.Math.Scan(values=code_block_13.out1)
code_block_14 = CodeBlock(val=scan_2, scale=scale_2)  # same code as code_block_9
getItemAtIndex_4 = List.GetItemAtIndex(list=round_2@@L2, index=code_block_12.out1)
code_block_15 = CodeBlock(lowerDist=getItemAtIndex_2, dist=getItemAtIndex_4, scale=scale_2)
# ---------- code_block_15.designscript (4 lines) ----------
// Y position
// Note. 'lowerDist' is viewport
// height i the row below
lowerDist+dist/2+scale*40;
# ----------------------------------------
byCoordinates_2 = Point.ByCoordinates(x=code_block_14.out2, y=code_block_15)
move_2 = Orchid.RevitProject.Views.Viewport.Move(viewport=associated_2.Viewport, point=byCoordinates_2)

# group: Set viewport label
join = List.Join(list0=move, list1=move_2)
code_block_16 = CodeBlock()
# ---------- code_block_16.designscript (2 lines) ----------
// Label on sheet
"No Title";
# ----------------------------------------
labelByName = Orchid.RevitProject.Views.Viewport.LabelByName(name=code_block_16)
setLabel = Orchid.RevitProject.Views.Viewport.SetLabel(viewport=join, label=labelByName)
