# Dynamo graph Scheduling.dyn (Dynamo 2.19.3.6394)
# packages: Orchid 2.19.5.6567

# group: Selection
# File: defaultProject
code_block = CodeBlock { "CategoryType"; "Model"; "Annotation"; "AnalyticalModel"; "Internal"; }
enumByName = Orchid.AdeskApps.Revit.EnumByName(enumType=code_block.out0, valueName=code_block.out1)
byCategoryType = Orchid.RevitProject.Elements.Element.ByCategoryType(categoryType=enumByName)
watch = Watch(byCategoryType.Category)
copyTo = Orchid.Common.Clipboard.CopyTo(object=byCategoryType.Category)

# group: Add shared parameter
code_block_2 = CodeBlock()
# ---------- code_block_2.designscript (6 lines) ----------
//Parameter name
"DTU_ProductID";
//GroupType
"DTU_Facility";
//GroupType
"AdskModelProperties";
# ----------------------------------------
byName = Orchid.AdeskApps.Units.GroupType.ByName(string=code_block_2.out2)
add = Orchid.RevitProject.Parameters.SharedParameter.Add(parameterName=code_block_2.out0, groupName=code_block_2.out1, groupType=byName)

# group: Create Schedules
code_block_3 = CodeBlock()
# ---------- code_block_3.designscript (7 lines) ----------
[
//"Ceilings",
"Doors",
"Floors",
"Windows",
"Walls"
];
# ----------------------------------------
byName_2 = Category.ByName(name=code_block_3)
code_block_4 = CodeBlock(category=byName_2) { t = category; t+"_Shedule"; "RegularSchedule"; }
createSchedule = ScheduleView.CreateSchedule(category=code_block_4.t, name=code_block_4.out1, scheduleType=code_block_4.out2)
await_ = Orchid.Common.DataStream.Await(pass=createSchedule, waitFors=add.ParameterElement)
schedulableFields = ScheduleView.SchedulableFields(scheduleView=await_)
code_block_5 = CodeBlock()
# ---------- code_block_5.designscript (9 lines) ----------
[
"DTU_ProductID",
"Type",
"Count",

// these are not avalible
// in all schedules!
"Level",
"Base Constraint"];
# ----------------------------------------
# note: Due to some parameters are not present in all elements, an error will occur!
byName_3 = Orchid.RevitProject.Schedules.SchedulableField.ByName(schedulableField=schedulableFields@L2, name=code_block_5)
clean = Orchid.Common.List.Clean(list=byName_3)
addFields = ScheduleView.AddFields(scheduleView=createSchedule@L1, fields=clean@L2)
schedule_type = ScheduleTypes("RegularSchedule")

# group: Format the field (column)
code_block_6 = CodeBlock { "Count"; }
byName_4 = Orchid.RevitProject.Schedules.SchedulableField.ByName(schedulableField=clean, name=code_block_6, lacing=Longest)
field = Orchid.RevitProject.Schedules.ScheduleField.Field(scheduleView=addFields, schedulableField=byName_4)
code_block_7 = CodeBlock { "ScheduleHorizontalAlignment"; "Right"; "ScheduleFieldDisplayType"; "Totals"; }
enumByName_2 = Orchid.AdeskApps.Revit.EnumByName(enumType=code_block_7.out0, valueName=code_block_7.out1)
enumByName_3 = Orchid.AdeskApps.Revit.EnumByName(enumType=code_block_7.out2, valueName=code_block_7.out3)
format = Orchid.RevitProject.Schedules.ScheduleField.Format(scheduleField=field, horizontalAlignment=enumByName_2, calculate=enumByName_3)
schedule_field_display_types = ScheduleFieldDisplayType("Max")
schedule_heading_orientations = ScheduleHeadingOrientation("Vertical")
schedule_horizontal_alignments = ScheduleHorizontalAlignment("Center")

# group: Set the schedule
schedule_footer_types = ScheduleFooterType("TitleTotals")
schedule_sort_order = ScheduleSortOrder("Descending")
await_2 = Orchid.Common.DataStream.Await(pass=addFields, waitFors=format)
code_block_8 = CodeBlock()
# ---------- code_block_8.designscript (8 lines) ----------
["DTU_ProductID","Type"];
// footer
"ScheduleFooter";
["Totals","None"];
// blankLine
[true,false];
"Totals";
true;
# ----------------------------------------
enumByName_4 = Orchid.Common.Orchid.EnumByName(enumType=code_block_8.out1, valueName=code_block_8.out2)
enumByName_5 = Orchid.Common.Orchid.EnumByName(enumType=code_block_8.out1, valueName=code_block_8.out4)
sortingGrouping = Orchid.RevitProject.Schedules.Schedule.SortingGrouping(scheduleView=await_2, name=code_block_8.out0, footer=enumByName_4, blankLine=code_block_8.out3, grandTotals=enumByName_5, itemize=code_block_8.out5)
