# Dynamo graph SheetViews.dyn (Dynamo 2.19.3.6394)
# packages: Orchid 2.19.3.6432

# group: 
# File: defaultProject
inDocument = Orchid.RevitProject.Views.Sheet.InDocument()

content = Orchid.RevitProject.Views.Sheet.Content(sheet=inDocument)
isShedule = Orchid.RevitProject.Views.View.IsShedule(view=content)
filterByBoolMask = List.FilterByBoolMask(list=content, mask=isShedule)
onSheet = Orchid.RevitProject.Schedules.Schedule.OnSheet(scheduleView=filterByBoolMask.in)
watch = Watch(onSheet)
onSheet_2 = Orchid.RevitProject.Views.View.OnSheet(view=filterByBoolMask.out)
watch_2 = Watch(onSheet_2)
watch_3 = Watch(content)
schedules = Sheet.Schedules(sheet=inDocument)
watch_4 = Watch(schedules)
views = Sheet.Views(sheet=inDocument)
watch_5 = Watch(views)
