# Dynamo graph Sheet_VisibilityGraphic.dyn (Dynamo 2.19.3.6394)
# packages: Orchid 2.19.4.6484

# group: Get views not on sheet
# File: defaultProject
model = Orchid.RevitProject.Views.View.Model()
inDocument = Orchid.RevitProject.Views.Sheet.InDocument()
content = Orchid.RevitProject.Views.Sheet.Content(sheet=inDocument)
flatten = List.Flatten(list=content)
contains = List.Contains(list=model, item=flatten, lacing=CrossProduct)
anyTrue = Orchid.Common.List.AnyTrue(list=contains, lacing=Longest)
filterByBoolMask = List.FilterByBoolMask(list=model, mask=anyTrue)

# group: Remove all element graphic overides
unhideElements = Orchid.RevitProject.Views.View.UnhideElements(view=filterByBoolMask.out)  # frozen
removeElementOverrides = Orchid.RevitProject.Views.View.RemoveElementOverrides(view=unhideElements)

# group: All overrides in document
removeElementOverrides_2 = Orchid.RevitProject.Views.View.RemoveElementOverrides()  # frozen
removeCategoryOverrides = Orchid.RevitProject.Views.View.RemoveCategoryOverrides()  # frozen

# group: Remove all category graphic overides
code_block = CodeBlock(views=filterByBoolMask.out) { views; }
code_block_2 = CodeBlock { "Walls"; }  # frozen
byName = Category.ByName(name=code_block_2)
removeCategoryOverrides_2 = Orchid.RevitProject.Views.View.RemoveCategoryOverrides(view=code_block, category=byName)
removeCategoryOverrides_3 = Orchid.RevitProject.Views.View.RemoveCategoryOverrides(view=code_block)

# group: Visibiliti graphics by pane
# ONLY view on sheet
boolean = BoolSelector(true)
visibilityGraphic = Orchid.RevitProject.Views.View.VisibilityGraphic(view=filterByBoolMask.in, analyticalCategories=boolean, importCategories=boolean)

# group: Remove all element graphic overides
code_block_3 = CodeBlock(views=filterByBoolMask.out) { views; }  # frozen
element = Orchid.RevitProject.Views.View.Element(view=code_block_3)
removeElementOverrides_3 = Orchid.RevitProject.Views.View.RemoveElementOverrides(view=code_block_3, element=element)
removeElementOverrides_4 = Orchid.RevitProject.Views.View.RemoveElementOverrides(view=code_block_3)
