# Dynamo graph StartingView.dyn (Dynamo 2.16.1.2727)
# packages: Orchid 2.19.3.6432

views = Views("{3D}")  # graph input
setStartingView = Orchid.RevitProject.Common.Document.SetStartingView(view=views)
watch = Watch(setStartingView)
