# Dynamo graph View-Cropbox.dyn (Dynamo 2.19.3.6394)
# packages: Orchid 2.19.5.6567

# group: Adjust view crop box
model = Orchid.RevitProject.Views.View.Model()
cropBox = Orchid.RevitProject.Views.View.CropBox(view=model)

# group: Proces by vector
select_model_element = DSModelElementSelection()  # 1 picked in the model; graph input
getLocation = Element.GetLocation(element=select_model_element)
asVector = Point.AsVector(point=getLocation)
reverse = Vector.Reverse(vector=asVector)

# group: ...by curve
startPoint = Curve.StartPoint(curve=cropBox.Curve)
add = Point.Add(point=startPoint, vectorToAdd=reverse)
endPoint = Curve.EndPoint(curve=cropBox.Curve)
add_2 = Point.Add(point=endPoint, vectorToAdd=reverse)
byStartPointEndPoint = Line.ByStartPointEndPoint(startPoint=add, endPoint=add_2)
setCropBox = Orchid.RevitProject.Views.View.SetCropBox(view=model, curve=byStartPointEndPoint)

# group: Adjust view crop box
model_2 = Orchid.RevitProject.Views.View.Model()
moveCropBox = Orchid.RevitProject.Views.View.MoveCropBox(view=model_2, point=getLocation)

# group: Adjust sectionsbox
threeD = Orchid.RevitProject.Views.View.ThreeD()
moveSectionBox = Orchid.RevitProject.Views.View.MoveSectionBox(view3D=threeD, point=getLocation)

# group: ...by bounding box
minPoint = BoundingBox.MinPoint(boundingBox=cropBox.BoundingBox)
add_3 = Point.Add(point=minPoint, vectorToAdd=reverse)
maxPoint = BoundingBox.MaxPoint(boundingBox=cropBox.BoundingBox)
add_4 = Point.Add(point=maxPoint, vectorToAdd=reverse)
byCorners = BoundingBox.ByCorners(min=add_3, max=add_4)
setCropBox_2 = Orchid.RevitProject.Views.View.SetCropBox(view=model, boundingBox=byCorners)

# group: Adjust view
model_3 = Orchid.RevitProject.Views.View.Model()
move = Orchid.RevitProject.Views.View.Move(view=model_3, point=getLocation)

# group: Model view
model_views = ModelView("Level 1 (door)")  # graph input
watch = Watch(model_views)

# group: Sheet view
sheet_views = SheetView("Level 1 (door)")  # graph input
watch_2 = Watch(sheet_views)

# group: Design option
design_options = DesignOption("Option 1  <primary>")
watch_3 = Watch(design_options)

# group: Scope box
# File: defaultProject_extended
scope_boxes = ScopeBox("Scope Box 1")
watch_4 = Watch(scope_boxes)

# group: Collect all view
inDocument = Orchid.RevitProject.Views.View.InDocument()
watch_5 = Watch(inDocument)
threeD_2 = Orchid.RevitProject.Views.View.ThreeD()
watch_6 = Watch(threeD_2)

# group: Collect sselected view by view family type
code_block = CodeBlock()
# ---------- code_block.designscript (3 lines) ----------
["Floor Plan",
"Section",
"3D View"];
# ----------------------------------------
byName = Orchid.RevitProject.Views.ViewFamilyType.ByName(name=code_block)
byViewFamilyType = Orchid.RevitProject.Views.View.ByViewFamilyType(viewFamilyType=byName.ViewFamilyType)
watch_7 = Watch(byViewFamilyType)
view_family_types = ViewFamilyType("Floor Plan")

# group: Collect sselected view by view family type
code_block_2 = CodeBlock()
# ---------- code_block_2.designscript (4 lines) ----------
"ViewType";
["FloorPlan",
"Section",
"ThreeD"];
# ----------------------------------------
enumByName = Orchid.AdeskApps.Revit.EnumByName(enumType=code_block_2.out0, valueName=code_block_2.out1, lacing=Longest)
byViewType = Orchid.RevitProject.Views.View.ByViewType(viewType=enumByName)
watch_8 = Watch(byViewType)
view_type = ViewType("FloorPlan")

# group: Adjust viewport on sheet
inDocument_2 = Orchid.RevitProject.Views.Viewport.InDocument()
move_2 = Orchid.RevitProject.Views.Viewport.Move(viewport=inDocument_2, point=getLocation)
