# Dynamo graph ViewDuplicate-ViewTemplate.dyn (Dynamo 2.19.3.6394)
# packages: Orchid 2.19.3.6432

# group: Duplicate view
# File: defaultProject
inDocument = Orchid.RevitProject.Datums.Level.InDocument()
byLevel = FloorPlanView.ByLevel(level=inDocument)
concat = String.Concat()  # unwired: string0, string1
code_block = CodeBlock()
# ---------- code_block.designscript (3 lines) ----------
//Text to add
["Arch plan - ",
"Struc plan - "];
# ----------------------------------------
name = Element.Name(element=inDocument)
cartesianProduct = List.CartesianProduct(comb=concat, list1=code_block, list2=name)
transpose = List.Transpose(lists=cartesianProduct)
view_duplicate_options = ViewDuplicateOption("Duplicate")  # graph input
duplicate = Orchid.RevitProject.Views.View.Duplicate(view=byLevel, name=transpose, option=view_duplicate_options)
transpose_2 = List.Transpose(lists=duplicate)
await_ = Orchid.Common.DataStream.Await(pass=byLevel, waitFors=duplicate)
delete = Orchid.RevitProject.Elements.Element.Delete(element=await_)
buildingStory = Orchid.RevitProject.Datums.Level.BuildingStory()

# group: Find view template in model
inDocument_2 = Orchid.RevitProject.Views.ViewTemplate.InDocument()
code_block_2 = CodeBlock()
# ---------- code_block_2.designscript (3 lines) ----------
// ViewTemplate to use
["Architectural Plan",
"Structural Building Plan"];
# ----------------------------------------
name_2 = Element.Name(element=inDocument_2.ViewTemplate)
contains = List.Contains(list=code_block_2, item=name_2@@L1)
filterByBoolMask = List.FilterByBoolMask(list=inDocument_2.ViewTemplate, mask=contains)
flatten = List.Flatten(list=filterByBoolMask.in)

# group: Set view template
name_3 = Element.Name(element=flatten)
byKeysValues = DesignScript.Builtin.Dictionary.ByKeysValues(keys=name_3, values=flatten)
valueAtKey = DesignScript.Builtin.Dictionary.ValueAtKey(dictionary=byKeysValues, key=name_3)
set = Orchid.RevitProject.Views.ViewTemplate.Set(view=transpose_2, viewTemplate=valueAtKey)
