# Dynamo graph ViewHandling.dyn (Dynamo 2.19.3.6394)
# packages: Orchid 2.19.3.6432

# group: Get views
activeView = Orchid.RevitProject.Common.Document.ActiveView()
inDocument = Orchid.RevitProject.Views.Sheet.InDocument()
view = Orchid.RevitProject.Views.Sheet.View(sheet=inDocument)
flatten = List.Flatten(list=view)

# group: Has view a view template attached
hasViewTemplate = Orchid.RevitProject.Views.View.HasViewTemplate(view=flatten)
watch = Watch(hasViewTemplate)

# group: Set link visibility
# File: LinkedProject
code_block = CodeBlock { "Level 1 (door)"; }
byName = Orchid.RevitProject.Views.View.ByName(name=code_block)
revitLink = Orchid.RevitProject.Common.Link.RevitLink()
boolean = BoolSelector(false)
setLinkVisibility = Orchid.RevitProject.Views.View.SetLinkVisibility(view=byName, link=revitLink, visible=boolean)

# group: Get link visibility
linkVisibility = Orchid.RevitProject.Views.View.LinkVisibility(view=byName)
watch_2 = Watch(linkVisibility.Link)
watch_3 = Watch(linkVisibility.boolean)

# group: Get link visibility
revitLink_2 = Orchid.RevitProject.Common.Link.RevitLink()
linkVisibility_2 = Orchid.RevitProject.Views.View.LinkVisibility(view=flatten, link=revitLink_2, lacing=Longest)
watch_4 = Watch(linkVisibility_2)
