# Dynamo graph ViewHandling_R25.dyn (Dynamo 3.3.0.6316)
# packages: Orchid 3.3.1.6589

# group: Get views
activeView = Orchid.RevitProject.Common.Document.ActiveView()
inDocument = Orchid.RevitProject.Views.Sheet.InDocument()
view = Orchid.RevitProject.Views.Sheet.View(sheet=inDocument)
flatten = List.Flatten(list=view)

# group: Has view a view template attached
hasViewTemplate = Orchid.RevitProject.Views.View.HasViewTemplate(view=flatten)
watch = Watch(hasViewTemplate)

# group: Set link visibility
# File: LinkedProject
code_block = CodeBlock { "Level 1 (door)"; }
byName = Orchid.RevitProject.Views.View.ByName(name=code_block)
revitLink = Orchid.RevitProject.Common.Link.RevitLink()
boolean = BoolSelector(false)
setLinkVisibility = Orchid.RevitProject.Views.View.SetLinkVisibility(view=byName, link=revitLink, visible=boolean)  # frozen

# group: Get link visibility
linkVisibility = Orchid.RevitProject.Views.View.LinkVisibility(view=byName)
watch_2 = Watch(linkVisibility.Link)
watch_3 = Watch(linkVisibility.boolean)

# group: Get link visibility
revitLink_2 = Orchid.RevitProject.Common.Link.RevitLink()
linkVisibility_2 = Orchid.RevitProject.Views.View.LinkVisibility(view=flatten, link=revitLink_2, lacing=Longest)
watch_4 = Watch(linkVisibility_2)

# group: Link display setting
instance = Orchid.RevitProject.Common.Link.Instance(link=revitLink)
code_block_2 = CodeBlock()
# ---------- code_block_2.designscript (6 lines) ----------
// LinkVisibility enum
"LinkVisibility";
// values
"ByHostView";
"ByLinkView";
"Custom";
# ----------------------------------------
enumByName = Orchid.AdeskApps.Revit.EnumByName(enumType=code_block_2.out0, valueName=code_block_2.out2)
document = Orchid.RevitProject.Common.Link.Document(instance=instance)
code_block_3 = CodeBlock()
# ---------- code_block_3.designscript (5 lines) ----------
// View name
"Level 1";
// ViewType enum
"ViewType";
"FloorPlan";
# ----------------------------------------
enumByName_2 = Orchid.AdeskApps.Revit.EnumByName(enumType=code_block_3.out1, valueName=code_block_3.out2)
byNameAndViewType = Orchid.RevitProject.Views.View.ByNameAndViewType(document=document, name=code_block_3.out0, viewType=enumByName_2)
flatten_2 = List.Flatten(list=byNameAndViewType)
linkDisplaySetting = Orchid.RevitProject.Views.View.LinkDisplaySetting(instance=instance, view=byName, setting=enumByName, linkView=flatten_2)
