# Dynamo graph ViewRotateHandling.dyn (Dynamo 2.19.3.6394)
# packages: Orchid 2.19.3.6432, Orchid 2.19.4.6486

# group: Project Origin
code_block = CodeBlock { Autodesk.Point.ByCoordinates(0, 0, 0); 45; }

# group: Rotate view
model = Orchid.RevitProject.Views.View.Model()
rotate = Orchid.RevitProject.Views.View.Rotate(view=model, point=code_block.out0, angle=code_block.out1)

# group: Rotate sectionsbox
threeD = Orchid.RevitProject.Views.View.ThreeD()
rotateSectionBox = Orchid.RevitProject.Views.View.RotateSectionBox(view3D=threeD, point=code_block.out0, angle=code_block.out1)

# group: Rotate view crop box
# File: defaultProject
model_2 = Orchid.RevitProject.Views.View.Model()
cropBox = Orchid.RevitProject.Views.View.CropBox(view=model_2)
center = Orchid.Geometry.DynamoBoundingBox.Center(dynamoBoundingBox=cropBox.BoundingBox)
code_block_2 = CodeBlock { -45; }
rotateCropBox = Orchid.RevitProject.Views.View.RotateCropBox(view=model_2, point=center, angle=code_block_2)
plan = Orchid.RevitProject.Views.View.Plan()
