# Dynamo graph ViewDuplicate-ViewTemplate.dyn (Dynamo 2.16.2.5624)
# packages: Orchid 216.3.0.5794

# group: Duplicate view
# File: defaultProject
inDocument = Orchid.RevitProject.Datums.Level.InDocument()
byLevel = FloorPlanView.ByLevel(level=inDocument)
concat = String.Concat()  # unwired: string0, string1
code_block = CodeBlock()
# ---------- code_block.designscript (4 lines) ----------
//Text to add
["DTU_Export DWG - ",
"DTU_Upload - ",
"DTU_Check - "];
# ----------------------------------------
name = Element.Name(element=inDocument)
cartesianProduct = List.CartesianProduct(comb=concat, list1=code_block, list2=name)
transpose = List.Transpose(lists=cartesianProduct)
view_duplicate_options = ViewDuplicateOption("Duplicate")  # graph input
duplicate = Orchid.RevitProject.Views.View.Duplicate(view=byLevel, name=transpose, option=view_duplicate_options)
transpose_2 = List.Transpose(lists=duplicate)
await_ = Orchid.Common.DataStream.Await(pass=byLevel, waitFor=duplicate)
delete = Orchid.RevitProject.Elements.Element.Delete(element=await_)
buildingStory = Orchid.RevitProject.Datums.Level.BuildingStory()

# group: Find view template in model
inDocument_2 = Orchid.RevitProject.Views.ViewTemplate.InDocument()
code_block_2 = CodeBlock()
# ---------- code_block_2.designscript (4 lines) ----------
// ViewTemplate to use
["DTU_Export DWG",
"DTU_FM Upload",
"DTU_FM Check"];
# ----------------------------------------
name_2 = Element.Name(element=inDocument_2.ViewTemplate)
contains = List.Contains(list=code_block_2, item=name_2@L1)
filterByBoolMask = List.FilterByBoolMask(list=inDocument_2.ViewTemplate, mask=contains)

# group: Set view template
name_3 = Element.Name(element=filterByBoolMask.in)
byKeysValues = DesignScript.Builtin.Dictionary.ByKeysValues(keys=name_3, values=filterByBoolMask.in)
valueAtKey = DesignScript.Builtin.Dictionary.ValueAtKey(dictionary=byKeysValues, key=code_block_2)
set = Orchid.RevitProject.Views.ViewTemplate.Set(view=transpose_2, viewTemplate=valueAtKey)

watch = Watch(set)
