# Dynamo graph WallHole.dyn (Dynamo 2.19.3.6394)
# packages: Orchid 2.19.3.6432

# group: Get hole elements as document (family edit)
# File: WallHole
code_block = CodeBlock { "Generic Models"; }
byName = Category.ByName(name=code_block)
byCategory = Orchid.RevitProject.Elements.Element.ByCategory(category=byName)
flatten = List.Flatten(list=byCategory.Element)
name = Element.Name(element=flatten)
code_block_2 = CodeBlock()
# ---------- code_block_2.designscript (2 lines) ----------
// Search string
"Hole";
# ----------------------------------------
contains = String.Contains(string=name, searchFor=code_block_2)
filterByBoolMask = List.FilterByBoolMask(list=flatten, mask=contains)
getFamily = FamilyInstance.GetFamily(familyInstance=filterByBoolMask.in)
edit = Orchid.RevitProject.Elements.Family.Edit(family=getFamily)

# group: filter for valid holes
get = Orchid.Geometry.Form.Get(document=edit)
flatten_2 = List.Flatten(list=get)
code_block_3 = CodeBlock { "Walls"; }
byName_2 = Category.ByName(name=code_block_3)
byCategory_2 = Orchid.RevitProject.Elements.Element.ByCategory(category=byName_2)
flatten_3 = List.Flatten(list=byCategory_2.Element)

# group: find host elements (DynamoSolid)
dynamoSolid = Orchid.Geometry.Form.DynamoSolid(form=flatten_2)
flatten_4 = List.Flatten(list=dynamoSolid)
intersect = Orchid.Geometry.DynamoSolid.Intersect(dynamoSolid=flatten_4)
watch = Watch(intersect)
intersect_2 = Orchid.Geometry.DynamoSolid.Intersect(dynamoSolid=flatten_4, elements=flatten_3)
watch_2 = Watch(intersect_2)

# group: find host elements (RevitSolid)
revitSolid = Orchid.Geometry.Form.RevitSolid(form=flatten_2)
flatten_5 = List.Flatten(list=revitSolid)
intersect_3 = Orchid.Geometry.RevitSolid.Intersect(revitSolid=flatten_5)
watch_3 = Watch(intersect_3)
intersect_4 = Orchid.Geometry.RevitSolid.Intersect(revitSolid=flatten_5, elements=flatten_3)
watch_4 = Watch(intersect_4)

# group: close document
await_ = Orchid.Common.DataStream.Await(pass=edit, waitFor0=watch, waitFor1=watch_2, waitFor2=watch_3, waitFor3=watch_4)
close = Orchid.RevitProject.Common.Document.Close(document=await_)
