# Dynamo graph ChangeMEPSystemClass.dyn (Dynamo 2.19.3.6394)
# packages: Orchid 2.19.3.6432

# group: Change system
# File: Colling
code_block = CodeBlock()
# ---------- code_block.designscript (3 lines) ----------
["Kølevand, 30% propylene gylkol, Frem",
"Kølevand, 30% propylene gylkol, Retur"];
["Cooling Supply","Cooling Return"];
# ----------------------------------------
byName = Orchid.RevitProject.Systems.MEPSystem.ByName(name=code_block.out0)
pipe = Orchid.RevitProject.Systems.Piping.Pipe(pipingSystem=byName)
byName_2 = Orchid.RevitProject.Systems.MEPSystemType.ByName(name=code_block.out1)
setSystemType = Orchid.RevitProject.Systems.Networks.Pipe.SetSystemType(element=pipe, systemType=byName_2)
