# Dynamo graph Mechanical_SystemTree_Handling.dyn "SystemTreeHandling" (Dynamo 2.19.3.6394)
# packages: Orchid 2.19.2.6353

# group: Root element
code_block = CodeBlock()
# ---------- code_block.designscript (4 lines) ----------
// Pick an element
// in the model and
// get its elementId
4339673;
# ----------------------------------------
element_by_id = ElementById(Id=code_block)

# group: Create SystemTree from MEPSystem
# File: Ventilation_Magicad
inDocument = Orchid.RevitProject.Systems.MEPSystem.InDocument()
mechanical = Orchid.RevitProject.Systems.MEPSystem.Mechanical(system=inDocument)
code_block_2 = CodeBlock()
# ---------- code_block_2.designscript (3 lines) ----------
//0 -- VI 1
//19 -- VI 13
0;
# ----------------------------------------
getItemAtIndex = List.GetItemAtIndex(list=mechanical, index=code_block_2)
create = Orchid.RevitProject.Systems.SystemTree.Create(mechanicalSystem=getItemAtIndex, rootElement=element_by_id)

name = Element.Name(element=mechanical)
watch = Watch(name)

# group: SystemTree element
treeElement = Orchid.RevitProject.Systems.SystemTree.TreeElement(systemTree=create)
watch_2 = Watch(treeElement)

# group: SystemTree component
boolean = BoolSelector(true)
treeComponent = Orchid.RevitProject.Systems.SystemTree.TreeComponent(systemTree=create, include=boolean)
watch_3 = Watch(treeComponent)

# group: Export
boolean_2 = BoolSelector(false)
path = Orchid.RevitProject.Common.Document.Path(withExtension=boolean_2)
exportJSON = Orchid.RevitProject.Systems.SystemTree.ExportJSON(systemTree=create, file=path)
exportXML = Orchid.RevitProject.Systems.SystemTree.ExportXML(systemTree=create, file=path)

# group: Starting element
code_block_3 = CodeBlock()
# ---------- code_block_3.designscript (4 lines) ----------
// Pick an element
// in the model and
// get its elementId
4278493;
# ----------------------------------------
element_by_id_2 = ElementById(Id=code_block_3)

# group: SystemTree element
leafElement = Orchid.RevitProject.Systems.SystemTree.LeafElement(systemTree=create, element=element_by_id_2)
watch_4 = Watch(leafElement)

# group: SystemTree element
branchElement = Orchid.RevitProject.Systems.SystemTree.BranchElement(systemTree=create, element=element_by_id_2)
watch_5 = Watch(branchElement)

# group: SystemTree branch component
boolean_3 = BoolSelector(true)
branchComponent = Orchid.RevitProject.Systems.SystemTree.BranchComponent(systemTree=create, element=element_by_id_2, include=boolean_3)
watch_6 = Watch(branchComponent)

# group: SystemTree branch component
boolean_4 = BoolSelector(true)
leafComponent = Orchid.RevitProject.Systems.SystemTree.LeafComponent(systemTree=create, element=element_by_id_2, include=boolean_4)
watch_7 = Watch(leafComponent)
